# Dynamo graph Automatic fire detection.dyn (Dynamo 2.0.0.4654)

# group: DS to calculate the spacing
spacing_calc = CodeBlock()
# ---------- spacing_calc.designscript (50 lines) ----------
/*This is the definition which works out the detector spacing along a given line
Inputs:
l = Line length
s = Detector diameter

Outputs:
c[] = array of detector spacing*/


def Points(l,s){

a=[Imperative]{
	//this calculates the number of detectors needed along the line
	if(l%s==0){
		return=Math.Floor((l/s)-1);
	}
	else{
		return=Math.Floor(l/s);
	}
	}

c[a]=null;

[Imperative]{
	//this caculates where to put the detectors
	if(l<=s){
		c[]=[l/2];
//One detector in the center;
	}
	elseif(l>s&&l<=s+s/2){
		c[]=[l/3,(l*2)/3];
//Two detectors evenly spaced from either end;
	}
	elseif(l>s+s/2&&l<=2*s){
		c[]=[s/2,l-s/2];
//Two detectors half spacing distance from either end;
	}
	elseif(l>s*2){
		for(j in 1..a-1){
			c[j]=(j*((l-s)/(a))+(s/2));
//X no. detectors evenly spaced;
			}
		c[0]=s/2;
//and two detectors half spacing distance from either end;
		c[a]=l-s/2;
		}

		}
return=c[];
};
# ----------------------------------------

# group: Please only edit here! Select the detector type, spacing in X & Y directions (12000mm optical or 10000mm heat), area coverage (100m2 optical or 50m2 heat) and offset height.
family_types = FamilyTypes()  # nothing selected; graph input
detector_coverage = DoubleSlider(100, range=50..100 step 50)  # graph input
detector_coverage_spacing = DoubleSlider(12000, range=6000..12000 step 1000)  # "Detector Coverage Spacing Perpendicular Edge"; graph input
detector_coverage_spacing_2 = DoubleSlider(12000, range=6000..12000 step 1000)  # "Detector Coverage Spacing Longest Edge"; graph input
detector_height = DoubleSlider(2400, range=0..5000 step 10)  # graph input

# group: Converts the selected elements to room boundaries & areas and collects the space IDs
pick_model_elements = Custom[Pick Model Elements]()  # This node offers a pick method for selecting elements in Revit.
area = Custom[Element.Area](element=pick_model_elements)  # Returns the area property of a given element (if that element has such a property)
boolean = BoolSelector(false)  # graph input
clean = List.Clean(list=area, preserveIndices=boolean)
boundaries = Custom[Room.Boundaries](room=pick_model_elements)  # Gets a list of all boundary elements of a given room or area
clean_2 = List.Clean(list=boundaries.curves, preserveIndices=boolean)
isEmpty = List.IsEmpty(list=boundaries.curves, lacing=Longest)
filterByBoolMask = List.FilterByBoolMask(list=pick_model_elements, mask=isEmpty)

# group: Find out if the main wall of the space is a curve or arc (so it can be ignored)
length = Curve.Length(curve=clean_2)
startPoint = Curve.StartPoint(curve=clean_2)
endPoint = Curve.EndPoint(curve=clean_2)
distanceTo = Geometry.DistanceTo(geometry=startPoint, other=endPoint)
eq = length == distanceTo
filterByBoolMask_2 = List.FilterByBoolMask(list=clean_2, mask=eq)

# group: Finds the longest boundary wall to start the first calculation
length_2 = Vector.Length(vector=filterByBoolMask_2.in)
maximumItem = List.MaximumItem(list=length_2)
eq_2 = length_2 == maximumItem
filterByBoolMask_3 = List.FilterByBoolMask(list=clean_2, mask=eq_2)
code_block = CodeBlock(l=filterByBoolMask_3.in) { List.GetItemAtIndex(l<1>,0); }

# group: Inital spacing calc along the longest edge
curve_length_of_longest_edge = Curve.Length(curve=code_block)
calc_x_points = CodeBlock(l=curve_length_of_longest_edge, s=detector_coverage_spacing_2) { Points(l,s); }
places_calc_d_points_on_the = Curve.PointAtSegmentLength(curve=code_block, segmentLength=calc_x_points)  # "Places Calc'd points on the Curve"

# group: Finds the normal at each point and reverses the vector direction
normalAtParameter = Curve.NormalAtParameter(curve=code_block, param=calc_x_points)
reverse = Vector.Reverse(vector=normalAtParameter)

# group: Counts up the number of lines in each space
count = List.Count()  # unwired: list
map = List.Map(list=places_calc_d_points_on_the, f_x=count)

# group: DesignScript to create a line perpendicular to the initial spacing calculation then place detectors
perpendicular_spacing = CodeBlock(family_type=family_types, a=detector_coverage, s=detector_coverage_spacing, space_area=clean, bound=clean_2, vec=reverse, point=places_calc_d_points_on_the, count_sum=map, space=filterByBoolMask.out)  # "Perpendicular Spacing Calculation"
# ---------- perpendicular_spacing.designscript (92 lines) ----------
/*This block takes the points calculated with the previous nodes.
Using the normal of each point, projects the point to the opposite boundary wall.
It then creates a line between the two points
and re-runs the spacing calc to find out where to put the detectors.

Inputs:
point = The inital points calculated using the spacing calc
bound = the space boundaries
vec = reversed vector of the point normal
count_sum = an array listing how many inital points are in a space
s = the spacing of each detector
family_type = the type of family to place into revit

Output:
None - this places the family instance in revit

*/

//Below takes in each input
family = family_type;
cover_area = a;
spacing = s;
area[] = space_area;
boundary[] = bound[];
vector[]=vec[];
points[] = point[];
sub_num[] = count_sum[];
spaces[] = space[];

//Below sets up each array
familyinstance[] = null;
perp_lines[][] = null;
clean_perp_lines[][] = null;
final_lines[][] = null;


perp_points[][] = null;
clean_perp_points[][] = null;
line_lengths = null;
points_total[][] = null;
check[] = null;
error[] = null;

[Imperative]{
	for(i in 0..Count(sub_num)){
		for(j in 0..sub_num[i]-1){//This loop projects the points to the opposite boundary

			perp_points[i][j] = points[i][j].Project(boundary[i], vector[i][j]);
		}
	}
}

clean_perp_points[] = List.Clean(perp_points[],false);
//removes nulls and empty lists;
[Imperative]{
	for(i in 0..Count(sub_num)){
		for(j in 0..sub_num[i]-1){//this loop draws a line between each of the above points

			perp_lines[i][j] = Line.ByStartPointEndPoint(clean_perp_points[i][j][0][0],clean_perp_points[i][j][1][0]);
		}
	}


	for(i in 0..Count(sub_num)){
		for(j in 0..sub_num[i]-1){
			//this calculates the line length;
			line_lengths[i][j] = perp_lines[i][j].Length;

			//passes the length and spacing to the spacing calc;
			points_segment[i][j] = Points(line_lengths[i][j],s);

			//Flattens the points list per space
			points_total[i][j] = perp_lines[i][j].PointAtSegmentLength(points_segment[i][j]);
			check[i] = Count(Flatten(points_total[i]));
		}

	}
	//Error checks the space size Vs number of detectors.
	//if there are insufficient dectors for the m2 area of space and error will be output
	for(i in 0..Count(check)-1){
		if(check[i]>(area[i]/cover_area)){
			familyinstance[i] = points_total[i];
		}
		else{
			error[i] = "Please verify shape of space and detector distribution in space: " +spaces[i].Name + ". Current spacing gives "+check[i] +" detectors. Minumum number required is: "+Math.Ceiling(area[i]/cover_area);
		}
	}

};
final_family[] = FamilyInstance.ByPoint(family,List.Clean(familyinstance,false));
error;
final_family;
# ----------------------------------------

# group: Change the detector height
code_block_2 = CodeBlock { "Dimensions_Height_Mounting"; }
setParameterByName = Element.SetParameterByName(element=perpendicular_spacing.out23, parameterName=code_block_2, value=detector_height)

# group: See here for Outputs
detectors_sucesfully_placed = Watch(setParameterByName)
errors = Watch(perpendicular_spacing.out22)
