# Dynamo graph Clash_Detection_WIP.dyn (Dynamo 2.0.0.4654)

code_block = CodeBlock { "Clash Detection"; }
file_path = Filename(".\Logo.png")
fromPath = FileObject(path=file_path)  # "File.FromPath"
readFromFile = Image.ReadFromFile(file=fromPath)
code_block_2 = CodeBlock { "OK"; }
code_block_3 = CodeBlock { "Elements New"; }
code_block_4 = CodeBlock { "Select Navisworks Test"; }
file_path_2 = Filename(".\Logo.png")
fromPath_2 = FileObject(path=file_path_2)  # "File.FromPath"
readFromFile_2 = Image.ReadFromFile(file=fromPath_2)
code_block_5 = CodeBlock { "OK"; }
code_block_6 = CodeBlock { "Select XML File"; }
file_path_3 = Filename(".\Ducts_Vs_Floor.xml")
ui_filepath_data = Custom[UI.FilePath Data](InputName=code_block_6, DefaulPath=file_path_3)  # Create filepath input for UI.MultipleInputForm ++ . Check out www.data-shapes.net for more infos !
boolean = BoolSelector(true)  # graph input
code_block_7 = CodeBlock { "Cancel"; }
ui_multipleinputform = Custom[UI.MultipleInputForm ++](Description_optional=code_block_4, Logo_optional=readFromFile_2, ButtonText_optional=code_block_5, Inputs=ui_filepath_data, Toggle=boolean, CancelButtonText_optional=code_block_7)  # Create a form with multiple inputs. see www.data-shapes.net for tutorials and infos!
list_to_single_string = Custom[List to Single String](Original_List=ui_multipleinputform.User_Inputs)  # renamed fork of "Convert List into List of Strings with Line Breaks"
read_file_path_to_elementtree = Custom[Read File Path to ElementTree with UTF8 roundtrip](filePath=list_to_single_string)  # to clean unsupported characters...
string = StringInput(".//value")  # graph input
xpath_expression_find_for = Custom[XPATH Expression Find for Element Tree](ElementTree=read_file_path_to_elementtree, XPATH=string)
string_2 = StringInput(".//name")  # graph input
xpath_expression_find_for_2 = Custom[XPATH Expression Find for Element Tree](ElementTree=read_file_path_to_elementtree, XPATH=string_2)
code_block_8 = CodeBlock { "Element ID"; }
eq = xpath_expression_find_for_2.text == code_block_8
filterByBoolMask = List.FilterByBoolMask(list=xpath_expression_find_for.text, mask=eq)
byElementId = archilab.Revit.Selection.Select.ByElementId(id=filterByBoolMask.in)
bv_remove_nulls = Custom[bv Remove Nulls](List=byElementId)  # forked from Lunchbox
string_3 = StringInput(".//resultstatus")  # graph input
xpath_expression_find_for_3 = Custom[XPATH Expression Find for Element Tree](ElementTree=read_file_path_to_elementtree, XPATH=string_3)
code_block_9 = CodeBlock { "New"; }
eq_2 = xpath_expression_find_for_3.text == code_block_9
filterByBoolMask_2 = List.FilterByBoolMask(list=bv_remove_nulls, mask=eq_2)
code_block_10 = CodeBlock { 100; }
ui_listview_data = Custom[UI.Listview Data](InputName=code_block_3, Keys=filterByBoolMask_2.in, Values=filterByBoolMask_2.in, Height_optionnal=code_block_10)  # Create data for ListView input in UI.MultiInputForm ++ . Check out www.data-shapes.net for more infos.
code_block_11 = CodeBlock { "Elements Active"; }
string_4 = StringInput(".//resultstatus")  # graph input
xpath_expression_find_for_4 = Custom[XPATH Expression Find for Element Tree](ElementTree=read_file_path_to_elementtree, XPATH=string_4)
code_block_12 = CodeBlock { "Active"; }
eq_3 = xpath_expression_find_for_4.text == code_block_12
filterByBoolMask_3 = List.FilterByBoolMask(list=bv_remove_nulls, mask=eq_3)
ui_listview_data_2 = Custom[UI.Listview Data](InputName=code_block_11, Keys=filterByBoolMask_3.in, Values=filterByBoolMask_3.in, Height_optionnal=code_block_10)
code_block_13 = CodeBlock { "Elements Approved"; }
string_5 = StringInput(".//resultstatus")  # graph input
xpath_expression_find_for_5 = Custom[XPATH Expression Find for Element Tree](ElementTree=read_file_path_to_elementtree, XPATH=string_5)
code_block_14 = CodeBlock { "Approved"; }
eq_4 = xpath_expression_find_for_5.text == code_block_14
filterByBoolMask_4 = List.FilterByBoolMask(list=bv_remove_nulls, mask=eq_4)
ui_listview_data_3 = Custom[UI.Listview Data](InputName=code_block_13, Keys=filterByBoolMask_4.in, Values=filterByBoolMask_4.in, Height_optionnal=code_block_10)
code_block_15 = CodeBlock { "Elements Reviewed"; }
string_6 = StringInput(".//resultstatus")  # graph input
xpath_expression_find_for_6 = Custom[XPATH Expression Find for Element Tree](ElementTree=read_file_path_to_elementtree, XPATH=string_6)
code_block_16 = CodeBlock { "Reviewed"; }
eq_5 = xpath_expression_find_for_6.text == code_block_16
filterByBoolMask_5 = List.FilterByBoolMask(list=bv_remove_nulls, mask=eq_5)
ui_listview_data_4 = Custom[UI.Listview Data](InputName=code_block_15, Keys=filterByBoolMask_5.in, Values=filterByBoolMask_5.in, Height_optionnal=code_block_10)
code_block_17 = CodeBlock { "Elements Resolved"; }
string_7 = StringInput(".//resultstatus")  # graph input
xpath_expression_find_for_7 = Custom[XPATH Expression Find for Element Tree](ElementTree=read_file_path_to_elementtree, XPATH=string_7)
code_block_18 = CodeBlock { "Resolved"; }
eq_6 = xpath_expression_find_for_7.text == code_block_18
filterByBoolMask_6 = List.FilterByBoolMask(list=bv_remove_nulls, mask=eq_6)
ui_listview_data_5 = Custom[UI.Listview Data](InputName=code_block_17, Keys=filterByBoolMask_6.in, Values=filterByBoolMask_6.in, Height_optionnal=code_block_10)
create = List.Create(item0=ui_listview_data, item1=ui_listview_data_2, item2=ui_listview_data_3, item3=ui_listview_data_4, item4=ui_listview_data_5)
code_block_19 = CodeBlock { "Cancel"; }
ui_multipleinputform_2 = Custom[UI.MultipleInputForm ++](Description_optional=code_block, Logo_optional=readFromFile, ButtonText_optional=code_block_2, Inputs=create, Toggle=boolean, CancelButtonText_optional=code_block_19)
code_block_20 = CodeBlock { 0; }
getItemAtIndex = List.GetItemAtIndex(list=ui_multipleinputform_2.User_Inputs, index=code_block_20)
code_block_21 = CodeBlock { "Clash_Detection_New"; }
code_block_22 = CodeBlock { 1; }
setParameterByName = Element.SetParameterByName(element=getItemAtIndex, parameterName=code_block_21, value=code_block_22)
code_block_23 = CodeBlock { 1; }
getItemAtIndex_2 = List.GetItemAtIndex(list=ui_multipleinputform_2.User_Inputs, index=code_block_23)
code_block_24 = CodeBlock { "Clash_Detection_Active"; }
code_block_25 = CodeBlock { 1; }
setParameterByName_2 = Element.SetParameterByName(element=getItemAtIndex_2, parameterName=code_block_24, value=code_block_25)
code_block_26 = CodeBlock { 2; }
getItemAtIndex_3 = List.GetItemAtIndex(list=ui_multipleinputform_2.User_Inputs, index=code_block_26)
code_block_27 = CodeBlock { "Clash_Detection_Approved"; }
code_block_28 = CodeBlock { 1; }
setParameterByName_3 = Element.SetParameterByName(element=getItemAtIndex_3, parameterName=code_block_27, value=code_block_28)
code_block_29 = CodeBlock { 3; }
getItemAtIndex_4 = List.GetItemAtIndex(list=ui_multipleinputform_2.User_Inputs, index=code_block_29)
code_block_30 = CodeBlock { "Clash_Detection_Reviewed"; }
code_block_31 = CodeBlock { 1; }
setParameterByName_4 = Element.SetParameterByName(element=getItemAtIndex_4, parameterName=code_block_30, value=code_block_31)
code_block_32 = CodeBlock { 4; }
getItemAtIndex_5 = List.GetItemAtIndex(list=ui_multipleinputform_2.User_Inputs, index=code_block_32)
code_block_33 = CodeBlock { "Clash_Detection_Resolved"; }
code_block_34 = CodeBlock { 1; }
setParameterByName_5 = Element.SetParameterByName(element=getItemAtIndex_5, parameterName=code_block_33, value=code_block_34)
code_block_35 = CodeBlock { "Clash_Detection_Check"; }
code_block_36 = CodeBlock { 1; }
setParameterByName_6 = Element.SetParameterByName(element=bv_remove_nulls, parameterName=code_block_35, value=code_block_36)
code_block_37 = CodeBlock { "Clash_Detection_Picture"; }
string_8 = StringInput("\\global.arup.com\americas\Jobs\BOS\240000\245397-00\4 Internal Project Data\4-03 Drawings\Navis Files\20180109\")  # graph input
code_block_38 = CodeBlock { ".//clashresult"; }
xpath_expression_find_for_8 = Custom[XPATH Expression Find for Element Tree](ElementTree=read_file_path_to_elementtree, XPATH=code_block_38)
code_block_39 = CodeBlock { "href"; }
eq_7 = xpath_expression_find_for_8.attrib_names == code_block_39
filterByBoolMask_7 = List.FilterByBoolMask(list=xpath_expression_find_for_8.attrib_values, mask=eq_7)
flatten = List.Flatten(list=filterByBoolMask_7.in)
add = string_8 + flatten  # lacing=CrossProduct
fromPath_3 = FileObject(path=add)  # "File.FromPath"
flatten_2 = List.Flatten(list=fromPath_3)
string_from_object = FromObject(obj=flatten_2)
setParameterByName_7 = Element.SetParameterByName(element=bv_remove_nulls, parameterName=code_block_37, value=string_from_object)
code_block_40 = CodeBlock {  }
