# Dynamo graph DFBP_01_Create Sheets from Excel.dyn (Dynamo 2.0.1.5055)

# group: Read Data from Excel
file_path = Filename(".\DFBP_01_Sheet List.xlsx")  # graph input
fromPath = FileObject(path=file_path)  # "File.FromPath"
code_block = CodeBlock { "Sheet1"; }
boolean = BoolSelector(true)  # graph input
importExcel = Data.ImportExcel(file=fromPath, sheetName=code_block, readAsStrings=boolean)

# group: Remove Header and Reformat
code_block_2 = CodeBlock { 0; }
removeItemAtIndex = List.RemoveItemAtIndex(list=importExcel, indices=code_block_2)
transpose = List.Transpose(lists=removeItemAtIndex)

# group: Create Sheet
code_block_3 = CodeBlock { 0; 1; }
getItemAtIndex = List.GetItemAtIndex(list=transpose, index=code_block_3.out1)
getItemAtIndex_2 = List.GetItemAtIndex(list=transpose, index=code_block_3.out0)
family_types = FamilyTypes()  # nothing selected; graph input
views = Views()  # nothing selected; graph input
byNameNumberTitleBlockAndView = Sheet.ByNameNumberTitleBlockAndView(sheetName=getItemAtIndex, sheetNumber=getItemAtIndex_2, titleBlockFamilyType=family_types, view=views)

# group: Update Sheet Parameters
code_block_4 = CodeBlock { "Approved By"; }
code_block_5 = CodeBlock { 3; 4; 5; 6; 7; }
getItemAtIndex_3 = List.GetItemAtIndex(list=transpose, index=code_block_5.out0)
setParameterByName = Element.SetParameterByName(element=byNameNumberTitleBlockAndView, parameterName=code_block_4, value=getItemAtIndex_3)
code_block_6 = CodeBlock { "Designed By"; }
getItemAtIndex_4 = List.GetItemAtIndex(list=transpose, index=code_block_5.out1)
setParameterByName_2 = Element.SetParameterByName(element=byNameNumberTitleBlockAndView, parameterName=code_block_6, value=getItemAtIndex_4)
code_block_7 = CodeBlock { "Checked By"; }
getItemAtIndex_5 = List.GetItemAtIndex(list=transpose, index=code_block_5.out2)
setParameterByName_3 = Element.SetParameterByName(element=byNameNumberTitleBlockAndView, parameterName=code_block_7, value=getItemAtIndex_5)
code_block_8 = CodeBlock { "Drawn By"; }
getItemAtIndex_6 = List.GetItemAtIndex(list=transpose, index=code_block_5.out3)
setParameterByName_4 = Element.SetParameterByName(element=byNameNumberTitleBlockAndView, parameterName=code_block_8, value=getItemAtIndex_6)
code_block_9 = CodeBlock { "Sheet Issue Date"; }
getItemAtIndex_7 = List.GetItemAtIndex(list=transpose, index=code_block_5.out4)
setParameterByName_5 = Element.SetParameterByName(element=byNameNumberTitleBlockAndView, parameterName=code_block_9, value=getItemAtIndex_7)
