# Dynamo graph DFBP_02_Add Legend to Sheets.dyn (Dynamo 2.0.1.5055)

# group: Get All Sheets
categories = Categories(index=447)
all_elements_of_category = ElementsOfCategory(Category=categories)

# group: Get Selected Sheets by Prefix
sheetNumber = Sheet.SheetNumber(sheet=all_elements_of_category)
sheet_prefix_string = StringInput("A-7")  # graph input
contains = String.Contains(str=sheetNumber, searchFor=sheet_prefix_string)
filterByBoolMask = List.FilterByBoolMask(list=all_elements_of_category, mask=contains)
watch = Watch(filterByBoolMask.in)

# group: Get Legend View
categories_2 = Categories(index=602)  # graph input
all_elements_of_category_2 = ElementsOfCategory(Category=categories_2)
isNull = Object.IsNull(obj=all_elements_of_category_2)
filterByBoolMask_2 = List.FilterByBoolMask(list=all_elements_of_category_2, mask=isNull)
name = Element.Name(element=filterByBoolMask_2.out)
legend_name_string = StringInput("Symbol Legend")  # graph input
firstIndexOf = List.FirstIndexOf(list=name, item=legend_name_string)
getItemAtIndex = List.GetItemAtIndex(list=filterByBoolMask_2.out, index=firstIndexOf)

# group: Add Legend to Sheet
x_coord_number = DoubleInput(940)  # graph input
y_coord_number = DoubleInput(700)  # graph input
byCoordinates = Point.ByCoordinates(x=x_coord_number, y=y_coord_number)
# note: From Rhythm package
create = Rhythm.Revit.Elements.Viewport.Create(sheet=filterByBoolMask.in, view=getItemAtIndex, location=byCoordinates)
