# Dynamo graph DFBP_03_Add Views to Sheets.dyn (Dynamo 2.0.1.5055)

# group: Get All Sheets
categories = Categories(index=447)  # graph input
all_elements_of_category = ElementsOfCategory(Category=categories)

# group: Sort List Based on Sheets in Excel
sheetNumber = Sheet.SheetNumber(sheet=all_elements_of_category)

# group: Read Data from Excel
file_path = Filename(".\DFBP_03_Sheet List.xlsx")  # graph input
fromPath = FileObject(path=file_path)  # "File.FromPath"
code_block = CodeBlock { "Sheet1"; }
boolean = BoolSelector(true)  # graph input
importExcel = Data.ImportExcel(file=fromPath, sheetName=code_block, readAsStrings=boolean)

# group: Remove Header, Reformat and Get Separate Lists
code_block_2 = CodeBlock { 0; }
removeItemAtIndex = List.RemoveItemAtIndex(list=importExcel, indices=code_block_2)
transpose = List.Transpose(lists=removeItemAtIndex)
isNull = Object.IsNull(obj=transpose)
filterByBoolMask = List.FilterByBoolMask(list=transpose, mask=isNull)
code_block_3 = CodeBlock { 0; 2; }
getItemAtIndex = List.GetItemAtIndex(list=filterByBoolMask.out, index=code_block_3.out0)
getItemAtIndex_2 = List.GetItemAtIndex(list=filterByBoolMask.out, index=code_block_3.out1)

firstIndexOf = List.FirstIndexOf(list=sheetNumber, item=getItemAtIndex)

# group (continued): Sort List Based on Sheets in Excel
getItemAtIndex_3 = List.GetItemAtIndex(list=all_elements_of_category, index=firstIndexOf)

# group: Get All Views
categories_2 = Categories(index=602)  # graph input
all_elements_of_category_2 = ElementsOfCategory(Category=categories_2)

# group: Remove Null Views
isNull_2 = Object.IsNull(obj=all_elements_of_category_2)
filterByBoolMask_2 = List.FilterByBoolMask(list=all_elements_of_category_2, mask=isNull_2)

# group: Format List of Views
code_block_4 = CodeBlock { ","; }
split = String.Split(str=getItemAtIndex_2, separater0=code_block_4)
trimWhitespace = String.TrimWhitespace(str=split@L2)

# group: Sort View List Based on Sheets in Excel
name = Element.Name(element=filterByBoolMask_2.out)
firstIndexOf_2 = List.FirstIndexOf(list=name, item=trimWhitespace)
getItemAtIndex_4 = List.GetItemAtIndex(list=filterByBoolMask_2.out, index=firstIndexOf_2@L2)

watch = Watch(getItemAtIndex_4)

# group: Add Views to Sheet
number = DoubleInput(500)  # graph input
number_2 = DoubleInput(400)  # graph input
# note: From Rhythm Package
byCoordinates = Point.ByCoordinates(x=number, y=number_2)
create = Rhythm.Revit.Elements.Viewport.Create(sheet=getItemAtIndex_3, view=watch@L3, location=byCoordinates)
