# Dynamo graph DFBP_04_Duplicate Sheets and Views.dyn (Dynamo 2.0.1.5055)

# group: Duplicate Sheets and Views
duplicate = Revit.Sheet.Duplicate()  # unwired: sheets, run, duplicateWithViews
run_boolean = BoolSelector(true)
duplicate_views_boolean = BoolSelector(true)  # graph input
duplidate_option_number = DoubleInput(0)  # graph input
# note: From BimorphNodes Package
suffix_string = StringInput("_test")  # graph input
prefix_string = StringInput("")  # graph input

# group: Get All Sheets
categories = Categories(index=447)
all_elements_of_category = ElementsOfCategory(Category=categories)

# group: Filter for Specific Sheets
sheet_number_to_duplicate_string = StringInput("A101")  # graph input
create = List.Create(item0=sheet_number_to_duplicate_string)
sheetNumber = Sheet.SheetNumber(sheet=all_elements_of_category)
contains = List.Contains(list=create, item=sheetNumber)
filterByBoolMask = List.FilterByBoolMask(list=all_elements_of_category, mask=contains)

duplicate_2 = Revit.Sheet.Duplicate(sheets=filterByBoolMask.in, run=run_boolean, duplicateWithViews=duplicate_views_boolean, duplicateOption=duplidate_option_number, suffix=suffix_string, prefix=prefix_string)
