# Dynamo graph DFBP_05_Batch Print to PDF.dyn (Dynamo 2.0.1.5055)

# group: Select View Set and Get Views
view_sets = ViewSetUi()  # nothing selected; graph input
get_views_from_view_set = Custom[Get Views from View Set](ViewSet=view_sets)  # This node will take a name of a view set and return views/sheet elements contained in it.

# group: Create File Path
directory_path = Directory("C:\Users\micha\Desktop\test files")  # graph input
sheetNumber = Sheet.SheetNumber(sheet=get_views_from_view_set)
code_block = CodeBlock(dirPath=directory_path, fileName=sheetNumber) { dirPath + "\\" + fileName + ".pdf"; }

boolean = BoolSelector(true)

# group: Print PDFs
print_range = PrintRangeUi(index=1)
code_block_2 = CodeBlock { true; }
printer_string = StringInput("Adobe PDF")  # graph input
print_settings = PrintSettingUi()  # nothing selected; graph input
python_script = Python(IN[0]=get_views_from_view_set, IN[1]=print_range, IN[2]=code_block_2, IN[3]=printer_string, IN[4]=print_settings, IN[5]=code_block, IN[6]=boolean)
# ---------- python_script.python (155 lines) ----------
import clr
clr.AddReference('ProtoGeometry')
from Autodesk.DesignScript.Geometry import *

# Import Element wrapper extension methods
clr.AddReference("RevitNodes")
import Revit
clr.ImportExtensions(Revit.Elements)

# Import geometry conversion extension methods
clr.ImportExtensions(Revit.GeometryConversion)

# Import DocumentManager and TransactionManager
clr.AddReference("RevitServices")
import RevitServices
from RevitServices.Persistence import DocumentManager
from RevitServices.Transactions import TransactionManager

doc = DocumentManager.Instance.CurrentDBDocument
uiapp = DocumentManager.Instance.CurrentUIApplication
app = uiapp.Application

# Import RevitAPI
clr.AddReference("RevitAPI")
import Autodesk
from Autodesk.Revit.DB import *

import sys
pyt_path = r'C:\Program Files (x86)\IronPython 2.7\Lib'
sys.path.append(pyt_path)
import System

# The inputs to this node will be stored as a list in the IN variable.
dataEnteringNode = IN

sheets = IN[0]
pRange = System.Enum.Parse(Autodesk.Revit.DB.PrintRange, IN[1])
combined = IN[2]
printerName = IN[3]
printSetting = IN[4]
filePath = IN[5]
runIt = IN[6]

####################################################################
# ADDED THIS
if isinstance(filePath, list):
    s_length = len(sheets)
    fp_length = len(filePath)
    if len(sheets) == len(filePath):
        pass
    else:
        filePath = filePath * (s_length / fp_length)
        if len(filePath) == len(sheets):
            pass
        else:
            OUT = "Filepaths and Sheets weren't the same length"
            exit()

elif isinstance(filePath, str):
    filepath = [filepath] * len(sheets)
# ADDED THIS
#######################################################################

if isinstance(sheets, list):
    viewSheets = []
    for i in sheets:
        viewSheets.append(UnwrapElement(i))
else:
    viewSheets = UnwrapElement(sheets)


def PrintView(doc, sheet, pRange, printerName, combined, filePath, printSetting):
    # create view set
    viewSet = ViewSet()
    viewSet.Insert(sheet)
    # determine print range
    printManager = doc.PrintManager
    printManager.PrintRange = pRange
    printManager.Apply()
    # make new view set current
    viewSheetSetting = printManager.ViewSheetSetting
    viewSheetSetting.CurrentViewSheetSet.Views = viewSet
    # set printer
    printManager.SelectNewPrintDriver(printerName)
    printManager.Apply()
    # set combined and print to file
    if printManager.IsVirtual:
        printManager.CombinedFile = combined
        printManager.Apply()
        printManager.PrintToFile = True
        printManager.Apply()
    else:
        printManager.CombinedFile = combined
        printManager.Apply()
        printManager.PrintToFile = False
        printManager.Apply()
    # set file path
    printManager.PrintToFileName = filePath
    printManager.Apply()
    # apply print setting
    try:
        printSetup = printManager.PrintSetup
        printSetup.CurrentPrintSetting = printSetting
        printManager.Apply()
    except:
        pass
    # save settings and submit print
    TransactionManager.Instance.EnsureInTransaction(doc)
    viewSheetSetting.SaveAs("tempSetName")
    printManager.Apply()
    printManager.SubmitPrint()
    viewSheetSetting.Delete()
    TransactionManager.Instance.TransactionTaskDone()

    return True


try:
    viewSets = FilteredElementCollector(doc).OfClass(ViewSheetSet)
    for i in viewSets:
        if i.Name == "tempSetName":
            TransactionManager.Instance.EnsureInTransaction(doc)
            doc.Delete(i.Id)
            TransactionManager.Instance.ForceCloseTransaction()
        else:
            continue

    errorReport = None
    message = "Success"
    if runIt:
        if isinstance(viewSheets, list) and isinstance(printSetting, list):
            # Edited this
            for i, j, fp in zip(viewSheets, printSetting, filePath):
                PrintView(doc, i, pRange, printerName, combined, fp, j)
        elif isinstance(viewSheets, list) and not isinstance(printSetting, list):
            # Edited this
            for i, fp in zip(viewSheets, filePath):
                PrintView(doc, i, pRange, printerName,
                          combined, fp, printSetting)
        elif not isinstance(viewSheets, list) and not isinstance(printSetting, list):
            # Edited this
            PrintView(doc, viewSheets, pRange, printerName,
                      combined, filePath[0], printSetting)
    else:
        message = "Set RunIt to True"
except:
    # if error accurs anywhere in the process catch it
    import traceback
    errorReport = traceback.format_exc()

# Assign your output to the OUT variable
if errorReport is None:
    OUT = message
else:
    OUT = errorReport
# ----------------------------------------

watch = Watch(python_script)
