# Dynamo graph DFBP_06_Create View Filter.dyn (Dynamo 2.0.1.5055)

# group: Get Parameter
categories = Categories(index=604)  # graph input
all_elements_of_category = ElementsOfCategory(Category=categories)
number = DoubleInput(0)  # graph input
getItemAtIndex = List.GetItemAtIndex(list=all_elements_of_category, index=number)
elementType = Element.ElementType(element=getItemAtIndex)
string = StringInput("Fire Rating")  # graph input
parameterByName = Parameter.ParameterByName(element=elementType, name=string)

# group: Define Rule 1
select_rule_type = RuleTypes(index=0)  # graph input
string_2 = StringInput("1 HR")  # graph input
byRuleType = Revit.Filter.FilterRule.ByRuleType(type=select_rule_type, value=string_2, parameter=parameterByName, lacing=Longest)

# group: Define Rule 2
select_rule_type_2 = RuleTypes(index=3)  # graph input
string_3 = StringInput("2 HR")  # graph input
byRuleType_2 = Revit.Filter.FilterRule.ByRuleType(type=select_rule_type_2, value=string_3, parameter=parameterByName, lacing=Longest)

# group: Define Rule 3
select_rule_type_3 = RuleTypes(index=3)  # graph input
string_4 = StringInput("3 HR")  # graph input
byRuleType_3 = Revit.Filter.FilterRule.ByRuleType(type=select_rule_type_3, value=string_4, parameter=parameterByName, lacing=Longest)

# group: Create List of Filter Rules
create = List.Create(item0=byRuleType, item1=byRuleType_2, item2=byRuleType_3)

# group: Create Filter
string_5 = StringInput("Rated Walls")  # graph input
categories_2 = Categories(index=604)  # graph input
byRules = Revit.Filter.ParameterFilterElement.ByRules(name=string_5, categories=categories_2, rules=create)
