# Dynamo graph DFBP_07_Add Filter to Views.dyn (Dynamo 1.3.2.2480)

# group: Get Views
view_type = ViewTypesUi("FloorPlan")
getByType = archilab.Revit.Views.View.GetByType(view_type)
# note: From archilab package
current = Document.Current()
activeView = Document.ActiveView(current)

# group: Get All Parameter Filters
element_types = ElementTypes("ParameterFilterElement")
all_elements_of_type = ElementsOfType(element_types)

# group: Filter List to Get Specific Parameter Filter
name = Element.Name(all_elements_of_type)
string = StringInput("Rated Walls - 2HR")
firstIndexOf = List.FirstIndexOf(list=name, item=string)
getItemAtIndex = List.GetItemAtIndex(list=all_elements_of_type, index=firstIndexOf)

# group: Create Graphic Overrides
number = DoubleInput(255)
byARGB = Color.ByARGB(r=number)
fill_patterns = FillPatterns("Solid fill")
line_patterns = LinePatterns("Hidden")
number_2 = DoubleInput(6)
byProperties = Revit.Filter.OverrideGraphicSettings.ByProperties(byARGB, arg4=fill_patterns, arg6=line_patterns, arg8=number_2)

# group: Set Filter Graphic Overrides
boolean = BoolSelector(true)
setFilterOverrides = View.SetFilterOverrides(view=getByType, parameterFilter=getItemAtIndex, overrides=byProperties, hide=boolean)
