# Dynamo graph DFBP_07_Add Filter to Views2.dyn (Dynamo 2.0.1.5055)

# group: Get All Parameter Filters
element_types = ElementTypes(index=221)  # graph input
all_elements_of_type = ElementsOfType(element_type=element_types)

# group: Filter List to Get Specific Parameter Filter
name = Element.Name(element=all_elements_of_type)
string = StringInput("Rated Walls - 2HR")  # graph input
firstIndexOf = List.FirstIndexOf(list=name, item=string)
getItemAtIndex = List.GetItemAtIndex(list=all_elements_of_type, index=firstIndexOf)

# group: Create Graphic Overrides
number = DoubleInput(255)  # graph input
byARGB = Color.ByARGB(r=number)
fill_patterns = FillPatterns()  # nothing selected; graph input
line_patterns = LinePatterns(index=31)  # graph input
number_2 = DoubleInput(6)  # graph input
byProperties = Revit.Filter.OverrideGraphicSettings.ByProperties(cutFillColor=byARGB, cutFillPattern=fill_patterns, cutLinePattern=line_patterns, cutLineWeight=number_2)

# group: Set Filter Graphic Overrides
boolean = BoolSelector(true)  # graph input
setFilterOverrides = View.SetFilterOverrides(parameterFilter=getItemAtIndex, overrides=byProperties, hide=boolean)  # unwired: view

# group: Get Views
# note: From archilab package
current = Document.Current()
activeView = Document.ActiveView(document=current)
view_type = ViewTypesUi(index=9)  # graph input
