# Dynamo graph DFBP_08_Change Elevation Crop Line Weight.dyn (Dynamo 2.0.1.5055)

# note: from archilab package

# group: Get Specific Views by Type and Name
# note: from archilab package
name = Element.Name()  # unwired: element
string = StringInput("Elevation")  # graph input
contains = String.Contains(str=name, searchFor=string)
filterByBoolMask = List.FilterByBoolMask(mask=contains)  # unwired: list

# group: Update Crop Boundary Lineweight
number_slider = DoubleSlider(5, range=1..16 step 1)  # graph input
# note: From Rhythm Package
overrideCrop = Rhythm.Revit.Views.ViewSection.OverrideCrop(viewSection=filterByBoolMask.in, lineWeight=number_slider)

# group: Get the Active View
current = Document.Current()
activeView = Document.ActiveView(document=current)

# group: Get Views on a Specific Sheet
categories = Categories(index=447)
all_elements_of_category = ElementsOfCategory(Category=categories)
sheetNumber = Sheet.SheetNumber(sheet=all_elements_of_category)
string_2 = StringInput("A302")  # graph input
allIndicesOf = List.AllIndicesOf(list=sheetNumber, item=string_2)
getItemAtIndex = List.GetItemAtIndex(list=all_elements_of_category, index=allIndicesOf)
views = Sheet.Views(sheet=getItemAtIndex)
