# Dynamo graph DFBP_09_Hide Categories in Views.dyn (Dynamo 2.0.1.5055)

# group: Select Categories to Turn Off
categories = Categories(index=604)  # graph input
categories_2 = Categories(index=208)  # graph input
categories_3 = Categories(index=408)  # graph input
categories_4 = Categories(index=506)  # graph input
create = List.Create(item0=categories, item1=categories_2, item2=categories_3, item3=categories_4)

# group: Turn Off Categories in View(s)
byProperties = Revit.Filter.OverrideGraphicSettings.ByProperties()
boolean = BoolSelector(true)  # graph input
setCategoryOverrides = View.SetCategoryOverrides(category=create, overrides=byProperties, hide=boolean)  # unwired: view

# group: Get Views by Type
# note: From archilab package
view_type = ViewTypesUi(index=1)  # graph input
