# Dynamo graph DFBP_10_Create Views from Rooms.dyn (Dynamo 2.0.1.5055)

# group: Get All Rooms
categories = Categories(index=425)  # graph input
all_elements_of_category = ElementsOfCategory(Category=categories)

# group: Filter Rooms by Level
string = StringInput("Level")  # graph input
getParameterValueByName = Element.GetParameterValueByName(element=all_elements_of_category, parameterName=string)
levels = Levels()  # nothing selected; graph input
name = Level.Name(level=levels)
eq = getParameterValueByName == name
filterByBoolMask = List.FilterByBoolMask(list=all_elements_of_category, mask=eq)

# group: Filter Rooms by Room Name
name_2 = Room.Name(room=all_elements_of_category)
string_2 = StringInput("Office")  # graph input
contains = String.Contains(str=name_2, searchFor=string_2)
filterByBoolMask_2 = List.FilterByBoolMask(list=all_elements_of_category, mask=contains)

# group: Create Views and Set View Scale
string_3 = StringInput("Enlarged")  # graph input
number = DoubleInput(2)  # graph input
boolean = BoolSelector(true)  # graph input
byRoom = Custom[FloorPlan.ByRoom](Room=filterByBoolMask_2.in@L1, Prefix=string_3, Offset=number, RunIt=boolean)  # This node takes input of a Room and creates a Floor Plan View with Crop Box set around that room.
# note: From archilab package
number_2 = DoubleInput(50)  # graph input
setScale = View.SetScale(view=byRoom, scale=number_2)
