# Dynamo graph DFBP_11_Create Floor Roof Walls from Points.dyn (Dynamo 2.0.1.5055)

# group: Define Coordinates
number_slider = DoubleSlider(40, range=0..100 step 1)  # graph input
number_slider_2 = DoubleSlider(73, range=0..100 step 1)  # graph input

# group: Create Corner Points
byCoordinates = Point.ByCoordinates()
byCoordinates_2 = Point.ByCoordinates(x=number_slider)
byCoordinates_3 = Point.ByCoordinates(x=number_slider, y=number_slider_2)
byCoordinates_4 = Point.ByCoordinates(y=number_slider_2)

# group: Create Lines from Points
byStartPointEndPoint = Line.ByStartPointEndPoint(startPoint=byCoordinates, endPoint=byCoordinates_2)
byStartPointEndPoint_2 = Line.ByStartPointEndPoint(startPoint=byCoordinates_2, endPoint=byCoordinates_3)
byStartPointEndPoint_3 = Line.ByStartPointEndPoint(startPoint=byCoordinates_3, endPoint=byCoordinates_4)
byStartPointEndPoint_4 = Line.ByStartPointEndPoint(startPoint=byCoordinates_4, endPoint=byCoordinates)

# group: Create Outline
create = List.Create(item0=byStartPointEndPoint, item1=byStartPointEndPoint_2, item2=byStartPointEndPoint_3, item3=byStartPointEndPoint_4)
byJoinedCurves = PolyCurve.ByJoinedCurves(curves=create)

# group: Create Roof
string = StringInput("Generic - 9\"")  # graph input
byName = RoofType.ByName(name=string)
levels = Levels(index=1)  # graph input
byOutlineTypeAndLevel = Roof.ByOutlineTypeAndLevel(outline=byJoinedCurves, roofType=byName, level=levels)

# group: Create Floor
floor_types = FloorTypes(index=2)  # graph input
levels_2 = Levels(index=0)  # graph input
byOutlineTypeAndLevel_2 = Floor.ByOutlineTypeAndLevel(outlineCurves=byJoinedCurves, floorType=floor_types, level=levels_2)

# group: Create Walls from Lines
levels_3 = Levels(index=0)  # graph input
levels_4 = Levels(index=1)  # graph input
wall_types = WallTypes(index=26)  # graph input
byCurveAndLevels = Wall.ByCurveAndLevels(c=byStartPointEndPoint, startLevel=levels_3, endLevel=levels_4, wallType=wall_types)
byCurveAndLevels_2 = Wall.ByCurveAndLevels(c=byStartPointEndPoint_2, startLevel=levels_3, endLevel=levels_4, wallType=wall_types)
byCurveAndLevels_3 = Wall.ByCurveAndLevels(c=byStartPointEndPoint_3, startLevel=levels_3, endLevel=levels_4, wallType=wall_types)
byCurveAndLevels_4 = Wall.ByCurveAndLevels(c=byStartPointEndPoint_4, startLevel=levels_3, endLevel=levels_4, wallType=wall_types)

watch_3d = Watch3D(byJoinedCurves)
