# Dynamo graph DFBP_12_MEP from Lines.dyn (Dynamo 2.0.1.5055)

# group: Get All Lines
element_types = ElementTypes(index=64)  # graph input
all_elements_of_type = ElementsOfType(element_type=element_types)

# group: Filter for Model Lines
name = Element.Name(element=all_elements_of_type)
string = StringInput("Model Lines")  # graph input
eq = name == string
filterByBoolMask = List.FilterByBoolMask(list=all_elements_of_type, mask=eq)

# group: Filter for Specific Line Style
string_2 = StringInput("Line Style")  # graph input
getParameterValueByName = Element.GetParameterValueByName(element=filterByBoolMask.in, parameterName=string_2)
name_2 = Element.Name(element=getParameterValueByName)
string_3 = StringInput("Wide Lines")  # graph input
eq_2 = name_2 == string_3
filterByBoolMask_2 = List.FilterByBoolMask(list=filterByBoolMask.in, mask=eq_2)

# group: Get All Pipe Types
element_types_2 = ElementTypes(index=236)  # graph input
all_elements_of_type_2 = ElementsOfType(element_type=element_types_2)

# group: Filter for Specific Type
name_3 = Element.Name(element=all_elements_of_type_2)
string_4 = StringInput("Standard")  # graph input
firstIndexOf = List.FirstIndexOf(list=name_3, item=string_4)
getItemAtIndex = List.GetItemAtIndex(list=all_elements_of_type_2, index=firstIndexOf)
watch = Watch(name_3)

# group: Get All MEP System Types
element_types_3 = ElementTypes(index=196)  # graph input
all_elements_of_type_3 = ElementsOfType(element_type=element_types_3)

# group: Filter for Specific Type
name_4 = Element.Name(element=all_elements_of_type_3)
string_5 = StringInput("Domestic Hot Water")  # graph input
firstIndexOf_2 = List.FirstIndexOf(list=name_4, item=string_5)
getItemAtIndex_2 = List.GetItemAtIndex(list=all_elements_of_type_3, index=firstIndexOf_2)

# group: Create Pipes
curve = CurveElement.Curve(curveElement=filterByBoolMask_2.in)
levels = Levels(index=0)  # graph input
# note: From MEPover Package
number = DoubleInput(6)  # graph input
byLines = Custom[Pipe.ByLines](Lines=curve, PipeType=getItemAtIndex, SystemType=getItemAtIndex_2, Level=levels, Diameter=number)  # Creates a pipe by Line, PipeType, SystemType, Level and Diameter

byLines_2 = Custom[Conduit.ByLines]()  # Creates conduits by Line, ConduitType, Level and Diameter; unwired: Lines, ConduitType, Level, Diameter
byLines_3 = Custom[DuctRectangular.ByLines]()  # Create ducts by Lines, DuctType, MechanicalFittingType, Level, Width and Height; unwired: Lines, DuctType, MechanicalSystemType, Level, Width, Height
