# Dynamo graph DFBP_15_Generate Curved Roof.dyn (Dynamo 2.0.1.5055)

# group: Define Corner Points
number = DoubleInput(40)  # graph input
byCoordinates = Point.ByCoordinates(x=number)
number_2 = DoubleInput(20)  # graph input
byCoordinates_2 = Point.ByCoordinates(x=number, y=number_2)
byCoordinates_3 = Point.ByCoordinates()
byCoordinates_4 = Point.ByCoordinates(y=number_2)

# group: Create Boundary Lines
byStartPointEndPoint = Line.ByStartPointEndPoint(startPoint=byCoordinates, endPoint=byCoordinates_2)
byStartPointEndPoint_2 = Line.ByStartPointEndPoint(startPoint=byCoordinates_3, endPoint=byCoordinates)
byStartPointEndPoint_3 = Line.ByStartPointEndPoint(startPoint=byCoordinates_2, endPoint=byCoordinates_4)
byStartPointEndPoint_4 = Line.ByStartPointEndPoint(startPoint=byCoordinates_4, endPoint=byCoordinates_3)

# group: Get MidPoint and Draw Line for Arc Height
number_3 = DoubleInput(0.5)  # graph input
pointAtParameter = Curve.PointAtParameter(curve=byStartPointEndPoint_2, param=number_3)
pointAtParameter_2 = Curve.PointAtParameter(curve=byStartPointEndPoint_3, param=number_3)
byStartPointEndPoint_5 = Line.ByStartPointEndPoint(startPoint=pointAtParameter, endPoint=pointAtParameter_2)
pointAtParameter_3 = Curve.PointAtParameter(curve=byStartPointEndPoint_5, param=number_3)

# group: Draw Arc
ZAxis = Vector.ZAxis()
number_4 = DoubleInput(5)  # graph input
byStartPointDirectionLength = Line.ByStartPointDirectionLength(startPoint=pointAtParameter_3, direction=ZAxis, length=number_4)
endPoint = Curve.EndPoint(curve=byStartPointDirectionLength)
byThreePoints = Arc.ByThreePoints(firstPoint=pointAtParameter, secondPoint=endPoint, thirdPoint=pointAtParameter_2)

# group: Create Surface and Panelize
create = List.Create(item0=byStartPointEndPoint, item1=byThreePoints, item2=byStartPointEndPoint_4)
byLoft = Surface.ByLoft(crossSections=create)
number_5 = DoubleInput(12)  # graph input
# note: From LunchBox package
number_6 = DoubleInput(15)  # graph input
panelQuad = Geometry.Panel.PanelQuad(srf=byLoft, u=number_5, v=number_6)

# group: Insert Adaptive Components
number_7 = DoubleInput(2)  # graph input
takeEveryNthItem = List.TakeEveryNthItem(list=panelQuad.Points, n=number_7)
family_types = FamilyTypes()  # nothing selected; graph input
byPoints = AdaptiveComponent.ByPoints(points=takeEveryNthItem, familyType=family_types)
dropEveryNthItem = List.DropEveryNthItem(list=panelQuad.Points, n=number_7)
family_types_2 = FamilyTypes()  # nothing selected; graph input
byPoints_2 = AdaptiveComponent.ByPoints(points=dropEveryNthItem, familyType=family_types_2)
