# Dynamo graph DFBP_16_Insert Families by Room.dyn (Dynamo 2.0.1.5055)

# group: Read Excel File
file_path = Filename("C:\Users\micha\Google Drive\Courses\C2017-010_Dynamo for Busy People\Scripts\Paid\16 - Insert Families by Room\DFBP_16_Furniture List.xlsx")  # graph input
fromPath = FileObject(path=file_path)  # "File.FromPath"
string = StringInput("Sheet1")  # graph input
importExcel = Data.ImportExcel(file=fromPath, sheetName=string)
number = DoubleInput(0)  # graph input
removeItemAtIndex = List.RemoveItemAtIndex(list=importExcel, indices=number)
transpose = List.Transpose(lists=removeItemAtIndex)

# group: Separate Excel Data into Lists
number_2 = DoubleInput(1)  # graph input
getItemAtIndex = List.GetItemAtIndex(list=transpose, index=number_2)
number_3 = DoubleInput(2)  # graph input
getItemAtIndex_2 = List.GetItemAtIndex(list=transpose, index=number_3)
number_4 = DoubleInput(0)  # graph input
getItemAtIndex_3 = List.GetItemAtIndex(list=transpose, index=number_4)
number_5 = DoubleInput(3)  # graph input
getItemAtIndex_4 = List.GetItemAtIndex(list=transpose, index=number_5)

# group: Get Families and Family Types from Excel
byName = Family.ByName(name=getItemAtIndex)
types = Family.Types(family=byName)
name = FamilyType.Name(familyType=types)
contains = List.Contains(list=getItemAtIndex_2, item=name@L2)
filterByBoolMask = List.FilterByBoolMask(list=types, mask=contains)
firstItem = List.FirstItem(list=filterByBoolMask.in@L2)

# group: Get Rooms and Room Names
categories = Categories(index=425)  # graph input
all_elements_of_category = ElementsOfCategory(Category=categories)
string_2 = StringInput("Name")  # graph input
getParameterValueByName = Element.GetParameterValueByName(element=all_elements_of_category, parameterName=string_2)

# group: Sort Family List by Excel
allIndicesOf = List.AllIndicesOf(list=getParameterValueByName, item=getItemAtIndex_3)
getItemAtIndex_5 = List.GetItemAtIndex(list=all_elements_of_category, index=allIndicesOf)

# group: Duplicate Rooms Based on Excel Quantities
cycle = List.Cycle()  # unwired: list, amount
combine = List.Combine(comb=cycle, list1=getItemAtIndex_5, list2=getItemAtIndex_4)

# group: Get Room Point and Level
location = Room.Location(room=combine)
# note: From Clockwork Package
level = Custom[Element.Level](element=combine@L2)  # Gets an element's level

# group: Insert Families
byPointAndLevel = FamilyInstance.ByPointAndLevel(familyType=firstItem@L1, point=location@L2, level=level@L2)
