# Dynamo graph DFBP_17_Batch Rename Families.dyn (Dynamo 2.0.1.5055)

# group: Inputs
string = StringInput("M_")  # graph input
# note: Text to search for
# note: Text to replace with
string_2 = StringInput("mm")  # graph input

# group: Get Families to Rename
element_types = ElementTypes(index=119)  # graph input
all_elements_of_type = ElementsOfType(element_type=element_types)
name = Family.Name(family=all_elements_of_type)
contains = String.Contains(str=name, searchFor=string)
filterByBoolMask = List.FilterByBoolMask(list=all_elements_of_type, mask=contains)

# group: Rename families
name_2 = Family.Name(family=filterByBoolMask.in)
# note: From Clockwork Package
replace = String.Replace(str=name_2, searchFor=string, replaceWith=string_2)
setName = Custom[Element.SetName](element=filterByBoolMask.in, name=replace)  # Gets the name of a given Revit element

# group: Rename family types
types = Family.Types()  # unwired: family
name_3 = FamilyType.Name(familyType=types)
