# Dynamo graph DFBP_18_Insert Multiple Wall-Hosted Families.dyn (Dynamo 1.3.2.2480)

# group: Select Wall(s)
select_model_elements = DSModelElementsSelection()  # 3 picked in the model
select_model_element = DSModelElementSelection()  # 1 picked in the model

# group: Filter Selection for Walls
getCategory = Element.GetCategory(select_model_elements)
string_from_object = FromObject(getCategory)
string = StringInput("Walls")
eq = string_from_object == string
filterByBoolMask = List.FilterByBoolMask(list=select_model_elements, mask=eq)

# group: Get Wall Curve and Level
getLocation = Element.GetLocation(filterByBoolMask.in)
# note: From Clockwork Package
level = Custom[Element.Level](element=filterByBoolMask.in)  # Gets an element's level

# group: Divide Curve by Distance
number_slider = DoubleSlider(5, range=0..100 step 1)
# note: From LunchBox Package
divideCurveByDistance = Geometry.Curves.DivideCurveByDistance(getLocation, number_slider)

# group: Divide Curve by Number of Points
number_slider_2 = DoubleSlider(8, range=0..100 step 1)
# note: From LunchBox Package
divideCurve = Geometry.Curves.DivideCurve(getLocation, number_slider_2)

# group: Remove First and Last Points
number = DoubleInput(0)
removeItemAtIndex = List.RemoveItemAtIndex(list=divideCurve@L2, indices=number)
count = List.Count(removeItemAtIndex@L2)
code_block = CodeBlock(count=count) { count - 1; }
removeItemAtIndex_2 = List.RemoveItemAtIndex(list=removeItemAtIndex@L2, indices=code_block)

# group: Select Family and Insert into Wall
family_types = FamilyTypes("Outlet-Duplex:Single")
# note: From WombatDynamo package
insertDoorOrWindow = WombatDynamo.Wall.InsertDoorOrWindow(filterByBoolMask.in, removeItemAtIndex_2@L2, family_types, level, lacing=Longest)

# group: Set Elevation Param Value
string_2 = StringInput("Elevation")
number_2 = DoubleInput(1.5)
setParameterByName = Element.SetParameterByName(element=insertDoorOrWindow, parameterName=string_2, value=number_2)
