# Dynamo graph DFBP_19_Batch Upgrade Families.dyn (Dynamo 2.0.1.5055)

# group: Get All Files in Directory
directory_path = Directory("C:\Users\micha\Google Drive\Courses\C2017-010_Dynamo for Busy People\Scripts\Paid\18 - Batch Upgrade Families\Doors")  # graph input
fromPath = DirectoryObject(path=directory_path)  # "Directory.FromPath"
getDirectoryContents = FileSystem.GetDirectoryContents(directory=fromPath)

# group: Open then Close and Save File
openDocumentFile = Rhythm.Revit.Application.Application.OpenDocumentFile(filePath=getDirectoryContents.files)
# note: From Rhythm Package
boolean = BoolSelector(true)  # graph input
closeDocument = Rhythm.Revit.Application.Application.CloseDocument(document=openDocumentFile, save=boolean)

watch = Watch(closeDocument)
upgradeFamilies = Rhythm.Revit.Tools.Batch.UpgradeFamilies()  # unwired: directoryPath
