# Dynamo graph DFBP_20_Create Family Types from Excel.dyn (Dynamo 2.0.1.5055)

# group: Select Family Instance in Model and Get Type
select_model_element = DSModelElementSelection()  # nothing selected; graph input
type = FamilyInstance.Type(familyInstance=select_model_element)

# group: Read Excel File
file_path = Filename(".\Window Family Types.xlsx")  # graph input
fromPath = FileObject(path=file_path)  # "File.FromPath"
string = StringInput("Sheet1")  # graph input
importExcel = Data.ImportExcel(file=fromPath, sheetName=string)

# group: Remove Header and Format Data
number = DoubleInput(0)  # graph input
removeItemAtIndex = List.RemoveItemAtIndex(list=importExcel, indices=number)
transpose = List.Transpose(lists=removeItemAtIndex)

# group: Get Type Data from Excel
code_block = CodeBlock { 0; 1; 2; }
getItemAtIndex = List.GetItemAtIndex(list=transpose, index=code_block.out0)
getItemAtIndex_2 = List.GetItemAtIndex(list=transpose, index=code_block.out1)
getItemAtIndex_3 = List.GetItemAtIndex(list=transpose, index=code_block.out2)

# group: Get Header Data and Format
number_2 = DoubleInput(0)  # graph input
getItemAtIndex_4 = List.GetItemAtIndex(list=importExcel, index=number_2)
code_block_2 = CodeBlock { 1; 2; }
getItemAtIndex_5 = List.GetItemAtIndex(list=getItemAtIndex_4, index=code_block_2.out0)
trimWhitespace = String.TrimWhitespace(str=getItemAtIndex_5)
getItemAtIndex_6 = List.GetItemAtIndex(list=getItemAtIndex_4, index=code_block_2.out1)
trimWhitespace_2 = String.TrimWhitespace(str=getItemAtIndex_6)

# group: Duplicate Family Type and Set Param Values
# note: From Springs Package
duplicate = Custom[Springs.ElementType.Duplicate](elementType=type, newName=getItemAtIndex)  # Create duplicate element types. If the type exists, it will be appended instead.

flatten = List.Flatten(list=duplicate)

# group (continued): Duplicate Family Type and Set Param Values
setParameterByName = Element.SetParameterByName(element=flatten, parameterName=trimWhitespace, value=getItemAtIndex_2)
setParameterByName_2 = Element.SetParameterByName(element=flatten, parameterName=trimWhitespace_2, value=getItemAtIndex_3)
