# Dynamo graph DFBP_21_Revit Warning Reporter.dyn (Dynamo 1.3.2.2480)

# group: NOTE:
# note: This script only works in Revit version 2018 and higher

# group: Get Warnings
boolean = BoolSelector(true)
# note: From Bang! package
getWarnings = Revit.WarningTools.GetWarnings(boolean)

# group: Output Warning Types and Counts
uniqueItems = List.UniqueItems(getWarnings.out0)
watch = Watch(uniqueItems)
containsItem = List.ContainsItem(list=uniqueItems, item=getWarnings.out0, lacing=CrossProduct)
countTrue = CountTrue(containsItem@L2)
watch_2 = Watch(countTrue)

# group: Output Total Number of Warnings
count = List.Count(getWarnings.out0)
watch_3 = Watch(count)

# group: Delete Duplicate Elements
string = StringInput("identical instances")
boolean_2 = BoolSelector(true)
contains = String.Contains(str=getWarnings.out0, searchFor=string, ignoreCase=boolean_2)
filterByBoolMask = List.FilterByBoolMask(list=getWarnings.out1, mask=contains)
firstItem = List.FirstItem(filterByBoolMask.in@L2)
# note: From Springs package
boolean_3 = BoolSelector(false)
deleteElements = Custom[Springs.Doc.DeleteElements](element=firstItem, confirm=boolean_3)  # Attempts to delete the input list of elements from the active Revit document.The node returns the number of successfully deleted elements and their Ids as a string. Carefully observe the deleted elements count. It may be greater than the input list because hosted elements or tags will be deleted as well. If an element in the list can not be deleted (for example last revision or last view), the whole list will fail to be deleted.

# group: Export Warnings to Excel
file_path = Filename("..\..\..\..\..\..\Desktop\Warning Output")
string_2 = StringInput("Revit Warnings")
number = DoubleInput(0)
id = Element.Id(getWarnings.out1)
create = List.Create(getWarnings.out0, getWarnings.out1, id)
transpose = List.Transpose(create)
flatten = Flatten(transpose@L3)
boolean_4 = BoolSelector(true)
writeToFile = Excel.WriteToFile(filePath=file_path, sheetName=string_2, startRow=number, startCol=number, data=flatten, overWrite=boolean_4)

# group: Isolate Warning Elements in 3D View
string_3 = StringInput("identical instances")
boolean_5 = BoolSelector(true)
contains_2 = String.Contains(str=getWarnings.out0, searchFor=string_3, ignoreCase=boolean_5)
filterByBoolMask_2 = List.FilterByBoolMask(list=getWarnings.out1, mask=contains_2)
flatten_2 = Flatten(filterByBoolMask_2.in)
views = Views("{3D}")
code_block = CodeBlock(name=string_3) { "Warning_" + name; }
# note: From archilab package
duplicate_options = DuplicateOptionsUi("Duplicate")
duplicate = archilab.Revit.Views.View.Duplicate(views, code_block, duplicate_options)
isolate_in_view = Custom[Isolate in View](Element=flatten_2, View=duplicate)  # This node will take input of elements and a view to isolate selected elements in a view.
