# Dynamo graph DFBP_22_Assign Workset By Category.dyn (Dynamo 1.3.2.2480)

# group: Specify Categories and Create List
categories = Categories("Walls")
categories_2 = Categories("Floors")
categories_3 = Categories("Roofs")
create = List.Create(categories, categories_2, categories_3)

# group: Get All Elements
all_elements_of_category = ElementsOfCategory(create)
flatten = Flatten(all_elements_of_category)

# group: Get Workset By Name
getAll = archilab.Revit.Elements.Workset.GetAll()
# note: From archilab package
name = archilab.Revit.Elements.Workset.Name(getAll)
string = StringInput("Shell")
firstIndexOf = List.FirstIndexOf(list=name, item=string)
getItemAtIndex = List.GetItemAtIndex(list=getAll, index=firstIndexOf)

# group: Set Element's Workset
string_2 = StringInput("Workset")
# note: From archilab package
id = archilab.Revit.Elements.Workset.Id(getItemAtIndex)
setParameterByName = Element.SetParameterByName(element=flatten, parameterName=string_2, value=id)
