# Dynamo graph DFBP_23_Renumber Column Grids.dyn (Dynamo 2.0.1.5055)

# group: Get All Grid Lines and Extract Curve
element_types = ElementTypes(index=142)  # graph input
all_elements_of_type = ElementsOfType(element_type=element_types)
curve = Grid.Curve(grid=all_elements_of_type)

# group: Select Renumber Line and Extract Curve
select_model_element = DSModelElementSelection()  # nothing selected; graph input
curves = Element.Curves(element=select_model_element)

# group: Add Points Along Line
number_slider = DoubleSlider(250, range=0..250 step 1)  # graph input
# note: From Lunchbox package
divideCurve = Geometry.Curves.DivideCurve(curve=curves, Number=number_slider)

# group: Create Upper and Lower Points
code_block = CodeBlock { 1000; }
byCoordinates = Vector.ByCoordinates(z=code_block)
subtract = Point.Subtract(point=divideCurve.Points, vectorToSubtract=byCoordinates)
add = Point.Add(point=divideCurve.Points, vectorToAdd=byCoordinates)

# group: Create Cylinders and Look for Intersection with Line
code_block_2 = CodeBlock { 800; }
byPointsRadius = Cylinder.ByPointsRadius(startPoint=subtract, endPoint=add, radius=code_block_2)
flatten = List.Flatten(list=byPointsRadius)
doesIntersect = Geometry.DoesIntersect(geometry=flatten, other=curve, lacing=CrossProduct)

# group: Get Index Number of Intersecting Grid Lines
boolean = BoolSelector(true)  # graph input
firstIndexOf = List.FirstIndexOf(list=doesIntersect@L2, item=boolean)
uniqueItems = List.UniqueItems(list=firstIndexOf)

# group: Remove Empty Values and Get Grid Lines
code_block_3 = CodeBlock { -1; }
firstIndexOf_2 = List.FirstIndexOf(list=uniqueItems, item=code_block_3)
removeItemAtIndex = List.RemoveItemAtIndex(list=uniqueItems, indices=firstIndexOf_2)
getItemAtIndex = List.GetItemAtIndex(list=all_elements_of_type, index=removeItemAtIndex)

# group: Generate Number Sequence
number = DoubleInput(1)  # graph input
count = List.Count(list=getItemAtIndex)
sequence = Sequence(start=number, amount=count)
string_from_object = FromObject(obj=sequence)

# group: Add Prefix
# note: Use this node first then disconnect. Connect the "String from Object" node and re-run the script. This will prevent errors where two grid lines have the same number.
code_block_4 = CodeBlock(val=string_from_object) { "ZZZ" + val; }

# group: Update Grid Numbers
code_block_5 = CodeBlock { "Name"; }
setParameterByName = Element.SetParameterByName(element=getItemAtIndex, parameterName=code_block_5, value=code_block_4)

# group: Generate Letter Sequence
# note: From Clockwork Package
boolean_2 = BoolSelector(true)  # graph input
alphabeticalSequence = Custom[List.AlphabeticalSequence](n=count, upperCase=boolean_2)  # Creates a list of the first N letters of the alphabet (where 1 = A, 2 = B, ... , 27 = AA, 28 = AB etc.).
