# Dynamo graph DFBP_24_Model Statistics.dyn (Dynamo 2.0.1.5055)

# group: Number of Warnings
boolean = BoolSelector(true)
string = StringInput("Number of warnings:")
# note: From archilab package
count = List.Count()  # unwired: list
watch = Watch(count)
create = List.Create(item0=string, item1=watch)

# group: File Path
string_2 = StringInput("File name:")  # graph input
current = Document.Current()
filePath = Document.FilePath(document=current)
watch_2 = Watch(filePath)
create_2 = List.Create(item0=string_2, item1=watch_2)

# group: File Size
string_3 = StringInput("File size:")  # graph input
size = Custom[Springs.File.Size](path=filePath)  # Outputs the the file size in kilobytes or megabytes. Provide a file path as a string. Set kbOnly to true for a consistent output.
# note: From Springs package
number = DoubleInput(0)
getItemAtIndex = List.GetItemAtIndex(list=size, index=number)
watch_3 = Watch(getItemAtIndex)
create_3 = List.Create(item0=string_3, item1=watch_3)

# group: Revit Version
string_4 = StringInput("Revit version:")
version = Custom[Application.Version]()  # Retrieves the name, version and build of the current Revit application.
# note: From Clockwork package
watch_4 = Watch(version.fullVersion)
create_4 = List.Create(item0=string_4, item1=watch_4)

create_5 = List.Create(item0=create_2, item1=create_3, item2=create_4)

# group: Number of Identical Instances
string_5 = StringInput("Number of identical instances:")  # graph input
string_6 = StringInput("identical instances")  # graph input
boolean_2 = BoolSelector(true)  # graph input
contains = String.Contains(searchFor=string_6, ignoreCase=boolean_2)  # unwired: str
countTrue = List.CountTrue(list=contains)
watch_5 = Watch(countTrue)
create_6 = List.Create(item0=string_5, item1=watch_5)

create_7 = List.Create(item0=create, item1=create_6)

# group: Number of Rooms
string_7 = StringInput("Number of rooms:")  # graph input
categories = Categories(index=425)  # graph input
all_elements_of_category = ElementsOfCategory(Category=categories)
count_2 = List.Count(list=all_elements_of_category)
watch_6 = Watch(count_2)
create_8 = List.Create(item0=string_7, item1=watch_6)

# group: Number of Unplaced Rooms
string_8 = StringInput("Number of unplaced rooms:")  # graph input
area = Room.Area(room=all_elements_of_category)
number_2 = DoubleInput(1)  # graph input
lt = area < number_2
countTrue_2 = List.CountTrue(list=lt)
watch_7 = Watch(countTrue_2)
create_9 = List.Create(item0=string_8, item1=watch_7)

create_10 = List.Create(item0=create_8, item1=create_9)

# group: Number of View Templates
categories_2 = Categories(index=602)  # graph input
all_elements_of_category_2 = ElementsOfCategory(Category=categories_2)
# note: From Archi-Lab package
clear_list = Custom[Clear List](Input=all_elements_of_category_2)  # This node will remove all Null and Empty Lists from any list.
# note: From Clockwork package
isViewTemplate = Custom[View.IsViewTemplate+](view=clear_list)  # Checks if a given view is a view template. Unlike the OOTB node it works for all view types.
countTrue_3 = List.CountTrue(list=isViewTemplate)
string_9 = StringInput("Number of view templates:")  # graph input
watch_8 = Watch(countTrue_3)
create_11 = List.Create(item0=string_9, item1=watch_8)

# group: Number of Views
string_10 = StringInput("Number of views:")  # graph input
categories_3 = Categories(index=602)  # graph input
all_elements_of_category_3 = ElementsOfCategory(Category=categories_3)
# note: From Archi-Lab package
clear_list_2 = Custom[Clear List](Input=all_elements_of_category_3)
count_3 = List.Count(list=clear_list_2)
sub = count_3 - countTrue_3
watch_9 = Watch(sub)
create_12 = List.Create(item0=string_10, item1=watch_9)

# group: Percentage of Views Using View Template
string_11 = StringInput("Percentage of views using view template:")  # graph input
filterByBoolMask = List.FilterByBoolMask(list=all_elements_of_category_2, mask=isViewTemplate)
# note: From Clockwork package
viewTemplate = Custom[View.ViewTemplate](view=filterByBoolMask.out)  # Returns the view template assigned to a given view (if one is assigned)
# note: From Archi-Lab package
clear_list_3 = Custom[Clear List](Input=viewTemplate)
count_4 = List.Count(list=clear_list_3)
div = count_4 / sub
number_3 = DoubleInput(100)  # graph input
mul = div * number_3
number_4 = DoubleInput(1)  # graph input
round = Math.Round(number=mul, digits=number_4)
watch_10 = Watch(round)
create_13 = List.Create(item0=string_11, item1=watch_10)

# group: Starting View
string_12 = StringInput("Starting View:")  # graph input
boolean_3 = BoolSelector(true)  # graph input
startingView = Custom[Document.StartingView](toggle=boolean_3)  # Retrieves the starting view of a Project file. Returns null if no starting view is set.
# note: From Clockwork package
name = Element.Name(element=startingView)
watch_11 = Watch(name)
create_14 = List.Create(item0=string_12, item1=watch_11)

create_15 = List.Create(item0=create_12, item1=create_11, item2=create_13, item3=create_14)

# group: Number of Sheets
string_13 = StringInput("Number of sheets:")  # graph input
categories_4 = Categories(index=447)  # graph input
all_elements_of_category_4 = ElementsOfCategory(Category=categories_4)
count_5 = List.Count(list=all_elements_of_category_4)
watch_12 = Watch(count_5)
create_16 = List.Create(item0=string_13, item1=watch_12)

# group: Percentage of Views on Sheets
string_14 = StringInput("Percentage of Views on Sheets:")  # graph input
# note: From Springs package
views = Custom[Springs.Sheet.Views+](sheet=all_elements_of_category_4)  # Extracts all views and schedules (minus the revision schedule) placed on the input sheet (or sheets). Will be depreciated once the bult in node works with all plan types.
flatten = List.Flatten(list=views.view_s)
count_6 = List.Count(list=flatten)
div_2 = count_6 / sub
number_5 = DoubleInput(100)  # graph input
mul_2 = div_2 * number_5
number_6 = DoubleInput(1)  # graph input
round_2 = Math.Round(number=mul_2, digits=number_6)
watch_13 = Watch(round_2)
create_17 = List.Create(item0=string_14, item1=watch_13)

create_18 = List.Create(item0=create_16, item1=create_17)

# group: Number of Worksets
string_15 = StringInput("Number of worksets:")  # graph input
# note: From archilab package
count_7 = List.Count()  # unwired: list
watch_14 = Watch(count_7)
create_19 = List.Create(item0=string_15, item1=watch_14)

# group: Number of Design Option Sets and Options
string_16 = StringInput("Number of Design Options:")  # graph input
# note: From Clockwork package
designOptions = Custom[Document.DesignOptions]()  # Returns all design options in the model, grouped by design option set
flatten_2 = List.Flatten(list=designOptions.DesignOptions)
count_8 = List.Count(list=flatten_2)
watch_15 = Watch(count_8)
create_20 = List.Create(item0=string_16, item1=watch_15)
string_17 = StringInput("Number of Design Option Sets:")  # graph input
count_9 = List.Count(list=designOptions.DesignOptionSets)
watch_16 = Watch(count_9)
create_21 = List.Create(item0=string_17, item1=watch_16)

create_22 = List.Create(item0=create_19, item1=create_20, item2=create_21)

# group: Number of CAD Links and Imports
string_18 = StringInput("Number of CAD links:")  # graph input
reportInstances = CAD.ReportInstances()
count_10 = List.Count(list=reportInstances.CADLinks)
watch_17 = Watch(count_10)
create_23 = List.Create(item0=string_18, item1=watch_17)
string_19 = StringInput("Number of CAD imports:")  # graph input
# note: From BimorphNodes package
count_11 = List.Count(list=reportInstances.CADImports)
watch_18 = Watch(count_11)
create_24 = List.Create(item0=string_19, item1=watch_18)

# group: Number of RVT Links
string_20 = StringInput("Number of RVT links:")  # graph input
# note: From Data-Shapes package
get_all_linked_docs_infos = Custom[Get All Linked Docs infos]()  # Get all linked documents names and paths
count_12 = List.Count(list=get_all_linked_docs_infos.Rvt_links_names)
watch_19 = Watch(count_12)
create_25 = List.Create(item0=string_20, item1=watch_19)

create_26 = List.Create(item0=create_23, item1=create_24, item2=create_25)

# group: Number of Wall Types
string_21 = StringInput("Number of wall types:")  # graph input
element_types = ElementTypes(index=345)  # graph input
all_elements_of_type = ElementsOfType(element_type=element_types)
count_13 = List.Count(list=all_elements_of_type)
watch_20 = Watch(count_13)
create_27 = List.Create(item0=string_21, item1=watch_20)

# group: Number of Wall Instances
string_22 = StringInput("Number of wall instances:")  # graph input
categories_5 = Categories(index=604)  # graph input
all_elements_of_category_5 = ElementsOfCategory(Category=categories_5)
count_14 = List.Count(list=all_elements_of_category_5)
watch_21 = Watch(count_14)
create_28 = List.Create(item0=string_22, item1=watch_21)

# group: Percentage of Wall Types in Use
string_23 = StringInput("Percentage of wall types in use:")  # graph input
# note: From archilab package
uniqueItems = List.UniqueItems()  # unwired: list
count_15 = List.Count(list=uniqueItems)
div_3 = count_15 / count_13
number_7 = DoubleInput(100)  # graph input
mul_3 = div_3 * number_7
number_8 = DoubleInput(1)  # graph input
round_3 = Math.Round(number=mul_3, digits=number_8)
watch_22 = Watch(round_3)
create_29 = List.Create(item0=string_23, item1=watch_22)

create_30 = List.Create(item0=create_27, item1=create_28, item2=create_29)

# group: Number of Text Note Types
string_24 = StringInput("Number of text note types:")  # graph input
element_types_2 = ElementTypes(index=320)  # graph input
all_elements_of_type_2 = ElementsOfType(element_type=element_types_2)
count_16 = List.Count(list=all_elements_of_type_2)
watch_23 = Watch(count_16)
create_31 = List.Create(item0=string_24, item1=watch_23)

# group: Number of Text Notes
string_25 = StringInput("Number of text notes:")  # graph input
categories_6 = Categories(index=585)  # graph input
all_elements_of_category_6 = ElementsOfCategory(Category=categories_6)
count_17 = List.Count(list=all_elements_of_category_6)
watch_24 = Watch(count_17)
create_32 = List.Create(item0=string_25, item1=watch_24)

# group: Percentage of Text Note Types in Use
string_26 = StringInput("Percentage of text note types in use:")  # graph input
typename = TextNote.Typename(textNote=all_elements_of_category_6)
uniqueItems_2 = List.UniqueItems(list=typename)
count_18 = List.Count(list=uniqueItems_2)
div_4 = count_18 / count_16
number_9 = DoubleInput(100)  # graph input
mul_4 = div_4 * number_9
number_10 = DoubleInput(1)  # graph input
round_4 = Math.Round(number=mul_4, digits=number_10)
watch_25 = Watch(round_4)
create_33 = List.Create(item0=string_26, item1=watch_25)

# group: Number of Filled Region Types
string_27 = StringInput("Number of filled region types:")  # graph input
element_types_3 = ElementTypes(index=125)  # graph input
all_elements_of_type_3 = ElementsOfType(element_type=element_types_3)
count_19 = List.Count(list=all_elements_of_type_3)
watch_26 = Watch(count_19)
create_34 = List.Create(item0=string_27, item1=watch_26)

# group: Number of Filled Regions
string_28 = StringInput("Number of filled regions:")  # graph input
element_types_4 = ElementTypes(index=124)  # graph input
all_elements_of_type_4 = ElementsOfType(element_type=element_types_4)
count_20 = List.Count(list=all_elements_of_type_4)
watch_27 = Watch(count_20)
create_35 = List.Create(item0=string_28, item1=watch_27)

# group: Percentage of Text Note Types in Use
string_29 = StringInput("Percentage of filled region types in use:")  # graph input
name_2 = FilledRegionType.Name(filledRegionType=all_elements_of_type_4)
uniqueItems_3 = List.UniqueItems(list=name_2)
count_21 = List.Count(list=uniqueItems_3)
div_5 = count_21 / count_19
number_11 = DoubleInput(100)  # graph input
mul_5 = div_5 * number_11
number_12 = DoubleInput(1)  # graph input
round_5 = Math.Round(number=mul_5, digits=number_12)
watch_28 = Watch(round_5)
create_36 = List.Create(item0=string_29, item1=watch_28)

create_37 = List.Create(item0=create_31, item1=create_32, item2=create_33, item3=create_34, item4=create_35, item5=create_36)

# group: Write Data to Excel
file_path = Filename(".\No file selected.xlsx")  # graph input
string_30 = StringInput("Model Statistics")  # graph input
number_13 = DoubleInput(0)  # graph input
join = List.Join(list0=create_5, list1=create_7, list2=create_10, list3=create_15, list4=create_18, list5=create_22, list6=create_26, list7=create_30, list8=create_37)
boolean_4 = BoolSelector(true)  # graph input
exportExcel = Data.ExportExcel(filePath=file_path, sheetName=string_30, startRow=number_13, startCol=number_13, data=join, overWrite=boolean_4)
