# Dynamo graph DFBP_Bonus_Export Family Instance and Type Parameters.dyn (Dynamo 2.0.1.5055)

# group: Select Family Instance in Model
select_model_element = DSModelElementSelection()  # nothing selected; graph input

# group: Get All Instances of Family
getFamily = FamilyInstance.GetFamily(familyInstance=select_model_element)
types = Family.Types(family=getFamily)
all_elements_of_family_type = ElementsOfFamilyType(Family_Type=types)

# group: Get Family Name for Excel Worksheet Name
name = Family.Name(family=getFamily)

# group: Filter Out Empty Family Types
isEmpty = List.IsEmpty(list=all_elements_of_family_type@L2)
filterByBoolMask = List.FilterByBoolMask(list=all_elements_of_family_type, mask=isEmpty)
flatten = List.Flatten(list=filterByBoolMask.out)

# group: Get Instance Parameters and Sort
parameters = Element.Parameters(element=flatten)
name_2 = Parameter.Name(parameter=parameters)
firstItem = List.FirstItem(list=name_2)
sort = List.Sort(list=firstItem)

# group: Get Instance Parameter Values and Add Header
getParameterValueByName = Element.GetParameterValueByName(element=flatten, parameterName=sort, lacing=CrossProduct)
addItemToFront = List.AddItemToFront(item=sort, list=getParameterValueByName)

# group: Get Type Parameters and Sort
type = FamilyInstance.Type(familyInstance=flatten)
parameters_2 = Element.Parameters(element=type)
name_3 = Parameter.Name(parameter=parameters_2)
firstItem_2 = List.FirstItem(list=name_3)
sort_2 = List.Sort(list=firstItem_2)

# group: Get Type Parameter Values and Add Header
getParameterValueByName_2 = Element.GetParameterValueByName(element=type, parameterName=sort_2, lacing=CrossProduct)
addItemToFront_2 = List.AddItemToFront(item=sort_2, list=getParameterValueByName_2)

# group: Combine Instance and Type Parameter Lists
join = List.Join()  # unwired: list0, list1
combine = List.Combine(comb=join, list1=addItemToFront, list2=addItemToFront_2)

# group: Export Data to Excel
file_path = Filename("No file selected.")  # graph input
number = DoubleInput(0)  # graph input
boolean = BoolSelector(true)  # graph input
exportExcel = Data.ExportExcel(filePath=file_path, sheetName=name, startRow=number, startCol=number, data=combine, overWrite=boolean)
