# Dynamo graph DYN-GEN-CHK-0010_ClashPointLocation_0.1.0.dyn (Dynamo 2.0.0.4654)

# group: Select XML report
code_block = CodeBlock { "Select XML File"; }
file_path = Filename(".\Ducts_Vs_Floor.xml")
ui_filepath_data = Custom[UI.FilePath Data](InputName=code_block, DefaulPath=file_path)  # Create filepath input for UI.MultipleInputForm ++ . Check out www.data-shapes.net for more infos !

# group: Filter Risk families
code_block_2 = CodeBlock { "Select Family"; }
categories = Categories(index=228)  # graph input
all_family_types_of_category = Custom[All Family Types Of Category](category=categories)  # Gets all family types/symbols of a given category in the model (does *not *work for system families)
string_from_object = FromObject(obj=all_family_types_of_category)
code_block_3 = CodeBlock { "Risk"; }
contains = String.Contains(str=string_from_object, searchFor=code_block_3)
filterByBoolMask = List.FilterByBoolMask(list=all_family_types_of_category, mask=contains)
ui_listview_data = Custom[UI.Listview Data](InputName=code_block_2, Keys=filterByBoolMask.in, Values=filterByBoolMask.in)  # Create data for ListView input in UI.MultiInputForm ++ . Check out www.data-shapes.net for more infos.

# group: Form
code_block_4 = CodeBlock { "Select Navisworks Test"; }
file_path_2 = Filename(".\Logo.png")
fromPath = FileObject(path=file_path_2)  # "File.FromPath"
readFromFile = Image.ReadFromFile(file=fromPath)
code_block_5 = CodeBlock { "OK"; }
create = List.Create(item0=ui_filepath_data, item1=ui_listview_data)
boolean = BoolSelector(true)  # graph input
code_block_6 = CodeBlock { "Cancel"; }
ui_multipleinputform = Custom[UI.MultipleInputForm ++](Description_optional=code_block_4, Logo_optional=readFromFile, ButtonText_optional=code_block_5, Inputs=create, Toggle=boolean, CancelButtonText_optional=code_block_6)  # Create a form with multiple inputs. see www.data-shapes.net for tutorials and infos!

# group: Get risk families list
code_block_7 = CodeBlock { 1; }
getItemAtIndex = List.GetItemAtIndex(list=ui_multipleinputform.User_Inputs, index=code_block_7)

code_block_8 = CodeBlock { 0; }
getItemAtIndex_2 = List.GetItemAtIndex(list=ui_multipleinputform.User_Inputs, index=code_block_8)
read_file_path_to_elementtree = Custom[Read File Path to ElementTree with UTF8 roundtrip](filePath=getItemAtIndex_2)  # to clean unsupported characters...
string = StringInput(".//pos3f")  # graph input

# group: Get X,Y,Z from XML report
xpath_expression_find_for = Custom[XPATH Expression Find for Element Tree](ElementTree=read_file_path_to_elementtree, XPATH=string)

code_block_9 = CodeBlock { [2,1,0]; }
get_from_sublists_using_one = Custom[Get from Sublists using One Index](list=xpath_expression_find_for.attrib_values, desired_index=code_block_9)
toNumber = String.ToNumber(str=get_from_sublists_using_one)

# group: Units conversion
convert_between_units = DynamoConvert(toNumber, MeasurementType="Length", FromConversion="Meters", ToConversion="Millimeters")

numbersToPoint = Geometry.Points.NumbersToPoint(Numbers=convert_between_units)
flatten = List.Flatten(list=numbersToPoint)

# group: Translate project internal to share coordinates
code_block_10 = CodeBlock { -719064396.8; -731020499.2; }
code_block_11 = CodeBlock { 358.20; }

translate = Geometry.Translate(geometry=flatten, xTranslation=code_block_10.out0, yTranslation=code_block_10.out1)
origin = Point.Origin()
ZAxis = Vector.ZAxis()
rotate = Geometry.Rotate(geometry=translate, origin=origin, axis=ZAxis, degrees=code_block_11)

# group: Place family in the model
byPoint = FamilyInstance.ByPoint(familyType=getItemAtIndex, point=rotate, lacing=Longest)

code_block_12 = CodeBlock()
# ---------- code_block_12.designscript (16 lines) ----------
/*
NOTES

Get clash point from Navisworks Xml clash detection report and place a warning family on it

WRITTEN BY		-	Jesús Moracho
DYNAMO VERSION	-	1.3.2
PACKAGES		-	Data-Shapes, Bakery
REVIT TEMPLATE	-	UK
LAST UPDATED	-	04-05-2018

FUTURE IMPROVEMENTS
- list of potential improvements
- which could be made in the future
- if developed further
*/;
# ----------------------------------------
