# Dynamo graph DYN-GEN-DAT-0010_Calculated to Shared_0.1.0.dyn (Dynamo 2.0.0.4654)

# group: Collects open view (script works if a Spaces Schedule is open)
activeViewFromCurrentDocument = Custom[Document.ActiveViewFromCurrentDocument]()  # Gets the active view of the current document
fields = ScheduleView.Fields(scheduleView=activeViewFromCurrentDocument)

# group: Creates 3 drop downs of the scheduled parameters
code_block = CodeBlock { "Calculated Parameter"; }
ui_dropdown_data = Custom[UI.DropDown Data](InputName=code_block, Keys=fields, Values=fields)  # Create data for DropDown input in UI.MultiInputForm ++ . Check out www.data-shapes.net for more infos.
code_block_2 = CodeBlock { "Shared Parameter"; }
ui_dropdown_data_2 = Custom[UI.DropDown Data](InputName=code_block_2, Keys=fields, Values=fields)
code_block_3 = CodeBlock { "Unique Space Identifier"; }
ui_dropdown_data_3 = Custom[UI.DropDown Data](InputName=code_block_3, Keys=fields, Values=fields)
create = List.Create(item0=ui_dropdown_data, item1=ui_dropdown_data_2, item2=ui_dropdown_data_3)

# group: Creates the pop-up user interface asking for the 3 parameters drop downs created in previous group
code_block_4 = CodeBlock { "Select the following parameters from the active Schedule"; }
file_path = Filename(".\Logo.png")
fromPath = FileObject(path=file_path)  # "File.FromPath"
readFromFile = Image.ReadFromFile(file=fromPath)
boolean = BoolSelector(true)  # graph input
code_block_5 = CodeBlock { "Cancel"; }
ui_multipleinputform = Custom[UI.MultipleInputForm ++](Description_optional=code_block_4, Logo_optional=readFromFile, Inputs=create, Toggle=boolean, CancelButtonText_optional=code_block_5)  # Create a form with multiple inputs. see www.data-shapes.net for tutorials and infos!

# group: Creates a string for each parameter name selected by the user
code_block_6 = CodeBlock { 1; }
getItemAtIndex = List.GetItemAtIndex(list=ui_multipleinputform.User_Inputs, index=code_block_6)
string_from_object = FromObject(obj=getItemAtIndex)
code_block_7 = CodeBlock { 0; }
getItemAtIndex_2 = List.GetItemAtIndex(list=ui_multipleinputform.User_Inputs, index=code_block_7)
string_from_object_2 = FromObject(obj=getItemAtIndex_2)
code_block_8 = CodeBlock { 2; }
getItemAtIndex_3 = List.GetItemAtIndex(list=ui_multipleinputform.User_Inputs, index=code_block_8)
string_from_object_3 = FromObject(obj=getItemAtIndex_3)

# group: Collect all spaces and a list of their unique identifier
categories = Categories(index=447)  # graph input
all_elements_of_category = ElementsOfCategory(Category=categories)
getParameterValueByName = Element.GetParameterValueByName(element=all_elements_of_category, parameterName=string_from_object_3)
flatten = List.Flatten(list=getParameterValueByName)

# group: Collect calculated value from active schedule
getCalculatedValues = Custom[Schedule.GetCalculatedValues](ViewSchedule_List=activeViewFromCurrentDocument, Calc_Val_Name_string=string_from_object_2)  # Get Schedule Calculated Values from name input
code_block_9 = CodeBlock(ls1=getCalculatedValues.Value_s) { ls1; }
flatten_2 = List.Flatten(list=code_block_9)

# group: Collect Unique Space Identifier from active schedule
getCalculatedValues_2 = Custom[Schedule.GetCalculatedValues](ViewSchedule_List=activeViewFromCurrentDocument, Calc_Val_Name_string=string_from_object_3)
code_block_10 = CodeBlock(ls2=getCalculatedValues_2.Value_s) { ls2; }
flatten_3 = List.Flatten(list=code_block_10)

# group: Not used option to round the resulting values
firstIndexOf = List.FirstIndexOf(list=flatten_3, item=flatten)
getItemAtIndex_4 = List.GetItemAtIndex(list=flatten_2, index=firstIndexOf)
toNumber = String.ToNumber(str=getItemAtIndex_4)
code_block_11 = CodeBlock { 5; }
ceiling = Custom[Math.Ceiling+](dbl=toNumber, precision=code_block_11)  # Rounds a number *up* to a specified precision
code_block_12 = CodeBlock { 60; }
div = ceiling / code_block_12
setParameterByName = Element.SetParameterByName(element=all_elements_of_category, parameterName=string_from_object, value=div)
