# Dynamo graph DYN-GEN-DAT-0010_Generate IES Link Name0.1.0.dyn (Dynamo 2.0.0.4654)

# group: Collect all spaces
categories = Categories(index=447)  # graph input
all_elements_of_category = ElementsOfCategory(Category=categories)

# group: Create lists of space level, name and number
code_block = CodeBlock { "Level"; }
getParameterValueByName = Element.GetParameterValueByName(element=all_elements_of_category, parameterName=code_block)
code_block_2 = CodeBlock { "Name"; }
getParameterValueByName_2 = Element.GetParameterValueByName(element=all_elements_of_category, parameterName=code_block_2)
code_block_3 = CodeBlock { "Number"; }
getParameterValueByName_3 = Element.GetParameterValueByName(element=all_elements_of_category, parameterName=code_block_3)

# group: Shortens Level name to first 3 digits
code_block_4 = CodeBlock { 0; 1; }
substring = String.Substring(str=getParameterValueByName, startIndex=code_block_4.out0, length=code_block_4.out1)

# group: Joins level, name and number together with a _ between
code_block_5 = CodeBlock { "_"; }
create = List.Create(item0=substring, item1=getParameterValueByName_2, item2=getParameterValueByName_3)
transpose = List.Transpose(lists=create)
join = String.Join(separator=code_block_5, string0=transpose)
flatten = List.Flatten(list=join)

# group: Writes new value to IES Link Name
code_block_6 = CodeBlock { "IES Link Name"; }
setParameterByName = Element.SetParameterByName(element=all_elements_of_category, parameterName=code_block_6, value=flatten)
