# Dynamo graph DYN-GEN-DAT-0010_Move OA from Calc to shared0.1.0.dyn (Dynamo 2.0.0.4654)

# group: Collect all spaces and a list of their 'IES Link Name'
categories = Categories(index=447)  # graph input
all_elements_of_category = ElementsOfCategory(Category=categories)
code_block = CodeBlock { "IES Link Name"; }
getParameterValueByName = Element.GetParameterValueByName(element=all_elements_of_category, parameterName=code_block)
flatten = List.Flatten(list=getParameterValueByName)

code_block_2 = CodeBlock { "Ventilation Flow Rate"; }
activeViewFromCurrentDocument = Custom[Document.ActiveViewFromCurrentDocument]()  # Gets the active view of the current document

# group: Collect calculated value from active schedule
string = StringInput("Outdoor Airflow [cfm]")  # graph input
getCalculatedValues = Custom[Schedule.GetCalculatedValues](ViewSchedule_List=activeViewFromCurrentDocument, Calc_Val_Name_string=string)  # Get Schedule Calculated Values from name input
code_block_3 = CodeBlock(ls1=getCalculatedValues.Value_s) { ls1; }
flatten_2 = List.Flatten(list=code_block_3)

# group: Collect IES Link Name from active schedule
string_2 = StringInput("IES Link Name")  # graph input
getCalculatedValues_2 = Custom[Schedule.GetCalculatedValues](ViewSchedule_List=activeViewFromCurrentDocument, Calc_Val_Name_string=string_2)
code_block_4 = CodeBlock(ls2=getCalculatedValues_2.Value_s) { ls2; }
flatten_3 = List.Flatten(list=code_block_4)

# group: Matches instances from the schedule with elements and converts values for import
firstIndexOf = List.FirstIndexOf(list=flatten_3, item=flatten)
getItemAtIndex = List.GetItemAtIndex(list=flatten_2, index=firstIndexOf)
toNumber = String.ToNumber(str=getItemAtIndex)
code_block_5 = CodeBlock { 5; }
ceiling = Custom[Math.Ceiling+](dbl=toNumber, precision=code_block_5)  # Rounds a number *up* to a specified precision
code_block_6 = CodeBlock { 60; }
div = ceiling / code_block_6

setParameterByName = Element.SetParameterByName(element=all_elements_of_category, parameterName=code_block_2, value=div)
