# Dynamo graph DYN-MEC-DES-0010_HVACExcelRevitLink_0.1.0.dyn (Dynamo 2.0.0.4654)

# group: Collects all spaces from Revit file. Displays all parameters avalible for reference. Space Numbers placed into list which is used by all other modules
categories = Categories(index=447)  # graph input
all_elements_of_category = ElementsOfCategory(Category=categories)
code_block = CodeBlock { "General_Location"; }
getParameterValueByName = Element.GetParameterValueByName(element=all_elements_of_category, parameterName=code_block)
level = CodeBlock { "LB"; }
contains = String.Contains(str=getParameterValueByName, searchFor=level)
filterByBoolMask = List.FilterByBoolMask(list=all_elements_of_category, mask=contains)
# note: Enter Desired Level Here
# Blank results in all levels
code_block_2 = CodeBlock { "Level"; }
getParameterValueByName_2 = Element.GetParameterValueByName(element=filterByBoolMask.out, parameterName=code_block_2)
level_2 = CodeBlock { "B02"; }
contains_2 = String.Contains(str=getParameterValueByName_2, searchFor=level_2)
filterByBoolMask_2 = List.FilterByBoolMask(list=all_elements_of_category, mask=contains_2)
code_block_3 = CodeBlock { "Number"; }
getParameterValueByName_3 = Element.GetParameterValueByName(element=all_elements_of_category, parameterName=code_block_3)
filterByBoolMask_3 = List.FilterByBoolMask(list=getParameterValueByName_3, mask=contains_2)

# group: File path to HVAC Design file and other constants defined here
# note: Note: Revit reads all values from Dynamo in Imperial Units. Metric units from Excel are converted to Imperial using these conversion values. The values are then displayed as Metric once in Revit thanks to our template.
# note: Green groups are user inputs, edit with caution.
# Purple and Functions within the Script.
# Pink are Text assignments from Excel.
# Blue are Number assignments from Excel and include a conversion factor.
# Orange are data recovery functions as should only be turned on if data in the Revit model has been lost.
file_path = Filename(".\Example_HVAC Design File.xlsx")
defines_conversion_values = CodeBlock()
# ---------- defines_conversion_values.designscript (14 lines) ----------
def LStoCFS()
{
return=0.03531467;
};

def m2toft2()
{
return=10.76391;
};

def WtoBTUh()
{
return=10.7637;
};
# ----------------------------------------

# group: Reads entire Spaces Ventilation Table for use by other Modules
on_off_control_for_module = BoolSelector(true)  # graph input
code_block_4 = CodeBlock { "Spaces Ventilation"; "b12"; "az5015"; }
boolean = BoolSelector(true)  # graph input
read_excel = Custom[Read Excel](filePath=file_path, runIt=on_off_control_for_module, sheetName=code_block_4.out0, byColumn=boolean, origin=code_block_4.out1, extent=code_block_4.out2)  # This node will read an excel file. You can read an entore sheet contents, read from specific origin cell, read only specific range, or do all of the former for multiple sheets at the same time.
code_block_5 = CodeBlock { 0; }
# note: Gets all Space Numbers from Excel
getItemAtIndex = List.GetItemAtIndex(list=read_excel, index=code_block_5)

# group: Excel Location of table headers
location_of_headers_in_excel = CodeBlock { "Spaces Ventilation"; "b11"; "az11"; }

# group: Imports and Assign Supply Air Flow rates from Excel to Revit
code_block_6 = CodeBlock { "SA Flow"; "Specified Supply Airflow"; }
on_off_control_for_module_2 = BoolSelector(true)  # graph input
boolean_2 = BoolSelector(true)  # graph input
read_excel_2 = Custom[Read Excel](filePath=file_path, runIt=on_off_control_for_module_2, sheetName=location_of_headers_in_excel.out0, byColumn=boolean_2, origin=location_of_headers_in_excel.out1, extent=location_of_headers_in_excel.out2)
flatten = List.Flatten(list=read_excel_2)
firstIndexOf = List.FirstIndexOf(list=flatten, item=code_block_6.out0)
getItemAtIndex_2 = List.GetItemAtIndex(list=read_excel, index=firstIndexOf)
firstIndexOf_2 = List.FirstIndexOf(list=getItemAtIndex, item=filterByBoolMask_3.in)
getItemAtIndex_3 = List.GetItemAtIndex(list=getItemAtIndex_2, index=firstIndexOf_2)
conversion_l_s_to_cfs = CodeBlock { LStoCFS(); }
# note: Break Link to Disable write to Revit
mul = getItemAtIndex_3 * conversion_l_s_to_cfs
setParameterByName = Element.SetParameterByName(element=filterByBoolMask_2.in, parameterName=code_block_6.out1, value=mul)

# group: Imports and Assign Return Air Flow rates from Excel to Revit
code_block_7 = CodeBlock { "RA Flow"; "Specified Return Airflow"; }
on_off_control_for_module_3 = BoolSelector(true)  # graph input
boolean_3 = BoolSelector(true)  # graph input
read_excel_3 = Custom[Read Excel](filePath=file_path, runIt=on_off_control_for_module_3, sheetName=location_of_headers_in_excel.out0, byColumn=boolean_3, origin=location_of_headers_in_excel.out1, extent=location_of_headers_in_excel.out2)
flatten_2 = List.Flatten(list=read_excel_3)
firstIndexOf_3 = List.FirstIndexOf(list=flatten_2, item=code_block_7.out0)
getItemAtIndex_4 = List.GetItemAtIndex(list=read_excel, index=firstIndexOf_3)
firstIndexOf_4 = List.FirstIndexOf(list=getItemAtIndex, item=filterByBoolMask_3.in)
getItemAtIndex_5 = List.GetItemAtIndex(list=getItemAtIndex_4, index=firstIndexOf_4)
conversion_l_s_to_cfs_2 = CodeBlock { LStoCFS(); }
# note: Break Link to Disable write to Revit
mul_2 = getItemAtIndex_5 * conversion_l_s_to_cfs_2
setParameterByName_2 = Element.SetParameterByName(element=filterByBoolMask_2.in, parameterName=code_block_7.out1, value=mul_2)

# group: Imports and Assign Exhuast Air Flow rates from Excel to Revit
code_block_8 = CodeBlock { "EXA Flow"; "Specified Exhaust Airflow"; }
on_off_control_for_module_4 = BoolSelector(true)  # graph input
boolean_4 = BoolSelector(true)  # graph input
read_excel_4 = Custom[Read Excel](filePath=file_path, runIt=on_off_control_for_module_4, sheetName=location_of_headers_in_excel.out0, byColumn=boolean_4, origin=location_of_headers_in_excel.out1, extent=location_of_headers_in_excel.out2)
flatten_3 = List.Flatten(list=read_excel_4)
firstIndexOf_5 = List.FirstIndexOf(list=flatten_3, item=code_block_8.out0)
getItemAtIndex_6 = List.GetItemAtIndex(list=read_excel, index=firstIndexOf_5)
firstIndexOf_6 = List.FirstIndexOf(list=getItemAtIndex, item=filterByBoolMask_3.in)
getItemAtIndex_7 = List.GetItemAtIndex(list=getItemAtIndex_6, index=firstIndexOf_6)
conversion_l_s_to_cfs_3 = CodeBlock { LStoCFS(); }
# note: Break Link to Disable write to Revit
mul_3 = getItemAtIndex_7 * conversion_l_s_to_cfs_3
setParameterByName_3 = Element.SetParameterByName(element=filterByBoolMask_2.in, parameterName=code_block_8.out1, value=mul_3)

# group: Reads entire Spaces Data Table for use by other Modules
on_off_control_for_module_5 = BoolSelector(true)  # graph input
code_block_9 = CodeBlock { "Space Data"; "b12"; "az5015"; }
boolean_5 = BoolSelector(true)  # graph input
read_excel_5 = Custom[Read Excel](filePath=file_path, runIt=on_off_control_for_module_5, sheetName=code_block_9.out0, byColumn=boolean_5, origin=code_block_9.out1, extent=code_block_9.out2)
code_block_10 = CodeBlock { 0; }
# note: Gets all Space Numbers from Excel
getItemAtIndex_8 = List.GetItemAtIndex(list=read_excel_5, index=code_block_10)

# group: Excel Location of table headers
location_of_headers_in_excel_2 = CodeBlock { "Space Data"; "b11"; "az11"; }

# group: Imports and Assign Design Cooling Load from Excel to Revit
code_block_11 = CodeBlock { "Design Sensible Gain with Safety"; "Design Cooling Load"; }
on_off_control_for_module_6 = BoolSelector(true)  # graph input
boolean_6 = BoolSelector(true)  # graph input
read_excel_6 = Custom[Read Excel](filePath=file_path, runIt=on_off_control_for_module_6, sheetName=location_of_headers_in_excel_2.out0, byColumn=boolean_6, origin=location_of_headers_in_excel_2.out1, extent=location_of_headers_in_excel_2.out2)
flatten_4 = List.Flatten(list=read_excel_6)
firstIndexOf_7 = List.FirstIndexOf(list=flatten_4, item=code_block_11.out0)
getItemAtIndex_9 = List.GetItemAtIndex(list=read_excel_5, index=firstIndexOf_7)
firstIndexOf_8 = List.FirstIndexOf(list=getItemAtIndex_8, item=filterByBoolMask_3.in)
getItemAtIndex_10 = List.GetItemAtIndex(list=getItemAtIndex_9, index=firstIndexOf_8)
conversion = CodeBlock { WtoBTUh(); }
# note: Break Link to Disable write to Revit
mul_4 = getItemAtIndex_10 * conversion
setParameterByName_4 = Element.SetParameterByName(element=filterByBoolMask_2.in, parameterName=code_block_11.out1, value=mul_4)

# group: Imports and Assign Design Heating Load from Excel to Revit
code_block_12 = CodeBlock { "Design Heat Loss With Safety"; "Design Heating Load"; }
on_off_control_for_module_7 = BoolSelector(true)  # graph input
boolean_7 = BoolSelector(true)  # graph input
read_excel_7 = Custom[Read Excel](filePath=file_path, runIt=on_off_control_for_module_7, sheetName=location_of_headers_in_excel_2.out0, byColumn=boolean_7, origin=location_of_headers_in_excel_2.out1, extent=location_of_headers_in_excel_2.out2)
flatten_5 = List.Flatten(list=read_excel_7)
firstIndexOf_9 = List.FirstIndexOf(list=flatten_5, item=code_block_12.out0)
getItemAtIndex_11 = List.GetItemAtIndex(list=read_excel_5, index=firstIndexOf_9)
firstIndexOf_10 = List.FirstIndexOf(list=getItemAtIndex_8, item=filterByBoolMask_3.in)
getItemAtIndex_12 = List.GetItemAtIndex(list=getItemAtIndex_11, index=firstIndexOf_10)
conversion_2 = CodeBlock { WtoBTUh(); }
# note: Break Link to Disable write to Revit
mul_5 = getItemAtIndex_12 * conversion_2
setParameterByName_5 = Element.SetParameterByName(element=filterByBoolMask_2.in, parameterName=code_block_12.out1, value=mul_5)

# group: Imports and Assign Heating Type from Excel to Revit
code_block_13 = CodeBlock { "Heating Method"; "Space_Mechanical_Heating_Type"; }
on_off_control_for_module_8 = BoolSelector(true)  # graph input
boolean_8 = BoolSelector(true)  # graph input
# note: Gets all Headers in the Excel Tab
read_excel_8 = Custom[Read Excel](filePath=file_path, runIt=on_off_control_for_module_8, sheetName=location_of_headers_in_excel_2.out0, byColumn=boolean_8, origin=location_of_headers_in_excel_2.out1, extent=location_of_headers_in_excel_2.out2)
flatten_6 = List.Flatten(list=read_excel_8)
firstIndexOf_11 = List.FirstIndexOf(list=flatten_6, item=code_block_13.out0)
getItemAtIndex_13 = List.GetItemAtIndex(list=read_excel_5, index=firstIndexOf_11)
firstIndexOf_12 = List.FirstIndexOf(list=getItemAtIndex_8, item=filterByBoolMask_3.in)
# note: Break Link to Disable write to Revit
getItemAtIndex_14 = List.GetItemAtIndex(list=getItemAtIndex_13, index=firstIndexOf_12)
setParameterByName_6 = Element.SetParameterByName(element=filterByBoolMask_2.in, parameterName=code_block_13.out1, value=getItemAtIndex_14)

# group: Imports and Assign Cooling Type from Excel to Revit
code_block_14 = CodeBlock { "Cooling Method"; "Space_Mechanical_Cooling_Type"; }
on_off_control_for_module_9 = BoolSelector(true)  # graph input
boolean_9 = BoolSelector(true)  # graph input
read_excel_9 = Custom[Read Excel](filePath=file_path, runIt=on_off_control_for_module_9, sheetName=location_of_headers_in_excel_2.out0, byColumn=boolean_9, origin=location_of_headers_in_excel_2.out1, extent=location_of_headers_in_excel_2.out2)
flatten_7 = List.Flatten(list=read_excel_9)
firstIndexOf_13 = List.FirstIndexOf(list=flatten_7, item=code_block_14.out0)
getItemAtIndex_15 = List.GetItemAtIndex(list=read_excel_5, index=firstIndexOf_13)
firstIndexOf_14 = List.FirstIndexOf(list=getItemAtIndex_8, item=filterByBoolMask_3.in)
# note: Break Link to Disable write to Revit
getItemAtIndex_16 = List.GetItemAtIndex(list=getItemAtIndex_15, index=firstIndexOf_14)
setParameterByName_7 = Element.SetParameterByName(element=filterByBoolMask_2.in, parameterName=code_block_14.out1, value=getItemAtIndex_16)

# group: Imports and Assign Ventilation Strategy Types from Excel to Revit
code_block_15 = CodeBlock { "Ventilation Strategy"; "Space_Mechanical_Ventilation_Type"; }
on_off_control_for_module_10 = BoolSelector(false)  # graph input
boolean_10 = BoolSelector(true)  # graph input
read_excel_10 = Custom[Read Excel](filePath=file_path, runIt=on_off_control_for_module_10, sheetName=location_of_headers_in_excel.out0, byColumn=boolean_10, origin=location_of_headers_in_excel.out1, extent=location_of_headers_in_excel.out2)
flatten_8 = List.Flatten(list=read_excel_10)
firstIndexOf_15 = List.FirstIndexOf(list=flatten_8, item=code_block_15.out0)
getItemAtIndex_17 = List.GetItemAtIndex(list=read_excel, index=firstIndexOf_15)
firstIndexOf_16 = List.FirstIndexOf(list=getItemAtIndex, item=filterByBoolMask_3.in)
# note: Break Link to Disable write to Revit
getItemAtIndex_18 = List.GetItemAtIndex(list=getItemAtIndex_17, index=firstIndexOf_16)
setParameterByName_8 = Element.SetParameterByName(element=filterByBoolMask_2.in, parameterName=code_block_15.out1, value=getItemAtIndex_18)

# group: Imports and Assign Outside Air Flow rates from Excel to Revit
code_block_16 = CodeBlock { "OA Flow"; "NPH_Specified_Outside_Air_Flow"; }
on_off_control_for_module_11 = BoolSelector(true)  # graph input
boolean_11 = BoolSelector(true)  # graph input
read_excel_11 = Custom[Read Excel](filePath=file_path, runIt=on_off_control_for_module_11, sheetName=location_of_headers_in_excel.out0, byColumn=boolean_11, origin=location_of_headers_in_excel.out1, extent=location_of_headers_in_excel.out2)
flatten_9 = List.Flatten(list=read_excel_11)
firstIndexOf_17 = List.FirstIndexOf(list=flatten_9, item=code_block_16.out0)
getItemAtIndex_19 = List.GetItemAtIndex(list=read_excel, index=firstIndexOf_17)
firstIndexOf_18 = List.FirstIndexOf(list=getItemAtIndex, item=filterByBoolMask_3.in)
getItemAtIndex_20 = List.GetItemAtIndex(list=getItemAtIndex_19, index=firstIndexOf_18)
conversion_l_s_to_cfs_4 = CodeBlock { LStoCFS(); }
# note: Break Link to Disable write to Revit
mul_6 = getItemAtIndex_20 * conversion_l_s_to_cfs_4
setParameterByName_9 = Element.SetParameterByName(element=filterByBoolMask_2.in, parameterName=code_block_16.out1, value=mul_6)

# group: Imports and Assign Design Space Type from Excel to Revit
code_block_17 = CodeBlock { "Design Space Type"; "NPH_Space_Type"; }
on_off_control_for_module_12 = BoolSelector(false)  # graph input
boolean_12 = BoolSelector(true)  # graph input
read_excel_12 = Custom[Read Excel](filePath=file_path, runIt=on_off_control_for_module_12, sheetName=location_of_headers_in_excel_2.out0, byColumn=boolean_12, origin=location_of_headers_in_excel_2.out1, extent=location_of_headers_in_excel_2.out2)
flatten_10 = List.Flatten(list=read_excel_12)
firstIndexOf_19 = List.FirstIndexOf(list=flatten_10, item=code_block_17.out0)
getItemAtIndex_21 = List.GetItemAtIndex(list=read_excel_5, index=firstIndexOf_19)
firstIndexOf_20 = List.FirstIndexOf(list=getItemAtIndex_8, item=filterByBoolMask_3.in)
# note: Break Link to Disable write to Revit
getItemAtIndex_22 = List.GetItemAtIndex(list=getItemAtIndex_21, index=firstIndexOf_20)
setParameterByName_10 = Element.SetParameterByName(element=filterByBoolMask_2.in, parameterName=code_block_17.out1, value=getItemAtIndex_22)

# group: Imports and Assign Supply air Systems from Excel to Revit
code_block_18 = CodeBlock { "Supply Air System Reference"; "NPH_Space_M_Supply_System"; }
on_off_control_for_module_13 = BoolSelector(false)  # graph input
boolean_13 = BoolSelector(true)  # graph input
read_excel_13 = Custom[Read Excel](filePath=file_path, runIt=on_off_control_for_module_13, sheetName=location_of_headers_in_excel.out0, byColumn=boolean_13, origin=location_of_headers_in_excel.out1, extent=location_of_headers_in_excel.out2)
flatten_11 = List.Flatten(list=read_excel_13)
firstIndexOf_21 = List.FirstIndexOf(list=flatten_11, item=code_block_18.out0)
getItemAtIndex_23 = List.GetItemAtIndex(list=read_excel, index=firstIndexOf_21)
firstIndexOf_22 = List.FirstIndexOf(list=getItemAtIndex, item=filterByBoolMask_3.in)
# note: Break Link to Disable write to Revit
getItemAtIndex_24 = List.GetItemAtIndex(list=getItemAtIndex_23, index=firstIndexOf_22)
setParameterByName_11 = Element.SetParameterByName(element=filterByBoolMask_2.in, parameterName=code_block_18.out1, value=getItemAtIndex_24)

# group: Imports and Assign Return Air Systems from Excel to Revit
code_block_19 = CodeBlock { "Return Air System Reference"; "NPH_Space_M_Return_System"; }
on_off_control_for_module_14 = BoolSelector(false)  # graph input
boolean_14 = BoolSelector(true)  # graph input
read_excel_14 = Custom[Read Excel](filePath=file_path, runIt=on_off_control_for_module_14, sheetName=location_of_headers_in_excel.out0, byColumn=boolean_14, origin=location_of_headers_in_excel.out1, extent=location_of_headers_in_excel.out2)
flatten_12 = List.Flatten(list=read_excel_14)
firstIndexOf_23 = List.FirstIndexOf(list=flatten_12, item=code_block_19.out0)
getItemAtIndex_25 = List.GetItemAtIndex(list=read_excel, index=firstIndexOf_23)
firstIndexOf_24 = List.FirstIndexOf(list=getItemAtIndex, item=filterByBoolMask_3.in)
# note: Break Link to Disable write to Revit
getItemAtIndex_26 = List.GetItemAtIndex(list=getItemAtIndex_25, index=firstIndexOf_24)
setParameterByName_12 = Element.SetParameterByName(element=filterByBoolMask_2.in, parameterName=code_block_19.out1, value=getItemAtIndex_26)

# group: Imports and Assign Exhaust Air System from Excel to Revit
code_block_20 = CodeBlock { "Exhaust Air System Reference"; "NPH_Space_M_Exhaust_System"; }
on_off_control_for_module_15 = BoolSelector(false)  # graph input
boolean_15 = BoolSelector(true)  # graph input
read_excel_15 = Custom[Read Excel](filePath=file_path, runIt=on_off_control_for_module_15, sheetName=location_of_headers_in_excel.out0, byColumn=boolean_15, origin=location_of_headers_in_excel.out1, extent=location_of_headers_in_excel.out2)
flatten_13 = List.Flatten(list=read_excel_15)
firstIndexOf_25 = List.FirstIndexOf(list=flatten_13, item=code_block_20.out0)
getItemAtIndex_27 = List.GetItemAtIndex(list=read_excel, index=firstIndexOf_25)
firstIndexOf_26 = List.FirstIndexOf(list=getItemAtIndex, item=filterByBoolMask_3.in)
# note: Break Link to Disable write to Revit
getItemAtIndex_28 = List.GetItemAtIndex(list=getItemAtIndex_27, index=firstIndexOf_26)
setParameterByName_13 = Element.SetParameterByName(element=filterByBoolMask_2.in, parameterName=code_block_20.out1, value=getItemAtIndex_28)

# group: Imports and Assign Design LTHW Flow from Excel to Revit
code_block_21 = CodeBlock { "LTHW Flow"; "NPH_Space_M_Heating_Water_Flowrate"; }
on_off_control_for_module_16 = BoolSelector(true)  # graph input
boolean_16 = BoolSelector(true)  # graph input
read_excel_16 = Custom[Read Excel](filePath=file_path, runIt=on_off_control_for_module_16, sheetName=location_of_headers_in_excel_2.out0, byColumn=boolean_16, origin=location_of_headers_in_excel_2.out1, extent=location_of_headers_in_excel_2.out2)
flatten_14 = List.Flatten(list=read_excel_16)
firstIndexOf_27 = List.FirstIndexOf(list=flatten_14, item=code_block_21.out0)
getItemAtIndex_29 = List.GetItemAtIndex(list=read_excel_5, index=firstIndexOf_27)
firstIndexOf_28 = List.FirstIndexOf(list=getItemAtIndex_8, item=filterByBoolMask_3.in)
getItemAtIndex_30 = List.GetItemAtIndex(list=getItemAtIndex_29, index=firstIndexOf_28)
conversion_3 = CodeBlock { LStoCFS(); }
# note: Break Link to Disable write to Revit
mul_7 = getItemAtIndex_30 * conversion_3
setParameterByName_14 = Element.SetParameterByName(element=filterByBoolMask_2.in, parameterName=code_block_21.out1, value=mul_7)

# group: Imports and Assign Design CHW Flow from Excel to Revit
code_block_22 = CodeBlock { "CHW Flow"; "NPH_Space_M_Cooling_Water_Flowrate"; }
on_off_control_for_module_17 = BoolSelector(true)  # graph input
boolean_17 = BoolSelector(true)  # graph input
read_excel_17 = Custom[Read Excel](filePath=file_path, runIt=on_off_control_for_module_17, sheetName=location_of_headers_in_excel_2.out0, byColumn=boolean_17, origin=location_of_headers_in_excel_2.out1, extent=location_of_headers_in_excel_2.out2)
flatten_15 = List.Flatten(list=read_excel_17)
firstIndexOf_29 = List.FirstIndexOf(list=flatten_15, item=code_block_22.out0)
getItemAtIndex_31 = List.GetItemAtIndex(list=read_excel_5, index=firstIndexOf_29)
firstIndexOf_30 = List.FirstIndexOf(list=getItemAtIndex_8, item=filterByBoolMask_3.in)
getItemAtIndex_32 = List.GetItemAtIndex(list=getItemAtIndex_31, index=firstIndexOf_30)
conversion_4 = CodeBlock { LStoCFS(); }
# note: Break Link to Disable write to Revit
mul_8 = getItemAtIndex_32 * conversion_4
setParameterByName_15 = Element.SetParameterByName(element=filterByBoolMask_2.in, parameterName=code_block_22.out1, value=mul_8)

# group: Imports and Assign Space Equipment Type from Excel to Revit
code_block_23 = CodeBlock { "Space Equipment Type"; "NPH_Space_M_Equipment Type"; }
on_off_control_for_module_18 = BoolSelector(true)  # graph input
boolean_18 = BoolSelector(true)  # graph input
read_excel_18 = Custom[Read Excel](filePath=file_path, runIt=on_off_control_for_module_18, sheetName=location_of_headers_in_excel_2.out0, byColumn=boolean_18, origin=location_of_headers_in_excel_2.out1, extent=location_of_headers_in_excel_2.out2)
flatten_16 = List.Flatten(list=read_excel_18)
firstIndexOf_31 = List.FirstIndexOf(list=flatten_16, item=code_block_23.out0)
getItemAtIndex_33 = List.GetItemAtIndex(list=read_excel_5, index=firstIndexOf_31)
firstIndexOf_32 = List.FirstIndexOf(list=getItemAtIndex_8, item=filterByBoolMask_3.in)
# note: Break Link to Disable write to Revit
getItemAtIndex_34 = List.GetItemAtIndex(list=getItemAtIndex_33, index=firstIndexOf_32)
setParameterByName_16 = Element.SetParameterByName(element=filterByBoolMask_2.in, parameterName=code_block_23.out1, value=getItemAtIndex_34)

# group: Imports and Assign Space Equipment Number from Excel to Revit
code_block_24 = CodeBlock { "Space Equipment Number"; "NPH_Space_M_Equipment Number"; }
on_off_control_for_module_19 = BoolSelector(true)  # graph input
boolean_19 = BoolSelector(true)  # graph input
read_excel_19 = Custom[Read Excel](filePath=file_path, runIt=on_off_control_for_module_19, sheetName=location_of_headers_in_excel_2.out0, byColumn=boolean_19, origin=location_of_headers_in_excel_2.out1, extent=location_of_headers_in_excel_2.out2)
flatten_17 = List.Flatten(list=read_excel_19)
firstIndexOf_33 = List.FirstIndexOf(list=flatten_17, item=code_block_24.out0)
getItemAtIndex_35 = List.GetItemAtIndex(list=read_excel_5, index=firstIndexOf_33)
firstIndexOf_34 = List.FirstIndexOf(list=getItemAtIndex_8, item=filterByBoolMask_3.in)
# note: Break Link to Disable write to Revit
getItemAtIndex_36 = List.GetItemAtIndex(list=getItemAtIndex_35, index=firstIndexOf_34)
setParameterByName_17 = Element.SetParameterByName(element=filterByBoolMask_2.in, parameterName=code_block_24.out1, value=getItemAtIndex_36)

# group: Imports and Assign Space Nominal Pressure from Excel to Revit
code_block_25 = CodeBlock { "Nominal Pressure"; "NPH_Space_Nominal Pressure"; }
on_off_control_for_module_20 = BoolSelector(true)  # graph input
boolean_20 = BoolSelector(true)  # graph input
read_excel_20 = Custom[Read Excel](filePath=file_path, runIt=on_off_control_for_module_20, sheetName=location_of_headers_in_excel_2.out0, byColumn=boolean_20, origin=location_of_headers_in_excel_2.out1, extent=location_of_headers_in_excel_2.out2)
flatten_18 = List.Flatten(list=read_excel_20)
firstIndexOf_35 = List.FirstIndexOf(list=flatten_18, item=code_block_25.out0)
getItemAtIndex_37 = List.GetItemAtIndex(list=read_excel_5, index=firstIndexOf_35)
firstIndexOf_36 = List.FirstIndexOf(list=getItemAtIndex_8, item=filterByBoolMask_3.in)
# note: Break Link to Disable write to Revit
getItemAtIndex_38 = List.GetItemAtIndex(list=getItemAtIndex_37, index=firstIndexOf_36)
setParameterByName_18 = Element.SetParameterByName(element=filterByBoolMask_2.in, parameterName=code_block_25.out1, value=getItemAtIndex_38)

# group: Imports and Assign Space Designer Note from Excel to Revit
code_block_26 = CodeBlock { "Designer Note"; "NPH_Space_HVAC_Designer Note"; }
on_off_control_for_module_21 = BoolSelector(true)  # graph input
boolean_21 = BoolSelector(true)  # graph input
read_excel_21 = Custom[Read Excel](filePath=file_path, runIt=on_off_control_for_module_21, sheetName=location_of_headers_in_excel_2.out0, byColumn=boolean_21, origin=location_of_headers_in_excel_2.out1, extent=location_of_headers_in_excel_2.out2)
flatten_19 = List.Flatten(list=read_excel_21)
firstIndexOf_37 = List.FirstIndexOf(list=flatten_19, item=code_block_26.out0)
getItemAtIndex_39 = List.GetItemAtIndex(list=read_excel_5, index=firstIndexOf_37)
firstIndexOf_38 = List.FirstIndexOf(list=getItemAtIndex_8, item=filterByBoolMask_3.in)
# note: Break Link to Disable write to Revit
getItemAtIndex_40 = List.GetItemAtIndex(list=getItemAtIndex_39, index=firstIndexOf_38)
setParameterByName_19 = Element.SetParameterByName(element=filterByBoolMask_2.in, parameterName=code_block_26.out1, value=getItemAtIndex_40)

# group: Imports and Assign Space Solar Gain from Excel to Revit
code_block_27 = CodeBlock { "Design Solar Gain"; "Space_Solar Heat Load"; }
on_off_control_for_module_22 = BoolSelector(false)  # graph input
boolean_22 = BoolSelector(true)  # graph input
read_excel_22 = Custom[Read Excel](filePath=file_path, runIt=on_off_control_for_module_22, sheetName=location_of_headers_in_excel_2.out0, byColumn=boolean_22, origin=location_of_headers_in_excel_2.out1, extent=location_of_headers_in_excel_2.out2)
flatten_20 = List.Flatten(list=read_excel_22)
firstIndexOf_39 = List.FirstIndexOf(list=flatten_20, item=code_block_27.out0)
getItemAtIndex_41 = List.GetItemAtIndex(list=read_excel_5, index=firstIndexOf_39)
firstIndexOf_40 = List.FirstIndexOf(list=getItemAtIndex_8, item=filterByBoolMask_3.in)
# note: Break Link to Disable write to Revit
getItemAtIndex_42 = List.GetItemAtIndex(list=getItemAtIndex_41, index=firstIndexOf_40)
setParameterByName_20 = Element.SetParameterByName(element=filterByBoolMask_2.in, parameterName=code_block_27.out1, value=getItemAtIndex_42)

# group: Imports and Assign Heat Loss from Excel to Revit
code_block_28 = CodeBlock { "Calculated Heat Loss"; "Space_Facade Heat Loss"; }
on_off_control_for_module_23 = BoolSelector(false)  # graph input
boolean_23 = BoolSelector(true)  # graph input
read_excel_23 = Custom[Read Excel](filePath=file_path, runIt=on_off_control_for_module_23, sheetName=location_of_headers_in_excel_2.out0, byColumn=boolean_23, origin=location_of_headers_in_excel_2.out1, extent=location_of_headers_in_excel_2.out2)
flatten_21 = List.Flatten(list=read_excel_23)
firstIndexOf_41 = List.FirstIndexOf(list=flatten_21, item=code_block_28.out0)
getItemAtIndex_43 = List.GetItemAtIndex(list=read_excel_5, index=firstIndexOf_41)
firstIndexOf_42 = List.FirstIndexOf(list=getItemAtIndex_8, item=filterByBoolMask_3.in)
# note: Break Link to Disable write to Revit
getItemAtIndex_44 = List.GetItemAtIndex(list=getItemAtIndex_43, index=firstIndexOf_42)
setParameterByName_21 = Element.SetParameterByName(element=filterByBoolMask_2.in, parameterName=code_block_28.out1, value=getItemAtIndex_44)

# group: Imports and Assign Space Infiltration Gain from Excel to Revit
code_block_29 = CodeBlock { "Infiltration Heat Loss"; "Space_Infiltration Heat Loss"; }
on_off_control_for_module_24 = BoolSelector(false)  # graph input
boolean_24 = BoolSelector(true)  # graph input
read_excel_24 = Custom[Read Excel](filePath=file_path, runIt=on_off_control_for_module_24, sheetName=location_of_headers_in_excel_2.out0, byColumn=boolean_24, origin=location_of_headers_in_excel_2.out1, extent=location_of_headers_in_excel_2.out2)
flatten_22 = List.Flatten(list=read_excel_24)
firstIndexOf_43 = List.FirstIndexOf(list=flatten_22, item=code_block_29.out0)
getItemAtIndex_45 = List.GetItemAtIndex(list=read_excel_5, index=firstIndexOf_43)
firstIndexOf_44 = List.FirstIndexOf(list=getItemAtIndex_8, item=filterByBoolMask_3.in)
# note: Break Link to Disable write to Revit
getItemAtIndex_46 = List.GetItemAtIndex(list=getItemAtIndex_45, index=firstIndexOf_44)
setParameterByName_22 = Element.SetParameterByName(element=filterByBoolMask_2.in, parameterName=code_block_29.out1, value=getItemAtIndex_46)
