# Dynamo graph DYN-MEC-DES-0010_HVACRevitExcelLink_0.1.0.dyn (Dynamo 2.0.0.4654)

# group: Set Desired Revit Parameters for export and required Column name within Excel (maintain order)
# note: Note: Element Id is added to the end automatically.
excel_column_names = CodeBlock()
# ---------- excel_column_names.designscript (5 lines) ----------
["Space Reference","Space Description","Space Floor Area",
"Space Volume","Level","Building","Design Space Type","Ventilation Strategy",
"Supply Air System Reference","Return Air System Reference",
"Exhaust Air System Reference","Space Occupancy",
"Space External", "Element Id"];
# ----------------------------------------
revit_parameter_names = CodeBlock()
# ---------- revit_parameter_names.designscript (4 lines) ----------
["Number","Name","Area","Volume","Level","General_Location","Space_Type",
"Space_Mechanical_Ventilation_Type","Space_M_Supply_System",
"Space_M_Return_System","Space_M_Exhaust_System",
"Space_Occupancy_HVAC_Normal","Space_External"];
# ----------------------------------------

# group: Collects all Spaces on assigned level
categories = Categories(index=447)  # graph input
all_elements_of_category = ElementsOfCategory(Category=categories)
code_block = CodeBlock { "Level"; }
getParameterValueByName = Element.GetParameterValueByName(element=all_elements_of_category, parameterName=code_block)
# note: Enter desired level here
# Alternatively, leave blank for all levels
level = CodeBlock { ""; }
contains = String.Contains(str=getParameterValueByName, searchFor=level)
filterByBoolMask = List.FilterByBoolMask(list=all_elements_of_category, mask=contains)

# group: Collects all vaules of desired Parameters for spaces in entire project.
getParameterValueByName_2 = Element.GetParameterValueByName(parameterName=revit_parameter_names)  # unwired: element
map = List.Map(list=filterByBoolMask.in, f_x=getParameterValueByName_2)

# group: Add Element Id To end of list.
code_block_2 = CodeBlock(i=filterByBoolMask.in) { i.Id; }
addItemToEnd = List.AddItemToEnd(item=code_block_2, list=map, lacing=Longest)

# group (continued): Collects all vaules of desired Parameters for spaces in entire project.
addItemToFront = List.AddItemToFront(item=excel_column_names, list=addItemToEnd)

# group: Writes to HVAC Design File. Suggest location is an input tab.
file_path = Filename("..\..\..\..\..\Documents\Example HVAC Design File.xlsx")
excel_tab_and_row_column = CodeBlock { "Space Geometry"; 10; 0; }  # "Excel Tab and Row/Column reference for data write"
exportExcel = Data.ExportExcel(filePath=file_path, sheetName=excel_tab_and_row_column.out0, startRow=excel_tab_and_row_column.out1, startCol=excel_tab_and_row_column.out2, data=addItemToFront)
