# Dynamo graph DYN-MEC-DES-0010_Space Name to Family_0.1.0.dyn (Dynamo 2.0.0.4654)

# group: Collects all Air Terminals, Mech Equipment and Spaces
categories = Categories(index=5)  # graph input
all_elements_of_category = ElementsOfCategory(Category=categories)
categories_2 = Categories(index=447)  # graph input
all_elements_of_category_2 = ElementsOfCategory(Category=categories_2)
categories_3 = Categories(index=294)  # graph input
all_elements_of_category_3 = ElementsOfCategory(Category=categories_3)

# group: Looks for all air termainals located in each space. List Map counts the number of air terminals in each space
elements_in_space = Custom[Elements in Space](Element=all_elements_of_category, Space=all_elements_of_category_2)  # This node will take an input of Spaces and Elements and attempt to group all elements by Room that it is located in. For elements that are placed by Line and not a Point, a mid point of line will be used to determine location.
flatten = List.Flatten(list=elements_in_space)
count = List.Count()  # unwired: list
map = List.Map(list=elements_in_space, f_x=count)

# group: Combines the Space name and numbe into a single string
active_level = CodeBlock { "Name"; "Number"; }
getParameterValueByName = Element.GetParameterValueByName(element=all_elements_of_category_2, parameterName=active_level.out0)
getParameterValueByName_2 = Element.GetParameterValueByName(element=all_elements_of_category_2, parameterName=active_level.out1)
code_block = CodeBlock(a=getParameterValueByName, b=getParameterValueByName_2) { a+"-"+b; }

# group: Maps space name to the found air terminal and assigns to the location parameter
code_block_2 = CodeBlock { "Location"; }
ofRepeatedItem = List.OfRepeatedItem(item=code_block, amount=map, lacing=Longest)
flatten_2 = List.Flatten(list=ofRepeatedItem)
setParameterByName = Element.SetParameterByName(element=flatten, parameterName=code_block_2, value=flatten_2)

# group: Looks for all air termainals located in each space. List Map counts the number of air terminals in each space
elements_in_space_2 = Custom[Elements in Space](Element=all_elements_of_category_3, Space=all_elements_of_category_2)
flatten_3 = List.Flatten(list=elements_in_space_2)
count_2 = List.Count()  # unwired: list
map_2 = List.Map(list=elements_in_space_2, f_x=count_2)

# group: Maps space name to the found air terminal and assigns to the location parameter
code_block_3 = CodeBlock { "Location"; }
ofRepeatedItem_2 = List.OfRepeatedItem(item=code_block, amount=map_2, lacing=Longest)
flatten_4 = List.Flatten(list=ofRepeatedItem_2)
setParameterByName_2 = Element.SetParameterByName(element=flatten_3, parameterName=code_block_3, value=flatten_4)
