# Dynamo graph LunchBoxML Testing.dyn (Dynamo 2.0.0.4654)

string = StringInput("Bath")  # graph input
string_2 = StringInput("Bedroom")  # graph input
string_3 = StringInput("Living")  # graph input
create = List.Create(item0=string, item1=string_2, item2=string_3)
string_4 = StringInput("Rooms")  # graph input
string_5 = StringInput("ID")  # graph input
string_6 = StringInput("Name")  # graph input
string_7 = StringInput("Department")  # graph input
create_2 = List.Create(item0=string_5, item1=string_6, item2=string_7)
# note: Naive Bayes Classifier
# note: Copyright (c) Proving Ground LLC 2017
boolean = BoolSelector(true)  # graph input
lunchbox_room_element_collector = Custom[LunchBox Room Element Collector](Toggle=boolean)  # Collects rooms from the Revit document
string_8 = StringInput("Department")  # graph input
getParameterValueByName = Element.GetParameterValueByName(element=lunchbox_room_element_collector.Element, parameterName=string_8)
create_3 = List.Create(item0=lunchbox_room_element_collector.Element_ID, item1=lunchbox_room_element_collector.Name, item2=getParameterValueByName)
transpose = List.Transpose(lists=create_3)
createDataTable = Lists.DataSets.CreateDataTable(Name=string_4, Headers=create_2, Data=transpose)
string_9 = StringInput("Name")  # graph input
string_10 = StringInput("Department")  # graph input
number = DoubleInput(5)  # graph input
naiveBayesClassifier = MachineLearning.Classification.NaiveBayesClassifier(TrainingData=createDataTable, InputColumnNames=string_9, OutputColumnName=string_10, seed=number)  # unwired: TestInputs
map = List.Map(list=create, f_x=naiveBayesClassifier.Result)

# group: Load .csv File
file_path = Filename("..\Data\Output\graphData.csv")
boolean_2 = BoolSelector(false)
importCSV = Data.ImportCSV(filePath=file_path, transpose=boolean_2)

# group: Sort CSV data into a data set for ML
code_block = CodeBlock { 0; 1; }
getItemAtIndex = List.GetItemAtIndex(list=importCSV, index=code_block.out0)
code_block_2 = CodeBlock { "Nodes"; }
getItemAtIndex_2 = List.GetItemAtIndex(list=getItemAtIndex, index=code_block.out0)
getItemAtIndex_3 = List.GetItemAtIndex(list=importCSV, index=code_block.out1)
getItemAtIndex_4 = List.GetItemAtIndex(list=getItemAtIndex_3, index=code_block.out0)
list_create = List.Create(item0=getItemAtIndex_2, item1=getItemAtIndex_4)
list_create_2 = List.Create(item0=getItemAtIndex, item1=getItemAtIndex_3)
transpose_2 = List.Transpose(lists=list_create_2)
code_block_3 = CodeBlock { 1; }
dropItems = List.DropItems(list=transpose_2, amount=code_block_3)
createDataTable_2 = Lists.DataSets.CreateDataTable(Name=code_block_2, Headers=list_create, Data=dropItems)

# group: Set test input from possible start nodes
code_block_4 = CodeBlock { 1; }
dropItems_2 = List.DropItems(list=getItemAtIndex, amount=code_block_4)
uniqueItems = List.UniqueItems(list=dropItems_2)
integer_slider = IntegerSlider(0, range=0..75 step 1)
getItemAtIndex_5 = List.GetItemAtIndex(list=uniqueItems, index=integer_slider)
watch = Watch(getItemAtIndex_5)

# group: LunchBoxML
string_11 = StringInput("Node A Name")  # graph input
string_12 = StringInput("Node B Name")  # graph input
number_2 = DoubleInput(5)  # graph input
naiveBayesClassifier_2 = MachineLearning.Classification.NaiveBayesClassifier(TestInputs=getItemAtIndex_5, TrainingData=createDataTable_2, InputColumnNames=string_11, OutputColumnName=string_12, seed=number_2)

# group: Results
watch_2 = Watch(naiveBayesClassifier_2.Numeric)
watch_3 = Watch(naiveBayesClassifier_2.Result)  # graph output
watch_4 = Watch(naiveBayesClassifier_2.Probabilities)

code_block_5 = CodeBlock { 1; 42; 5; }
hiddenMarkovModel = MachineLearning.Models.HiddenMarkovModel(TrainingInputs=dropItems, Generations=code_block_5.out0, seed=code_block_5.out1, states=code_block_5.out2)
watch_5 = Watch(hiddenMarkovModel)  # graph output
