# Dynamo graph MPA_Title Block_Key Plan Control.dyn (Dynamo 2.0.0.4654)

# group: Enter Title Block used Name
title_block_name = CodeBlock { "2017_MPA_TITLE_BLOCK_36x48-Arup"; }

# group: Collects all Title Blocks and passes the Elements and Sheet Name
categories = Categories(index=557)
all_elements_of_category = ElementsOfCategory(Category=categories)
name = FamilyType.Name(familyType=all_elements_of_category)
startsWith = String.StartsWith(str=name, searchFor=title_block_name)
filterByBoolMask = List.FilterByBoolMask(list=all_elements_of_category, mask=startsWith)
code_block = CodeBlock { "Sheet Name"; }
parameterByName = Parameter.ParameterByName(element=filterByBoolMask.in, name=code_block)
string_from_object = FromObject(obj=parameterByName)

zone_criteria = CodeBlock { "Zone A"; "Zone B"; "Zone C"; "Zone D"; "Zone E"; "Zone F"; "Zone G"; "Zone H"; "Zone I"; "Zone J"; }

# group: Assigns Zone A to the Title Block
boolean = BoolSelector(true)
contains = String.Contains(str=string_from_object, searchFor=zone_criteria.out0, ignoreCase=boolean)
filterByBoolMask_2 = List.FilterByBoolMask(list=filterByBoolMask.in, mask=contains)
code_block_2 = CodeBlock { "Key Plan Zone"; }
code_block_3 = CodeBlock { 1; }
setParameterByName = Element.SetParameterByName(element=filterByBoolMask_2.in, parameterName=code_block_2, value=code_block_3)

# group: Assigns Zone B to the Title Block
boolean_2 = BoolSelector(true)
contains_2 = String.Contains(str=string_from_object, searchFor=zone_criteria.out1, ignoreCase=boolean_2)
filterByBoolMask_3 = List.FilterByBoolMask(list=filterByBoolMask.in, mask=contains_2)
code_block_4 = CodeBlock { "Key Plan Zone"; }
code_block_5 = CodeBlock { 2; }
setParameterByName_2 = Element.SetParameterByName(element=filterByBoolMask_3.in, parameterName=code_block_4, value=code_block_5)

# group: Assigns Zone C to the Title Block
boolean_3 = BoolSelector(true)
contains_3 = String.Contains(str=string_from_object, searchFor=zone_criteria.out2, ignoreCase=boolean_3)
filterByBoolMask_4 = List.FilterByBoolMask(list=filterByBoolMask.in, mask=contains_3)
code_block_6 = CodeBlock { "Key Plan Zone"; }
code_block_7 = CodeBlock { 3; }
setParameterByName_3 = Element.SetParameterByName(element=filterByBoolMask_4.in, parameterName=code_block_6, value=code_block_7)

# group: Assigns Zone D to the Title Block
boolean_4 = BoolSelector(true)
contains_4 = String.Contains(str=string_from_object, searchFor=zone_criteria.out3, ignoreCase=boolean_4)
filterByBoolMask_5 = List.FilterByBoolMask(list=filterByBoolMask.in, mask=contains_4)
code_block_8 = CodeBlock { "Key Plan Zone"; }
code_block_9 = CodeBlock { 4; }
setParameterByName_4 = Element.SetParameterByName(element=filterByBoolMask_5.in, parameterName=code_block_8, value=code_block_9)

# group: Assigns Zone E to the Title Block
boolean_5 = BoolSelector(true)
contains_5 = String.Contains(str=string_from_object, searchFor=zone_criteria.out4, ignoreCase=boolean_5)
filterByBoolMask_6 = List.FilterByBoolMask(list=filterByBoolMask.in, mask=contains_5)
code_block_10 = CodeBlock { "Key Plan Zone"; }
code_block_11 = CodeBlock { 5; }
setParameterByName_5 = Element.SetParameterByName(element=filterByBoolMask_6.in, parameterName=code_block_10, value=code_block_11)

# group: Assigns Zone F to the Title Block
boolean_6 = BoolSelector(true)
contains_6 = String.Contains(str=string_from_object, searchFor=zone_criteria.out5, ignoreCase=boolean_6)
filterByBoolMask_7 = List.FilterByBoolMask(list=filterByBoolMask.in, mask=contains_6)
code_block_12 = CodeBlock { "Key Plan Zone"; }
code_block_13 = CodeBlock { 6; }
setParameterByName_6 = Element.SetParameterByName(element=filterByBoolMask_7.in, parameterName=code_block_12, value=code_block_13)

# group: Assigns Zone G to the Title Block
boolean_7 = BoolSelector(true)
contains_7 = String.Contains(str=string_from_object, searchFor=zone_criteria.out6, ignoreCase=boolean_7)
filterByBoolMask_8 = List.FilterByBoolMask(list=filterByBoolMask.in, mask=contains_7)
code_block_14 = CodeBlock { "Key Plan Zone"; }
code_block_15 = CodeBlock { 7; }
setParameterByName_7 = Element.SetParameterByName(element=filterByBoolMask_8.in, parameterName=code_block_14, value=code_block_15)

# group: Assigns Zone H to the Title Block
boolean_8 = BoolSelector(true)
contains_8 = String.Contains(str=string_from_object, searchFor=zone_criteria.out7, ignoreCase=boolean_8)
filterByBoolMask_9 = List.FilterByBoolMask(list=filterByBoolMask.in, mask=contains_8)
code_block_16 = CodeBlock { "Key Plan Zone"; }
code_block_17 = CodeBlock { 8; }
setParameterByName_8 = Element.SetParameterByName(element=filterByBoolMask_9.in, parameterName=code_block_16, value=code_block_17)

# group: Assigns Zone I to the Title Block
boolean_9 = BoolSelector(true)
contains_9 = String.Contains(str=string_from_object, searchFor=zone_criteria.out8, ignoreCase=boolean_9)
filterByBoolMask_10 = List.FilterByBoolMask(list=filterByBoolMask.in, mask=contains_9)
code_block_18 = CodeBlock { "Key Plan Zone"; }
code_block_19 = CodeBlock { 9; }
setParameterByName_9 = Element.SetParameterByName(element=filterByBoolMask_10.in, parameterName=code_block_18, value=code_block_19)

# group: Assigns Zone J to the Title Block
boolean_10 = BoolSelector(true)
contains_10 = String.Contains(str=string_from_object, searchFor=zone_criteria.out9, ignoreCase=boolean_10)
filterByBoolMask_11 = List.FilterByBoolMask(list=filterByBoolMask.in, mask=contains_10)
code_block_20 = CodeBlock { "Key Plan Zone"; }
code_block_21 = CodeBlock { 10; }
setParameterByName_10 = Element.SetParameterByName(element=filterByBoolMask_11.in, parameterName=code_block_20, value=code_block_21)

reference = CodeBlock()
# ---------- reference.designscript (13 lines) ----------
/*
NOTES

Assigns Key Plan Zone based on Sheet
Name

WRITTEN BY		-	Patrick Pease
DYNAMO VERSION	-	2.0
PACKAGES		-	None
REVIT TEMPLATE	-	N/A
LAST UPDATED	-	17-07-2018

*/;
# ----------------------------------------
