# Dynamo graph Room Type Assignment based Name.dyn (Dynamo 2.0.0.4654)

# group: Set Desired Revit Parameters for export and required Parameter name within Excel (maintain order)
excel_parameter_names = CodeBlock()
# ---------- excel_parameter_names.designscript (2 lines) ----------
["Space Reference","Space Description","IES Link Name","Space Floor Area",
"Space Volume","Level","VRF System","Element Id"];
# ----------------------------------------
revit_parameter_names = CodeBlock { ["Number","Name","IES Link Name","Area","Volume","Level","VRF Zone"]; }

# group: Collects all Spaces on assigned level
categories = Categories(index=447)  # graph input
# note: Selects by level, or simply all spaces
all_elements_of_category = ElementsOfCategory(Category=categories)

# group: Collects all vaules for desired Parameters for spaces in entire project.
getParameterValueByName = Element.GetParameterValueByName(parameterName=revit_parameter_names)  # unwired: element
map = List.Map(list=all_elements_of_category, f_x=getParameterValueByName)

# group: Add Element Id To end of list.
code_block = CodeBlock(i=all_elements_of_category) { i.Id; }
addItemToEnd = List.AddItemToEnd(item=code_block, list=map, lacing=Longest)

# group (continued): Collects all vaules for desired Parameters for spaces in entire project.
addItemToFront = List.AddItemToFront(item=excel_parameter_names, list=addItemToEnd)

# group: Writes to Record Copy area of HVAC Design Spreadsheet
file_path = Filename("..\..\4-04 Calculations\4-04-06 Mech\CC5 HVAC Design File.xlsx")
code_block_2 = CodeBlock { "Space Geometry"; 8; 0; }
exportExcel = Data.ExportExcel(filePath=file_path, sheetName=code_block_2.out0, startRow=code_block_2.out1, startCol=code_block_2.out2, data=addItemToFront)

# group: Collects all Spaces on assigned level
categories_2 = Categories(index=447)  # graph input
all_elements_of_category_2 = ElementsOfCategory(Category=categories_2)
code_block_3 = CodeBlock { "Level"; }
getParameterValueByName_2 = Element.GetParameterValueByName(element=all_elements_of_category_2, parameterName=code_block_3)
# note: Enter Desired Level Here
# Blank results in all levels
level = CodeBlock { "B02"; }
contains = String.Contains(str=getParameterValueByName_2, searchFor=level)
filterByBoolMask = List.FilterByBoolMask(list=all_elements_of_category_2, mask=contains)
