# Dynamo graph Test Graph_PP_02.dyn (Dynamo 2.0.0.4654)

byCoordinates = Point.ByCoordinates()
byCoordinates_2 = Point.ByCoordinates()
byStartPointEndPoint = Line.ByStartPointEndPoint(startPoint=byCoordinates, endPoint=byCoordinates_2)
