# Dynamo graph agpl.dyn (Dynamo 2.1.0.6544)

file_path = Filename(".\DynamoOutput1.xlsx")  # graph input
string = StringInput("Sheet1")  # graph input
number = DoubleInput(1)  # graph input
select_model_elements = DSModelElementsSelection()  # nothing selected; graph input
string_2 = StringInput("Line Segment Name")  # graph input
getParameterValueByName = Element.GetParameterValueByName(element=select_model_elements, parameterName=string_2)
watch = Watch(getParameterValueByName)
string_3 = StringInput("Length")  # graph input
getParameterValueByName_2 = Element.GetParameterValueByName(element=select_model_elements, parameterName=string_3)
watch_2 = Watch(getParameterValueByName_2)
string_4 = StringInput("Spot Elevation 1")  # graph input
getParameterValueByName_3 = Element.GetParameterValueByName(element=select_model_elements, parameterName=string_4)
watch_3 = Watch(getParameterValueByName_3)
string_5 = StringInput("Spot Elevation 2")  # graph input
getParameterValueByName_4 = Element.GetParameterValueByName(element=select_model_elements, parameterName=string_5)
watch_4 = Watch(getParameterValueByName_4)
string_6 = StringInput("Weighted Total")  # graph input
getParameterValueByName_5 = Element.GetParameterValueByName(element=select_model_elements, parameterName=string_6)
watch_5 = Watch(getParameterValueByName_5)
create = List.Create(item0=watch_5)
getValues = GetValues(list=create)
sum = Math.Sum(values=getValues)
create_2 = List.Create(item0=watch_2)
getValues_2 = GetValues(list=create_2)
sum_2 = Math.Sum(values=getValues_2)
div = sum / sum_2
create_3 = List.Create(item0=watch, item1=watch_2, item2=watch_3, item3=watch_4, item4=watch_5, item5=div)
transpose = List.Transpose(lists=create_3)
boolean = BoolSelector(true)  # graph input
exportExcel = Data.ExportExcel(filePath=file_path, sheetName=string, startRow=number, startCol=number, data=transpose, overWrite=boolean)
string_7 = StringInput("Spot Elevation 1")  # graph input
fromPath = FileObject()  # "File.FromPath"; unwired: path
boolean_2 = BoolSelector(false)  # graph input
importExcel = Data.ImportExcel(file=fromPath, sheetName=string, readAsStrings=boolean_2)
transpose_2 = List.Transpose(lists=importExcel)
number_2 = DoubleInput(2)  # graph input
getItemAtIndex = List.GetItemAtIndex(list=transpose_2, index=number_2)
setParameterByName = Element.SetParameterByName(parameterName=string_7, value=getItemAtIndex)  # unwired: element
string_8 = StringInput("Spot Elevation 2")  # graph input
number_3 = DoubleInput(3)  # graph input
getItemAtIndex_2 = List.GetItemAtIndex(list=transpose_2, index=number_3)
setParameterByName_2 = Element.SetParameterByName(parameterName=string_8, value=getItemAtIndex_2)  # unwired: element
