# Dynamo graph detailnum.dyn (Dynamo 2.1.0.6544)

# group: DOC - WIP
# note: ________________________________________________________
# note: USES: IN PROGRESS, FROZEN, BROKEN

# group: DOC - ANNOTATION
# note: ________________________________________________________
# note: USES: ANNOTATIONS, EXPLANATION

# group: DOC - WATCH
# note: ________________________________________________________
# note: USES: HIGHLIGHT, WATCH

# group: WRITE DATA - STEP
# note: ________________________________________________________
# note: USES: TEMPORARY/SECONDARY MODEL GEOM.

# group: WRITE DATA - REVIT
# note: ________________________________________________________
# note: USES: OUTPUTS, MODEL CHANGES

# group: LOGIC - AUXILLARY
# note: ________________________________________________________
# note: USES: SECONDARY LOGIC

# group: LOGIC - SECONDARY
# note: ________________________________________________________
# note: USES: LOGIC, DECISION-MAKING, COMPUTATION

# group: LOGIC - PRIMARY
# note: ________________________________________________________
# note: USES: LOGIC, DECISION-MAKING, COMPUTATION

# group: INPUT - PARSE/MOD
# note: ________________________________________________________
# note: USES: TRANSLATING INPUTS FOR DYNAMO

# group: INPUT - FIXED
# note: ________________________________________________________
# note: USES: FIXED INPUTS, STATIC INPUTS

# group: INPUT - CONTROL
# note: ________________________________________________________
# note: USES: INPUT, UI INPUT, DATA IN

# group: COLLECT CURRENT SHEET AND VIEWS
get_revit_activeview = Custom[Get Revit ActiveView]()  # Active View
# note: Viewports on the are collected from the active sheet.
watch = Watch(get_revit_activeview)

# group: CREATE BOUNDING BOXES
byElement = Custom[BoundingBox.ByElement](view=get_revit_activeview)  # Gets the bounding box of a Revit element; unwired: element
# note: Bounding box is created in the Revit sheet environment based on the geometry of the viewports.
watch_2 = Watch(byElement.DynamoBoundingBox)
byOriginNormal = Plane.ByOriginNormal()
# note: The bounding boxes outlines are projected onto a plane at 0,0,0. This is because the default-created bounding boxes are, counterintuitively, three dimensional entities, within a two dimensional drawing environment.
perimeterCurvesOnPlane = Custom[BoundingBox.PerimeterCurvesOnPlane](boundingbox=watch_2, plane=byOriginNormal)  # Returns the perimeter curve of a bounding box on a given plane (assuming that the bounding box and plane intersect)
# note: New bounding boxes are created from the new normalized geometry.
# note: Lists are cleaned of null values. Bugs have been encountered with bounding box logic on the Dell Laptop workstations. This is a temporary workaround.
byGeometry = BoundingBox.ByGeometry()  # unwired: geom
flatten = List.Flatten(list=byGeometry)

# group: USER INPUT
# note: Select the spline on your sheet which will determine the order in which your views will be runmbered.
select_model_element = DSModelElementSelection()  # nothing selected; graph input
# note: Specify at what number you'd like the renumbering to begin, and by what increment you would like each viewport along the line of the spline to be renumbered.
renumbering_start = DoubleInput(1)  # graph input
renumber_by_increments_of = DoubleInput(1)  # graph input

# group: LOGIC - SPLINE SUBDIVISION
curve = CurveElement.Curve(curveElement=select_model_element)
integer_slider = IntegerSlider(800, range=0..800 step 1)  # graph input
# note: This subdivides the input spline into points which will be tested against the bounding boxes of the viewports to determine whether or not views fall within the path of the line.
pointsAtEqualSegmentLength = Curve.PointsAtEqualSegmentLength(curve=curve, divisions=integer_slider)

# group: LOGIC - LIST MAPPING AUX
contains = BoundingBox.Contains(boundingBox=flatten)  # unwired: point
watch_3 = Watch()  # unwired: arg0
filterByBoolMask = List.FilterByBoolMask(list=watch_3)  # unwired: mask

# group: LOGIC - BOUNDING BOX DETERMINANT
flatten_2 = List.Flatten(list=pointsAtEqualSegmentLength)
# note: Spline subdivided points are checked against the created, normalized bounding boxes.
map = List.Map(list=flatten_2, f_x=contains)
# note: Filter mapped list of boolean determinants based on Viewports which are on the sheet.
map_2 = List.Map(list=map, f_x=filterByBoolMask.in)
flatten_3 = List.Flatten(list=map_2)
# note: List the unique viewports which are intersected by the input spline.
uniqueItems = List.UniqueItems(list=flatten_3)
watch_to_reorder = Watch(uniqueItems)

# group: CHANGE DETAIL NUMBERS ON SHEETS
string = StringInput("VIEWPORT_DETAIL_NUMBER")  # graph input
# note: Count the amount of views that we have to renumber.
count = List.Count(list=watch_to_reorder)
# note: Parse the sequence info from the user input, and combine with the amount of views that have to be renumbered.
sequence = Sequence(start=renumbering_start, amount=count, step=renumber_by_increments_of, lacing=Longest)
string_from_object = FromObject(obj=sequence)
# note: Set the parameter of the Viewport Detail Number to be the new, renumbered sequence.
set_builtin_parameter = Custom[Set BuiltIn Parameter](ParameterName=string, Elements=watch_to_reorder, ParameterValues=string_from_object)  # This node will take an input of a built in parameter name and set that parameter to given value for given elements.

# group: SET TEMPORARY DETAIL NUMBERS
string_2 = StringInput("VIEWPORT_DETAIL_NUMBER")  # graph input
get_built_in_parameter = Custom[Get Built In Parameter](ParameterNames=string_2)  # This node will take an input of a built in parameter name and element to return that parameters value.; unwired: Elements
code_block = CodeBlock { "x"; }
# note: Temporary view numbers are added, because Revit does not allow duplicate detail numbers on the same sheet.
code_block_2 = CodeBlock(a=get_built_in_parameter, b=code_block) { a+b; }
set_builtin_parameter_2 = Custom[Set BuiltIn Parameter](ParameterName=string_2, ParameterValues=code_block_2)  # unwired: Elements

# group: WATCH - RENUMBERED
# note: This will show you the Viewport Detail Numbers which the script has pushed into the Revit sheet. Watch this to make sure that the sequence is correct.
watch_4 = Watch(sequence)

# group: README
# note: KieranTimberlake
# Script: Drawing Renumbering on Sheet Per Spline
# Author: Petar Mitev
# Dynamo Version: 1.31
# August, 2017
# Script Inputs
# 1. Spline to determine the order of views to be renumbered.
# 2. Sequence start.
# 3. Sequence increment.
# Script Function & Output
# 1. The script will renumber views/details on a Revit sheet in the order that an annotative spline is drawn on them, and in the sequence that the user specifies.
# Dependencies: Clockwork, Archi-Lab, Springs, Rhythm
# Dynamo Player Ready: No
# Dyno Ready: No
date_time = DateTime("2017-08-02T10:07:00Z")  # graph input
