# Dynamo graph example 001.dyn (Dynamo 2.0.0.4654)

# group: Select all Air Terminals in the project
categories = Categories(index=5)  # graph input
all_elements_of_category = ElementsOfCategory(Category=categories)
python_script = Python(IN[0]=all_elements_of_category)
# ---------- python_script.python (52 lines) ----------
import clr

clr.AddReference('ProtoGeometry')
from Autodesk.DesignScript.Geometry import *

# Import RevitAPI
clr.AddReference("RevitAPI")
import Autodesk
from Autodesk.Revit.DB import *

# Import DocumentManager and TransactionManager
clr.AddReference("RevitServices")
import RevitServices
from RevitServices.Persistence import DocumentManager
from RevitServices.Transactions import TransactionManager

# Import ToDSType(bool) extension method
clr.AddReference("RevitNodes")
import Revit
clr.ImportExtensions(Revit.Elements)
clr.ImportExtensions(Revit.GeometryConversion)

#Revit Doc Reference
doc =  DocumentManager.Instance.CurrentDBDocument



#The inputs to this node will be stored as a list in the IN variables.
aTs = UnwrapElement(IN[0])

aTsS = []
aTsR = []
aTsE = []




for aT in aTs:
	if(aT.Parameter['System Classification'].AsString()=="Supply Air"):
		aTsS.Add(aT)
	if(aT.Parameter['System Classification'].AsString()=="Return Air"):
		aTsR.Add(aT)
	if(aT.Parameter['System Classification'].AsString()=="Exhaust Air"):
		aTsE.Add(aT)
		
output = []
output.append(aTsS)
output.append(aTsR)
output.append(aTsE)

#Assign your output to the OUT variable.
OUT = output
# ----------------------------------------
code_block = CodeBlock(list=python_script) { Supply=list[0]; Return=list[1]; Exhaust=list[2]; }

# group: Supply Air Flow to Air Terminals from each Specified Supply Air Flow space parameter
string = StringInput("Air_Flow Rate")  # graph input
setParameterByName = Element.SetParameterByName(parameterName=string)  # unwired: element, value
space = Custom[Element.Space](element=code_block.Supply)  # This will retrieve the space in which an element is contained. (if available)
create = List.Create(item0=space, item1=code_block.Supply)
transpose = List.Transpose(lists=create)
removeNulls = Lists.Manage.RemoveNulls(Data=transpose)
code_block_2 = CodeBlock { 1; }
getItemAtIndex = List.GetItemAtIndex(index=code_block_2)  # unwired: list
map = List.Map(list=removeNulls.Cleaned, f_x=getItemAtIndex)
removeNulls_2 = Lists.Manage.RemoveNulls(Data=map)
removeNulls_3 = Lists.Manage.RemoveNulls(Data=space)
uniqueItems = List.UniqueItems(list=removeNulls_3.Cleaned)
code_block_3 = CodeBlock { "Specified Supply Airflow"; }
getParameterValueByName = Element.GetParameterValueByName(element=uniqueItems, parameterName=code_block_3, lacing=Longest)
identity = Object.Identity()  # unwired: obj
groupByFunction = List.GroupByFunction(list=removeNulls_3.Cleaned, func=identity)
count = List.Count(list=groupByFunction, lacing=Longest)
code_block_4 = CodeBlock(SpaceSpecifiedAirflow=getParameterValueByName, AirTerminalsperSpace=count) { Ave=SpaceSpecifiedAirflow/AirTerminalsperSpace; }
firstIndexOf = List.FirstIndexOf(list=code_block.Supply, item=removeNulls_2.Cleaned)
getItemAtIndex_2 = List.GetItemAtIndex(list=space, index=firstIndexOf)
firstIndexOf_2 = List.FirstIndexOf(list=uniqueItems, item=getItemAtIndex_2)
getItemAtIndex_3 = List.GetItemAtIndex(list=code_block_4, index=firstIndexOf_2)
laceLongest = List.LaceLongest(comb=setParameterByName, list1=removeNulls_2.Cleaned, list2=getItemAtIndex_3)

# group: Return Air Flow to Air Terminals from each Specified Return Air Flow space parameter
string_2 = StringInput("Air_Flow Rate")  # graph input
setParameterByName_2 = Element.SetParameterByName(parameterName=string_2)  # unwired: element, value
space_2 = Custom[Element.Space](element=code_block.Return)
create_2 = List.Create(item0=space_2, item1=code_block.Return)
transpose_2 = List.Transpose(lists=create_2)
removeNulls_4 = Lists.Manage.RemoveNulls(Data=transpose_2)
code_block_5 = CodeBlock { 1; }
getItemAtIndex_4 = List.GetItemAtIndex(index=code_block_5)  # unwired: list
map_2 = List.Map(list=removeNulls_4.Cleaned, f_x=getItemAtIndex_4)
removeNulls_5 = Lists.Manage.RemoveNulls(Data=map_2)
removeNulls_6 = Lists.Manage.RemoveNulls(Data=space_2)
uniqueItems_2 = List.UniqueItems(list=removeNulls_6.Cleaned)
code_block_6 = CodeBlock { "Specified Return Airflow"; }
getParameterValueByName_2 = Element.GetParameterValueByName(element=uniqueItems_2, parameterName=code_block_6, lacing=Longest)
identity_2 = Object.Identity()  # unwired: obj
groupByFunction_2 = List.GroupByFunction(list=removeNulls_6.Cleaned, func=identity_2)
count_2 = List.Count(list=groupByFunction_2, lacing=Longest)
code_block_7 = CodeBlock(SpaceSpecifiedAirflow=getParameterValueByName_2, AirTerminalsperSpace=count_2) { Ave=SpaceSpecifiedAirflow/AirTerminalsperSpace; }
firstIndexOf_3 = List.FirstIndexOf(list=code_block.Return, item=removeNulls_5.Cleaned)
getItemAtIndex_5 = List.GetItemAtIndex(list=space_2, index=firstIndexOf_3)
firstIndexOf_4 = List.FirstIndexOf(list=uniqueItems_2, item=getItemAtIndex_5)
getItemAtIndex_6 = List.GetItemAtIndex(list=code_block_7, index=firstIndexOf_4)
laceLongest_2 = List.LaceLongest(comb=setParameterByName_2, list1=removeNulls_5.Cleaned, list2=getItemAtIndex_6)

# group: Exhaust Air Flow to Air Terminals from each Specified Exhaust Air Flow space parameter
string_3 = StringInput("Air_Flow Rate")  # graph input
setParameterByName_3 = Element.SetParameterByName(parameterName=string_3)  # unwired: element, value
space_3 = Custom[Element.Space](element=code_block.Exhaust)
create_3 = List.Create(item0=space_3, item1=code_block.Exhaust)
transpose_3 = List.Transpose(lists=create_3)
removeNulls_7 = Lists.Manage.RemoveNulls(Data=transpose_3)
code_block_8 = CodeBlock { 1; }
getItemAtIndex_7 = List.GetItemAtIndex(index=code_block_8)  # unwired: list
map_3 = List.Map(list=removeNulls_7.Cleaned, f_x=getItemAtIndex_7)
removeNulls_8 = Lists.Manage.RemoveNulls(Data=map_3)
removeNulls_9 = Lists.Manage.RemoveNulls(Data=space_3)
uniqueItems_3 = List.UniqueItems(list=removeNulls_9.Cleaned)
code_block_9 = CodeBlock { "Specified Exhaust Airflow"; }
getParameterValueByName_3 = Element.GetParameterValueByName(element=uniqueItems_3, parameterName=code_block_9, lacing=Longest)
identity_3 = Object.Identity()  # unwired: obj
groupByFunction_3 = List.GroupByFunction(list=removeNulls_9.Cleaned, func=identity_3)
count_3 = List.Count(list=groupByFunction_3, lacing=Longest)
code_block_10 = CodeBlock(SpaceSpecifiedAirflow=getParameterValueByName_3, AirTerminalsperSpace=count_3) { Ave=SpaceSpecifiedAirflow/AirTerminalsperSpace; }
firstIndexOf_5 = List.FirstIndexOf(list=code_block.Exhaust, item=removeNulls_8.Cleaned)
getItemAtIndex_8 = List.GetItemAtIndex(list=space_3, index=firstIndexOf_5)
firstIndexOf_6 = List.FirstIndexOf(list=uniqueItems_3, item=getItemAtIndex_8)
getItemAtIndex_9 = List.GetItemAtIndex(list=code_block_10, index=firstIndexOf_6)
laceLongest_3 = List.LaceLongest(comb=setParameterByName_3, list1=removeNulls_8.Cleaned, list2=getItemAtIndex_9)
