# Dynamo graph example 002.dyn (Dynamo 2.0.0.4654)

activeView = Custom[Springs.Doc.ActiveView]()  # Selects the current document's active view. Supports more view types than the built-in option. Will be depreciated once the bult in node works with all plan types.
categories = Categories(index=245)  # graph input
boolean = BoolSelector(true)  # graph input
elementsInView = Custom[Springs.Collector.ElementsInView](view=activeView, category=categories, refresh=boolean)  # Selects all elements visible in the input view.
flatten = List.Flatten(list=elementsInView)
python_script = Python(IN[0]=flatten, IN[1]=activeView)
# ---------- python_script.python (24 lines) ----------
import clr
clr.AddReference('RevitAPI')
from Autodesk.Revit.DB import *
import Autodesk


clr.AddReference("RevitServices")
import RevitServices
from RevitServices.Persistence import DocumentManager
from RevitServices.Transactions import TransactionManager

doc = DocumentManager.Instance.CurrentDBDocument
uiapp = DocumentManager.Instance.CurrentUIApplication
app = uiapp.Application

a = UnwrapElement(IN[0])
v = UnwrapElement(IN[1])
TransactionManager.Instance.EnsureInTransaction(doc)
for i in a:
	i.HideBubbleInView(DatumEnds.End0,v)
	i.HideBubbleInView(DatumEnds.End1,v)
TransactionManager.Instance.TransactionTaskDone()

OUT = 0
# ----------------------------------------
