# Dynamo graph example 003.dyn (Dynamo 2.0.0.4654)

# group: Select the pipe type (material and fittings) by entering the index from the watch node below
element_types = ElementTypes(index=234)  # graph input
all_elements_of_type = ElementsOfType(element_type=element_types)
name = Element.Name(element=all_elements_of_type)
watch = Watch(name)
enter_index_number_of_required = CodeBlock { 3; }  # "Enter index number of required pipe type"
getItemAtIndex = List.GetItemAtIndex(list=all_elements_of_type, index=enter_index_number_of_required)

# group: Select the pipe system type by enetering the index from the watch node below
element_types_2 = ElementTypes(index=236)  # graph input
all_elements_of_type_2 = ElementsOfType(element_type=element_types_2)
name_2 = Element.Name(element=all_elements_of_type_2)
watch_2 = Watch(name_2)
enter_index_number_of_required_2 = CodeBlock { 36; }  # "Enter index number of required system type"
getItemAtIndex_2 = List.GetItemAtIndex(list=all_elements_of_type_2, index=enter_index_number_of_required_2)

# group: Select the Excel file and sheet of points data
file_path = Filename("..\07_XLS\Test%20Points.xlsx")
fromPath = FileObject(path=file_path)  # "File.FromPath"
code_block = CodeBlock { "SWPipe"; }
boolean = BoolSelector(false)  # graph input

# group: Reads data from file and discards first row (which are the headers)
importExcel = Data.ImportExcel(file=fromPath, sheetName=code_block, readAsStrings=boolean)
restOfItems = List.RestOfItems(list=importExcel)

# group: Flip the lists to be by X, Y and Z coordinates and conduit diameter
transpose = List.Transpose(lists=restOfItems)

# group: Extract the X, Y and Z dimensions separately and the diameter
code_block_2 = CodeBlock { 0; 1; 2; 3; }
getItemAtIndex_3 = List.GetItemAtIndex(list=transpose, index=code_block_2.out1)
getItemAtIndex_4 = List.GetItemAtIndex(list=transpose, index=code_block_2.out0)
getItemAtIndex_5 = List.GetItemAtIndex(list=transpose, index=code_block_2.out2)
getItemAtIndex_6 = List.GetItemAtIndex(list=transpose, index=code_block_2.out3)

# group: Select the Excel file and sheet of survey coordinates
file_path_2 = Filename("..\07_XLS\Test%20Points.xlsx")
fromPath_2 = FileObject(path=file_path_2)  # "File.FromPath"
code_block_3 = CodeBlock { "SiteCoordinates"; }
boolean_2 = BoolSelector(false)  # graph input

# group: Reads data from file, discards first row (which are the headers) and gets the northing and easting for the site so they can be subtracted from the pipe placement points
importExcel_2 = Data.ImportExcel(file=fromPath_2, sheetName=code_block_3, readAsStrings=boolean_2)
restOfItems_2 = List.RestOfItems(list=importExcel_2)
flatten = List.Flatten(list=restOfItems_2)
code_block_4 = CodeBlock { 0; 1; }
getItemAtIndex_7 = List.GetItemAtIndex(list=flatten, index=code_block_4.out1)
getItemAtIndex_8 = List.GetItemAtIndex(list=flatten, index=code_block_4.out0)

# group: Dynamo works to coordinates based on the project basepoint rather than the survey point (MGA). So the survey point distance is subtracted to get project coordinates for the points
sub = getItemAtIndex_3 - getItemAtIndex_7
sub_2 = getItemAtIndex_4 - getItemAtIndex_8

# group: Revit works in feet, so convert mm dimensions to feet
ft = Custom[Convert.mm.to.ft](Length_mm=sub)  # convert mm units to feet
ft_2 = Custom[Convert.mm.to.ft](Length_mm=sub_2)
ft_3 = Custom[Convert.mm.to.ft](Length_mm=getItemAtIndex_5)
ft_4 = Custom[Convert.mm.to.ft](Length_mm=getItemAtIndex_6)

# group: Create the start and end points for the conduits
byCoordinates = Point.ByCoordinates(x=ft, y=ft_2, z=ft_3)

# group: Remove last point from list (to get only start points)
reverse = List.Reverse(list=byCoordinates)
restOfItems_3 = List.RestOfItems(list=reverse)
reverse_2 = List.Reverse(list=restOfItems_3)

# group: Remove first point from list (to get only end points)
restOfItems_4 = List.RestOfItems(list=byCoordinates)

# group: Select the reference level
levels = Levels()  # nothing selected; graph input

# group: Output to Revit (create the pipes)
dyn_xxx_sub_0004_create_pipe = Custom[DYN_XXX_SUB_0004 Create Pipe from Points [0.0.01]](StartPoints=reverse_2, EndPoints=restOfItems_4, Level=levels, PipeType=getItemAtIndex, SystemType=getItemAtIndex_2, Diameter=ft_4)  # Create pipes given a level, pipe type, system type and series of start and end points

code_block_5 = CodeBlock()
# ---------- code_block_5.designscript (20 lines) ----------
/*
NOTES

This script takes a list of points
from an Excel file as input and will
then automatically place pipes between
each set of points

WRITTEN BY		-	Andrew Beazley
DYNAMO VERSION	-	1.2
PACKAGES		-	DYN_XXX_SUB_0004 Create Pipe from Points [0.0.01].dyf
				- 	DYN_XXX_SUB_0003 Convert mm to feet [0.0.01].dyf

REVIT TEMPLATE	-	AUS
LAST UPDATED	-	01-09-2017

FUTURE IMPROVEMENTS
- incorporate unit conversion within the
pipe placement custom node
*/;
# ----------------------------------------
