# Dynamo graph example 004.dyn (Dynamo 2.0.0.4654)

# group: Select Category and Model Line (Spline)
select_model_element = DSModelElementSelection()  # nothing selected; graph input
categories = Categories(index=294)  # graph input

# group: Select Elements in order that Spline intersects
select_elements_by_curve = Custom[Select Elements By Curve](modelCurve=select_model_element, category=categories)  # This will select model elements in order that a curve is drawn through them.
count = List.Count(list=select_elements_by_curve)
code_block = CodeBlock(a=count, b=count) { 1..a..#b; }
string_from_object = FromObject(obj=code_block)
watch = Watch(select_elements_by_curve)

# group: Set Prefix
code_block_2 = CodeBlock { 0; "FCU"; }

# group: Set Parameter Value
code_block_3 = CodeBlock { "Identity_Reference"; }
setParameterByName = Element.SetParameterByName(parameterName=code_block_3)  # unwired: element, value
insert = String.Insert(str=string_from_object, index=code_block_2.out0, toInsert=code_block_2.out1)
combine = List.Combine(comb=setParameterByName, list1=select_elements_by_curve, list2=insert)

boolean = BoolSelector(true)  # graph input
