# Dynamo graph example 005.dyn (Dynamo 2.0.0.4654)

# group: GUIDLINES
# note: Giovanni Brogiolo
# January 2017
# Dynamo 1.2.1
# PACKAGES
# Bimorph (rearranged a bit)
# note: Allows to select all the lines on a layer from an imported dwg. Those lines can be used to place structural framing and structural columns.

# group: SELECT IMPORTED DWG
select_model_element = DSModelElementSelection()  # nothing selected; graph input

# group: CAD LAYER NAMES FROM Bimorph PACKAGE
python_script = Python(IN[0]=select_model_element)
# ---------- python_script.python (22 lines) ----------
#Copyright 2016. All rights reserved. Bimorph Consultancy LTD, 5 St Johns Lane, London EC1M 4BH www.bimorph.co.uk
#Written by Thomas Mahon @Thomas__Mahon info@bimorph.co.uk package: bimorphNodes
#GitHub: https://github.com/ThomasMahon/bimorphNodes/

import clr

# Import RevitAPI
clr.AddReference("RevitAPI")
import Autodesk
from Autodesk.Revit.DB import *

dwgImport = UnwrapElement(IN[0])

catSub = dwgImport.Category.SubCategories
enum = catSub.GetEnumerator()

nameList = []
while enum.MoveNext():
	layerName = enum.Current.Name
	nameList.Add( layerName )
	
OUT  = nameList
# ----------------------------------------

# group: SELECT THE CAD LAYER(BEAMS)
# note: This codeblock is the same as List Get Item at Index. The number in the square bracket is the index to pick.
code_block = CodeBlock(a=python_script) { a[17]; }
getItemAtIndex = List.GetItemAtIndex()  # unwired: list, index

# group: CURVES FROM CAD LAYERS FROM Bimorph PACKAGE
boolean = BoolSelector(false)  # graph input
levels = Levels()  # nothing selected; graph input
python_script_2 = Python(IN[0]=select_model_element, IN[1]=code_block, IN[2]=boolean, IN[3]=levels)
# ---------- python_script_2.python (136 lines) ----------
#Copyright 2016. All rights reserved. Bimorph Consultancy LTD, 5 St Johns Lane, London EC1M 4BH www.bimorph.co.uk
#Written by Thomas Mahon @Thomas__Mahon info@bimorph.co.uk package: bimorphNodes
#GitHub: https://github.com/ThomasMahon/bimorphNodes/

import clr

# Import DocumentManager and TransactionManager
clr.AddReference("RevitServices")
import RevitServices
from RevitServices.Persistence import DocumentManager
from RevitServices.Transactions import TransactionManager
from System.Collections.Generic import *

clr.AddReference("RevitNodes")
import Revit
# Import ToProtoType, ToRevitType geometry conversion extension methods
clr.ImportExtensions(Revit.GeometryConversion)

# Import RevitAPI
clr.AddReference("RevitAPI")
import Autodesk
from Autodesk.Revit.DB import *

doc = DocumentManager.Instance.CurrentDBDocument
uiapp = DocumentManager.Instance.CurrentUIApplication
app = uiapp.Application

importDWG = UnwrapElement(IN[0])
nameOfLayersToImport = IN[1]
revitModelLines = IN[2]

if nameOfLayersToImport == None or nameOfLayersToImport == []: 
	catSub = importDWG.Category.SubCategories
	enum = catSub.GetEnumerator()
	
	nameOfLayersToImport = []
	while enum.MoveNext():
		layerName = enum.Current.Name
		nameOfLayersToImport.Add( layerName )

if isinstance(nameOfLayersToImport, list):
	layerList = nameOfLayersToImport
else:
	layerList = [nameOfLayersToImport]

def storageDictionary(crvListDict, eleGraphicStyleName, e):
	if eleGraphicStyleName in crvListDict.keys(): 
		crvListDict[eleGraphicStyleName].append( e )
	else:
		crvListDict[eleGraphicStyleName] = []
		crvListDict[eleGraphicStyleName].append( e )
		
	
def curveConversion (crv, revitModelLines, crvObject, refPlane):
	if revitModelLines == True:
		crv.Add( doc.Create.NewModelCurve( crvObject, refPlane) )
	else:
		crv.Add( crvObject.ToProtoType() )
	
TransactionManager.Instance.EnsureInTransaction(doc)

geomEnum = importDWG.Geometry[ Options() ].GetEnumerator()

crvListDict = dict()
failedFilter = []
while geomEnum.MoveNext(): 
	instGeom = geomEnum.Current.GetInstanceGeometry()
	
	instGeomEnum = instGeom.GetEnumerator()
	while instGeomEnum.MoveNext():
		e = instGeomEnum.Current
		try:
			graphicStyleId = e.GraphicsStyleId
					
			eleGraphicStyle = doc.GetElement(graphicStyleId)
			eleGraphicStyleName = eleGraphicStyle.GraphicsStyleCategory.Name
			
			
			if eleGraphicStyleName in layerList: 
				storageDictionary(crvListDict, eleGraphicStyleName, e)

		except:
			try: 
				vol = e.Volume
				
				if vol == 0.0: 
					edgesList = e.Edges
					edgesEnum = edgesList.GetEnumerator()

					while edgesEnum.MoveNext():
						edge = edgesEnum.Current
						eleGraphicStyle = doc.GetElement(edge.GraphicsStyleId)
						eleGraphicStyleName = eleGraphicStyle.GraphicsStyleCategory.Name
						
						if eleGraphicStyleName in layerList:
							storageDictionary(crvListDict, eleGraphicStyleName, edge.AsCurve() )
							
			except: 
				failedFilter.Add(e)

if "2015" in app.VersionName:
	levelParam = "Base Level"
else:
	levelParam = BuiltInParameter.IMPORT_BASE_LEVEL

levelId = UnwrapElement(IN[3]).Id

pln = SketchPlane.Create(doc, levelId )
	
crvList = [ crv for crv in crvListDict.values() ] 

failedConversion = []
modelLines =  []
for subList in crvList: 
	crv = []
	for i in subList: 
		try:
			crvType = i.GetType()
			if crvType != Autodesk.Revit.DB.PolyLine:
				curveConversion(crv, revitModelLines, i, pln)
			else: 
				pt = i.GetCoordinates()
				count = i.NumberOfCoordinates
					
				for j in range(count-1): 
					ln = Line.CreateBound(pt[j], pt[j+1])
					curveConversion(crv, revitModelLines, ln, pln)
						
		except: 
			failedConversion.Add( i )
				
	modelLines.Add(crv)

TransactionManager.Instance.TransactionTaskDone()

OUT = modelLines, crvListDict.keys()
# ----------------------------------------
code_block_2 = CodeBlock(a=python_script_2) { Flatten(a[0]); }

# group: TYPE THE BEAM SIZE
string = StringInput("305x127x42")  # graph input

# group: GET THE REVIT BEAMS
# note: Collects all the structural framing
# types in the Revit model
python_script_3 = Python()  # unwired: IN[0]
# ---------- python_script_3.python (22 lines) ----------
import clr
clr.AddReference('ProtoGeometry')
from Autodesk.DesignScript.Geometry import *

# Import RevitAPI
clr.AddReference("RevitAPI")
import Autodesk
from Autodesk.Revit.DB import *

# Import RevitAPI
clr.AddReference("RevitServices")
import RevitServices
from RevitServices.Persistence import DocumentManager

#The inputs to this node will be stored as a list in the IN variables.
doc = DocumentManager.Instance.CurrentDBDocument
cat = doc.Settings.Categories

collector = FilteredElementCollector(doc).OfCategory(BuiltInCategory.OST_StructuralFraming)

#Assign your output to the OUT variable.
OUT = [i for i in collector]
# ----------------------------------------
name = Family.Name(family=python_script_3)
bv_remove_nulls = Custom[bv Remove Nulls](List=name)  # forked from Lunchbox
code_block_3 = CodeBlock { 1; }
contains = String.Contains(str=bv_remove_nulls, searchFor=string, ignoreCase=code_block_3)
filterByBoolMask = List.FilterByBoolMask(list=python_script_3, mask=contains)

# group: CREATE STRUCTURAL FRAMING IN REVIT
beamByCurve = StructuralFraming.BeamByCurve(curve=code_block_2, level=levels, structuralFramingType=filterByBoolMask.in, lacing=Longest)

# group: SELECT THE CAD LAYER (COLUMNS)
code_block_4 = CodeBlock(a=python_script) { a[11]; }

# group: CURVES FROM CAD LAYERS FROM Bimorph PACKAGE
boolean_2 = BoolSelector(false)  # graph input
levels_2 = Levels()  # nothing selected; graph input
python_script_4 = Python(IN[0]=select_model_element, IN[1]=code_block_4, IN[2]=boolean_2, IN[3]=levels_2)  # same code as python_script_2
code_block_5 = CodeBlock(a=python_script_4) { Flatten(a[0]); }

# group: SELECT COLUMN SIZE
structural_column_types = StructuralColumnTypes()  # nothing selected; graph input

# group: CREATE STRUCTURAL COLUMNS IN REVIT
columnByCurve = StructuralFraming.ColumnByCurve(curve=code_block_5, level=levels_2, structuralColumnType=structural_column_types)
