# Dynamo graph example 006.dyn (Dynamo 2.0.0.4654)

categories = Categories(index=589)  # graph input
all_elements_of_category = ElementsOfCategory(Category=categories)
watch = Watch(all_elements_of_category)
parameters = Element.Parameters(element=all_elements_of_category)
geometry = Element.Geometry(element=all_elements_of_category)
XY = Plane.XY()
intersect = Geometry.Intersect(geometry=geometry, other=XY)
flatten = List.Flatten(list=intersect)
perimeterCurves = Surface.PerimeterCurves(surface=flatten)
length = Curve.Length(curve=perimeterCurves)
minimumItem = List.MinimumItem(list=length)
eq = _ == minimumItem  # unwired: x; lacing=CrossProduct
map = List.Map(list=length, f_x=eq)
filterByBoolMask = List.FilterByBoolMask(list=perimeterCurves, mask=map)
code_block = CodeBlock { 0.5; }
pointAtParameter = Curve.PointAtParameter(curve=filterByBoolMask.in, param=code_block)
transpose = List.Transpose(lists=pointAtParameter)
code_block_2 = CodeBlock(l=transpose) { l[0]; l[1]; }
byStartPointEndPoint = Line.ByStartPointEndPoint(startPoint=code_block_2.out0, endPoint=code_block_2.out1)
element_types = ElementTypes(index=168)  # graph input
all_elements_of_type = ElementsOfType(element_type=element_types)
code_block_3 = CodeBlock { 0..1; 1; }
sublists = List.Sublists(list=all_elements_of_type, ranges=code_block_3.out0, offset=code_block_3.out1)
restOfItems = List.RestOfItems(list=sublists)
code_block_4 = CodeBlock { -1; }
dropItems = List.DropItems(list=restOfItems, amount=code_block_4)
transpose_2 = List.Transpose(lists=dropItems)
code_block_5 = CodeBlock(w=transpose_2) { w[0]; w[1]; }
name = WallType.Name(wallType=all_elements_of_category)
byName = WallType.ByName(name=name)
byCurveAndLevels = Wall.ByCurveAndLevels(startLevel=code_block_5.out0, endLevel=code_block_5.out1, wallType=byName)  # unwired: c
map_2 = List.Map(list=byStartPointEndPoint, f_x=byCurveAndLevels)
code_block_6 = CodeBlock { "Top Constraint"; }
firstItem = List.FirstItem(list=sublists)
code_block_7 = CodeBlock(f=firstItem) { f[1]; }
setParameterByName = Element.SetParameterByName(element=all_elements_of_category, parameterName=code_block_6, value=code_block_7)
element_types_2 = ElementTypes(index=168)  # graph input
all_elements_of_type_2 = ElementsOfType(element_type=element_types_2)
elevation = Level.Elevation(level=all_elements_of_type_2)

# group: SELECT WALL
select_model_element = DSModelElementSelection()  # nothing selected; graph input

location = Custom[Element.Location](element=select_model_element)  # Returns the location of an element as an XYZ (or if it's line-based the start and end point of the line), along with some booleans to help filtering the results. Use this for some element types (e.g. walls or lines) that do not work with the built-in Get Family Instance Location node.

# group: SELECT FLOORS (WALL BASE FLOOR EXCLUDED)
select_model_elements = DSModelElementsSelection()  # nothing selected; graph input

geometry_2 = Element.Geometry(element=select_model_elements)
centroid = Solid.Centroid(solid=geometry_2)
code_block_8 = CodeBlock(a=centroid) { a.Z; }
code_block_9 = CodeBlock { "Thickness"; }
getParameterValueByName = Element.GetParameterValueByName(element=select_model_elements, parameterName=code_block_9)
code_block_10 = CodeBlock(a=code_block_8, b=getParameterValueByName) { a+b/2; }
flatten_2 = List.Flatten(list=code_block_10)
flatten_3 = List.Flatten(list=code_block_8)
sortByKey = List.SortByKey(list=flatten_2, keys=flatten_3)
watch_2 = Watch(sortByKey.sorted_list)
python_script = Python(IN[0]=location.curves, IN[1]=watch_2)
# ---------- python_script.python (25 lines) ----------
import clr
clr.AddReference('ProtoGeometry')
from Autodesk.DesignScript.Geometry import *
#The inputs to this node will be stored as a list in the IN variables.

lines = UnwrapElement(IN[0])

ptZ = UnwrapElement(IN[1])

StartPt= []

EndPt = []

newLn = []

for pt in lines:
	for zcoord in ptZ:
		StartPt.append(Point.ByCoordinates(pt.StartPoint.X,pt.StartPoint.Y,zcoord))
		EndPt.append(Point.ByCoordinates(pt.EndPoint.X,pt.EndPoint.Y,zcoord))

for i in range (0,len(StartPt)):
	newLn.append(Line.ByStartPointEndPoint(StartPt[i],EndPt[i]))

#Assign your output to the OUT variable.
OUT = newLn
# ----------------------------------------
python_script_2 = Python(IN[0]=watch_2)
# ---------- python_script_2.python (14 lines) ----------
import clr
clr.AddReference('ProtoGeometry')
from Autodesk.DesignScript.Geometry import *
#The inputs to this node will be stored as a list in the IN variables.

numbers = UnwrapElement(IN[0])
difference = []

for i in range (0,len(numbers)-1):
	difference.append(numbers[i+1]-numbers[i])


#Assign your output to the OUT variable.
OUT = difference
# ----------------------------------------
flatten_4 = List.Flatten(list=python_script_2)
code_block_11 = CodeBlock { 1; }
dropItems_2 = List.DropItems(list=all_elements_of_type_2, amount=code_block_11)
python_script_3 = Python(IN[0]=select_model_element)
# ---------- python_script_3.python (18 lines) ----------
import clr
clr.AddReference('RevitAPI')
from Autodesk.Revit.DB import *

items = UnwrapElement(IN[0])
typelist = list()


"""
for i in range (0,len(items)):
	try: 
		typelist.append(item[i].Document.GetElement(item[i].GetTypeId()))
	except:
		typelist.append(list())
"""


OUT = items.Document.GetElement(items.GetTypeId())
# ----------------------------------------
byCurveAndHeight = Wall.ByCurveAndHeight(curve=python_script, height=flatten_4, level=dropItems_2, wallType=python_script_3)
code_block_12 = CodeBlock { "Top Constraint"; }
code_block_13 = CodeBlock { 2; }
dropItems_3 = List.DropItems(list=all_elements_of_type_2, amount=code_block_13)
setParameterByName_2 = Element.SetParameterByName(element=byCurveAndHeight, parameterName=code_block_12, value=dropItems_3)
