# Dynamo graph facade.dyn (Dynamo 2.1.0.6544)

# group: PERCENT GLAZING TEST
boolean = BoolSelector(true)  # graph input
percentGlazingByOrientation = Custom[Rhythm.PercentGlazingByOrientation](RunMe=boolean)  # This node was show at RTCNA2015 to optimize your workflows. It reports the window to wall % by direction the wall faces.
watch = Watch(percentGlazingByOrientation.East)
watch_2 = Watch(percentGlazingByOrientation.North)
watch_3 = Watch(percentGlazingByOrientation.West)
watch_4 = Watch(percentGlazingByOrientation.South)

categories = Categories(index=142)  # graph input
all_elements_of_category = ElementsOfCategory(Category=categories)
watch_5 = Watch(all_elements_of_category)
asFamilyInstance = CurtainPanel.AsFamilyInstance(curtainPanel=all_elements_of_category)
watch_6 = Watch(asFamilyInstance)
transpose = List.Transpose(lists=watch_6)
watch_7 = Watch(transpose)
string = StringInput("Wood Panel")  # graph input
filterByString = Custom[List.FilterByString](list=watch_7, String=string)  # Filter a list by a string match
watch_8 = Watch(filterByString.Match)
uniqueId = Element.UniqueId(element=watch_8)
string_2 = StringInput("Area")  # graph input
getParameterValueByName = Element.GetParameterValueByName(parameterName=string_2)  # unwired: element
watch_9 = Watch(getParameterValueByName)
flatten = List.Flatten(list=watch_9)
sum = Math.Sum(values=flatten)

# group: AREA SUM
mass_addition = Custom[Mass Addition](List=sum)  # This node will attempt to sum all elements contained within it.
watch_10 = Watch(mass_addition)

geometry = Element.Geometry()  # unwired: element
flatten_2 = List.Flatten(list=geometry)
string_3 = StringInput("Solid")  # graph input
filterByString_2 = Custom[List.FilterByString](list=flatten_2, String=string_3)
flatten_3 = List.Flatten(list=filterByString_2.Match)
byUnion = Solid.ByUnion(solids=flatten_3)

# group: MASS EXPORT TO SAT. SPECIFIY DIRECTORY & FILE
directory_path = Directory("P:\868 UW Phase 4B\2.0 Design\2.15 Workflow Development\170123_Cost Tracking Bim Integration - Facade")  # graph input
string_4 = StringInput("\Output2")  # graph input
code_block = CodeBlock(dir=directory_path, filename=string_4) { dir + filename; }
exportToSAT = ExportWithUnits(geometry=byUnion, filePath=code_block, SelectedExportedUnitsSource=[0, 1, 2, 3, 5, 4], SelectedExportedUnit=0)
watch_11 = Watch(exportToSAT)
