# Dynamo graph fam.dyn (Dynamo 2.1.0.6544)

# group: LOGIC - AUXILLARY
# note: ________________________________________________________
# note: USES: SECONDARY LOGIC

# group: WRITE DATA - STEP
# note: ________________________________________________________
# note: USES: TEMPORARY/SECONDARY

# group: WRITE DATA - FINAL
# note: ________________________________________________________
# note: USES: OUTPUTS, MODEL CHANGES

# group: WATCH/MISC
# note: ________________________________________________________
# note: USES: HIGHLIGHT, WATCH

# group: LOGIC - SECONDARY
# note: ________________________________________________________
# note: USES: LOGIC, DECISION-MAKING, COMPUTATION

# group: LOGIC - PRIMARY
# note: ________________________________________________________
# note: USES: LOGIC, DECISION-MAKING, COMPUTATION

# group: COLLECT DATA
# note: ________________________________________________________
# note: USES: FILES IN, INFO IN, DATA IN

# group: USER INTERFACE
# note: ________________________________________________________
# note: USES: USER INTERFACE

# group: USER INPUT
# note: ________________________________________________________
# note: USES: INPUT, UI INPUT, DATA IN

# group: Directory Input
directory_path = Directory("P:\872 College of Physicians\2.0 Design\2.1 Design Media\Revit")  # graph input

# group: Collect Files
string = StringInput("rfa")  # graph input
directory_contents_battlebim = Custom[Directory.Contents+(BattleBIM)](directoryPath=directory_path, searchFileType=string)  # This custom node will Return all of the contents
string_2 = StringInput("000")  # graph input
contains = String.Contains(str=directory_contents_battlebim.files, searchFor=string_2)
filterByBoolMask = List.FilterByBoolMask(list=directory_contents_battlebim.files, mask=contains)
fileName = FileSystem.FileName(path=filterByBoolMask.out)

# group: PARSE FAMILY CATEGORIES
string_3 = StringInput("")  # graph input
replace = String.Replace(str=filterByBoolMask.out, searchFor=directory_path, replaceWith=string_3)
string_4 = StringInput("\")  # graph input
split = String.Split(str=replace, separater0=string_4)
number = DoubleInput(1)  # graph input
getItemAtIndex = List.GetItemAtIndex(index=number)  # unwired: list
map = List.Map(list=split, f_x=getItemAtIndex)

# group: PARSE FAMILY NAMES
string_5 = StringInput(".rfa")  # graph input
string_6 = StringInput("")  # graph input
replace_2 = String.Replace(str=fileName, searchFor=string_5, replaceWith=string_6)

# group: WATCH
categories = Watch(map)
file_names = Watch(replace_2)
file_links = Watch(filterByBoolMask.out)

# group: Create Excel Data
create = List.Create(item0=categories, item1=file_names, item2=file_links)
transpose = List.Transpose(lists=create)

# group: Write To Excel
directory_path_2 = Directory("C:\Users\584\Desktop\Temp")  # graph input
string_7 = StringInput("\folder_COP.xlsx")
code_block = CodeBlock(dir=directory_path_2, filename=string_7) { dir + filename; }
watch = Watch(code_block)
string_8 = StringInput("YDrive")
number_2 = DoubleInput(0)
number_3 = DoubleInput(0)
boolean = BoolSelector(true)
exportExcel = Data.ExportExcel(filePath=watch, sheetName=string_8, startRow=number_2, startCol=number_3, data=transpose, overWrite=boolean)  # frozen

# group: README
# note: KieranTimberlake
# Script: Family File Audit of Directory
# Author: Petar Mitev
# Dynamo Version: 1.31
# July, 2017
# Notes: Exports a list of all Revit family files within a specified directory. Exported data includes Family Name, Family Location, and Family Category as determined by the folder structure of the parent directory.
# Dependencies: Clockwork, WombatDynamo, Rhythm, ReAnimation, BattleBIM
# Dynamo Player Ready: No
# Dyno Ready: No
date_time = DateTime("2017-07-11T15:22:00Z")  # graph input
