# Dynamo graph fd2018-03-27.dyn (Dynamo 2.0.0.4654)

# group: Select All Ductwork Within Mech Model
categories = Categories(index=178)  # graph input
all_elements_of_category = ElementsOfCategory(Category=categories)
watch = Watch(all_elements_of_category)

# group: Select Fire Rated Walls From Linked Model
# note: Archilab
get_documents = Custom[Get Documents]()  # Queries all linked Revit files and retrieves their Name, LinkInstance and Document properties.
watch_2 = Watch(get_documents.Link_Doc)
firstItem = List.FirstItem(list=watch_2)
categories_2 = Categories(index=589)  # graph input
get_all_elements_from_linked = Custom[Get All Elements From Linked Model](LinkDoc=firstItem, Category=categories_2)  # This node is based on code posted by Julien Benoit. Big thanks to Julien for sharing his work. This node will retrieve all elements of a given category from a given linked model.
watch_3 = Watch(get_all_elements_from_linked)
elementType = Custom[Element.ElementType+](element=get_all_elements_from_linked)  # Gets the family type of a given element (if applicable). Unlike the OOTB node, it also works for elements in linked models.
code_block = CodeBlock { "Fire Rating"; }
getParameterValueByName = Element.GetParameterValueByName(element=elementType, parameterName=code_block)
code_block_2 = CodeBlock { "2"; }
eq = getParameterValueByName == code_block_2
filterByBoolMask = List.FilterByBoolMask(list=watch_3, mask=eq)
watch_4 = Watch(filterByBoolMask.in)
code_block_3 = CodeBlock()  # //archilab
code_block_4 = CodeBlock()  # //clockwork

# group: Clash Detection Between Fire Rated Walls & Ducts
revit_element_clash_detection_v1 = Custom[Revit Element Clash Detection v1](RevitElementSetA=watch, RevitElementSetB=watch_4)
code_block_5 = CodeBlock()  # //Bakery

# group: Place Fire Damper
family_types = FamilyTypes()  # nothing selected; graph input
transpose = List.Transpose(lists=revit_element_clash_detection_v1.clashPoint)
byPoint = FamilyInstance.ByPoint(familyType=family_types, point=transpose)  # frozen
watch_5 = Watch(transpose)

# group: Split Intersecting Duct at Clash Point
code_block_6 = CodeBlock { "Damper Length"; }  # frozen
getParameterValueByName_2 = Element.GetParameterValueByName(element=byPoint, parameterName=code_block_6)  # frozen

# group: Rotate Fire Damper to Rotation of Duct
code_block_7 = CodeBlock()  # //Clockwork
code_block_8 = CodeBlock()  # //Clockwork
XAxis = Vector.XAxis()
location = Custom[Element.Location+](element=revit_element_clash_detection_v1.clashSetA)  # Returns the location of an element as an XYZ (or if it's line-based the start and end point of the line), along with some booleans to help filtering the results. Use this for some element types (e.g. walls or lines) that do not work with the built-in Get Family Instance Location node.
direction = Line.Direction(line=location.curves)
angleWithVector = Vector.AngleWithVector(vector=XAxis, otherVector=direction)
code_block_9 = CodeBlock { 0.25; }
round = Custom[Math.Round+](dbl=angleWithVector, precision=code_block_9)  # Rounds a number to a specified precision
setRotation = FamilyInstance.SetRotation(familyInstance=byPoint, degree=round)

mep_connector_info = Custom[MEP connector info](Element=setRotation)  # Returns location, connector info and connected elements
watch_6 = Watch(mep_connector_info.ConnectedElements)
select_model_element = DSModelElementSelection()  # nothing selected; graph input
select_model_element_2 = DSModelElementSelection()  # nothing selected; graph input
connectInto = Custom[Element.ConnectInto](Element=select_model_element, Element_2=select_model_element_2)  # Connects terminal elements into pipes or ducts. An optional margin value can be given to define the curve offset length from the terminal if applicable.
