# Dynamo graph grids.dyn (Dynamo 2.1.0.6544)

# group: DOC - WIP
# note: ________________________________________________________
# note: USES: IN PROGRESS, FROZEN, BROKEN

# group: DOC - ANNOTATION
# note: ________________________________________________________
# note: USES: ANNOTATIONS, EXPLANATION

# group: DOC - WATCH
# note: ________________________________________________________
# note: USES: HIGHLIGHT, WATCH

# group: WRITE DATA - STEP
# note: ________________________________________________________
# note: USES: TEMPORARY/SECONDARY MODEL GEOM.

# group: WRITE DATA - FINAL
# note: ________________________________________________________
# note: USES: OUTPUTS, MODEL CHANGES

# group: LISTS & DATA
# note: ________________________________________________________
# note: USES: LISTS, LIST MGMT, DATA

# group: LOGIC - AUXILLARY
# note: ________________________________________________________
# note: USES: SECONDARY LOGIC

# group: LOGIC - SECONDARY
# note: ________________________________________________________
# note: USES: LOGIC, DECISION-MAKING, COMPUTATION

# group: LOGIC - PRIMARY
# note: ________________________________________________________
# note: USES: LOGIC, DECISION-MAKING, COMPUTATION

# group: INPUT - PARSE/MOD
# note: ________________________________________________________
# note: USES: TRANSLATING INPUTS FOR DYNAMO

# group: INPUT - FIXED
# note: ________________________________________________________
# note: USES: FIXED INPUTS, STATIC INPUTS

# group: INPUT - CONTROL
# note: ________________________________________________________
# note: USES: INPUT, UI INPUT, DATA IN

# group: README
# note: KieranTimberlake
# Script: Perforated Screen - Harvard Lowell
# Author: Petar Mitev
# Dynamo Version: 1.31
# September, 2017
# Script Inputs:
# 1. Top and bottom of screen as model curves.
# 2. Physical properties as parameters
# 3. (Optional) - for Baking Solids in Project - File Path of Family Template, Family Names, Family Category
# Script Function & Output:
# 1. Solids of perforated screen
# 2. (Optional) - for Baking Solids in Project - imported family instances of Solid geometry
# 3. (Optional) - for Baking Solids in Family - imported solid extrusions within Revit Family Document
# Dependencies: Springs
# Dynamo Player Ready: No
# Dyno Ready: No
date_time = DateTime("2017-09-12T14:09:00Z")  # graph input

# group: SCREEN #1 PHYSICAL PROPERTIES
screen_2_hole_radius_ft = DoubleSlider(0.5, range=0..4 step 0.1)  # graph input
screen_2_thickness_ft = DoubleSlider(0.5, range=0..100 step 1)  # graph input
screen_2_horizontal_divisions = DoubleSlider(40, range=0..100 step 1)  # graph input
screen_2_vertical_divisions = DoubleSlider(13, range=0..100 step 1)  # graph input
screen_2_top_margin = DoubleSlider(5, range=0..100 step 1)  # graph input
screen_2_bottom_margin = DoubleSlider(8, range=0..100 step 1)  # graph input

# group: BOUNDARY CURVES
# note: Input top and bottom of perforated screen as model curves.
boundary_curves = DSModelElementsSelection()  # nothing selected; graph input

# group: PARSE INPUT - CREATE SURFACE
curve = CurveElement.Curve(curveElement=boundary_curves)
byLoft = PolySurface.ByLoft(crossSections=curve)
# note: This creates a basic polysurface by lofting the input model curves.
surfaces = PolySurface.Surfaces(polySurface=byLoft)

# group: ASSEMBLY PHYSICAL PROPERTIES
wall_thickness_ft = DoubleSlider(0.25, range=0..100 step 1)  # graph input
distance_between_wall_and_screen = DoubleSlider(0.5, range=0..10 step 0.5)  # "Distance Between Wall and Screen (ft)"; graph input
distance_between_screens_ft = DoubleSlider(2, range=0..10 step 0.5)  # graph input

thicken = Surface.Thicken(surface=surfaces, thickness=wall_thickness_ft)
code_block = CodeBlock { 0.5; }
normalAtParameter = Surface.NormalAtParameter(surface=surfaces, u=code_block, v=code_block)
translate = Geometry.Translate(geometry=surfaces, direction=normalAtParameter, distance=distance_between_wall_and_screen)

# group: ATTRACTOR CIRCLES
attractor_circles = DSModelElementsSelection()  # nothing selected; graph input

# group: SCREEN #1 ATTRACTOR PROPERTIES
x_axis_gradient = BoolSelector(true)  # graph input
y_axis_gradient = BoolSelector(true)  # graph input
localization_amount = DoubleSlider(35, range=0..100 step 1)  # graph input
new_min_radius = DoubleSlider(0.1, range=0..100 step 1)  # graph input
new_max_radius = DoubleSlider(1, range=0..3 step 0.01)  # graph input

# group: OUTPUT TOGGLE
toggle_solids_output = BoolSelector(false)  # graph input
toggle_surface_output = BoolSelector(false)  # graph input

dynamicAttractors = Custom[Surface.Perforate.DynamicAttractors](Base_Surface=translate, Attractor_Circles=attractor_circles, XAxisGradient=x_axis_gradient, YAxisGradient=y_axis_gradient, Attractor_Localilzation_Amt=localization_amount, Min_Radius=new_min_radius, Max_Radius=new_max_radius, Screen_Thickness=screen_2_thickness_ft, Horizontal_Divisions=screen_2_horizontal_divisions, Vertical_Divisions=screen_2_vertical_divisions, Top_Margin=screen_2_top_margin, Bottom_Margin=screen_2_bottom_margin, ToggleSolids=toggle_solids_output, ToggleSurfaces=toggle_surface_output)  # Perforate a surface based ona dynamic number of attractor points.
translate_2 = Geometry.Translate(geometry=translate, direction=normalAtParameter, distance=distance_between_screens_ft)

# group: SCREEN #2 ATTRACTOR PROPERTIES
x_axis_gradient_2 = BoolSelector(true)  # graph input
y_axis_gradient_2 = BoolSelector(true)  # graph input
localization_amount_2 = DoubleSlider(35, range=0..100 step 1)  # graph input
new_min_radius_2 = DoubleSlider(0.1, range=0..100 step 1)  # graph input
new_max_radius_2 = DoubleSlider(1, range=0..3 step 0.01)  # graph input

# group: SCREEN #2 PHYSICAL PROPERTIES
screen_2_thickness_ft_2 = DoubleSlider(0.5, range=0..100 step 1)  # graph input
screen_2_horizontal_divisions_2 = DoubleSlider(40, range=0..100 step 1)  # graph input
screen_2_vertical_divisions_2 = DoubleSlider(13, range=0..100 step 1)  # graph input
screen_2_top_margin_2 = DoubleSlider(5, range=0..100 step 1)  # graph input
screen_2_bottom_margin_2 = DoubleSlider(8, range=0..100 step 1)  # graph input
screen_2_hole_radius_ft_2 = DoubleSlider(0.5, range=0..4 step 0.1)  # graph input

# group: OUTPUT TOGGLE
toggle_solids_output_2 = BoolSelector(false)  # graph input
toggle_surface_output_2 = BoolSelector(false)  # graph input

dynamicAttractors_2 = Custom[Surface.Perforate.DynamicAttractors](Base_Surface=translate_2, Attractor_Circles=attractor_circles, XAxisGradient=x_axis_gradient_2, YAxisGradient=y_axis_gradient_2, Attractor_Localilzation_Amt=localization_amount_2, Min_Radius=new_min_radius_2, Max_Radius=new_max_radius_2, Screen_Thickness=screen_2_thickness_ft_2, Horizontal_Divisions=screen_2_horizontal_divisions_2, Vertical_Divisions=screen_2_vertical_divisions_2, Top_Margin=screen_2_top_margin_2, Bottom_Margin=screen_2_bottom_margin_2, ToggleSolids=toggle_solids_output_2, ToggleSurfaces=toggle_surface_output_2)

# group: LIST OF SOLIDS
create = List.Create(item0=thicken, item1=dynamicAttractors.Solid, item2=dynamicAttractors_2.Solid)  # frozen
flatten = List.Flatten(list=create)

# group: BAKE SOLIDS IN PROJECT
file_path = Filename("..\..\..\..\..\Desktop\Temp\family template_materialsPreload02.rft")
code_block_2 = CodeBlock { "Screen_A" + (1..3); }
categories = Categories(index=222)
byGeometry = Custom[Springs.FamilyInstance.ByGeometry](geometry=flatten, familyTemplatePath=file_path, familyName=code_block_2, category=categories)  # frozen; You must provide a valid family template path that will be used for all input geometry objects. The project units(and not the templates) will be used to determine the size of the output geometry. The provided category will be used only if the family template supports it. If not, the default template category will be used instead. Likewise, the family material(provided as a string) will be set only if a material with that name exists in the template. If not, the default material will be used instead ("By Category"). For void cuts, the material settings will be ignored. The Subcategory name is an optional input. If you'd like to skip assigning a Subcategory to any new instance, simply use null. The node expects a unique family name for each geometry object. The rest of the input lists will be processed as if the node lacing is set to longest.
watch = Watch(byGeometry.instance)
watch_2 = Watch(byGeometry.family)
code_block_3 = CodeBlock { ["Brass", "Birch", "Glass"]; }
# note: This will take the Dynamo geometry, turn it into families, and import the families at the location within the project.
# The family template specified must be preloaded with materials if any material inputs are desired. If not, this may be left blank, as well as the rest of the inputs below it.
# If creating more than one family, they must have unique names, and their material inputs must be formatted as a list (if there are any).
boolean = BoolSelector(false)

# group: ALTERNATIVE VOLUME CREATION
extrudeAsSolid = Curve.ExtrudeAsSolid()  # unwired: curve
extrudeAsSolid_2 = Curve.ExtrudeAsSolid()  # unwired: curve
byUnion = Solid.ByUnion(solids=extrudeAsSolid_2)
difference = Solid.Difference(solid=extrudeAsSolid, other=byUnion)

# group: EXPORT SOLIDS AS SAT
file_path_2 = Filename("..\..\..\..\..\Desktop\Temp\export9.sat")  # graph input
exportToSAT = ExportWithUnits(geometry=difference, filePath=file_path_2, SelectedExportedUnitsSource=[0, 1, 2, 3, 5, 4], SelectedExportedUnit=0)
watch_3 = Watch(exportToSAT)
