# Dynamo graph intaudit.dyn (Dynamo 2.1.0.6544)

levels = Levels()  # nothing selected; graph input
all_elements_at_level = ElementsAtLevel(Level=levels)
element_types = ElementTypes(index=341)  # graph input
isOfType = Custom[Element.IsOfType](Element=all_elements_at_level, ElementType=element_types)  # This nodes yields true or false, checking if input elements are of given Element Type.
filterByBoolMask = List.FilterByBoolMask(list=all_elements_at_level, mask=isOfType)
watch = Watch(filterByBoolMask.in)
geometry = Element.Geometry(element=watch)
element_types_2 = ElementTypes(index=132)  # graph input
isOfType_2 = Custom[Element.IsOfType](Element=all_elements_at_level, ElementType=element_types_2)
filterByBoolMask_2 = List.FilterByBoolMask(list=all_elements_at_level, mask=isOfType_2)
watch_2 = Watch(filterByBoolMask_2.in)
geometry_2 = Element.Geometry(element=watch_2)
categories = Categories(index=506)  # graph input
all_elements_of_category = ElementsOfCategory(Category=categories)
doesIntersect = Geometry.DoesIntersect(geometry=geometry_2, other=all_elements_of_category)
flatten = List.Flatten()  # unwired: list
map = List.Map(list=doesIntersect, f_x=flatten)
