# Dynamo graph lego.dyn (Dynamo 2.1.0.6544)

categories = Categories(index=425)  # graph input
all_elements_of_category = ElementsOfCategory(Category=categories)
watch = Watch(all_elements_of_category)
string = StringInput("Room_Name")  # graph input
getParameterValueByName = Element.GetParameterValueByName(element=all_elements_of_category, parameterName=string)
groupByKey = List.GroupByKey(list=all_elements_of_category, keys=getParameterValueByName)
string_2 = StringInput("Room_Name")  # graph input
getParameterValueByName_2 = Element.GetParameterValueByName(element=groupByKey.groups, parameterName=string_2)
string_3 = StringInput("TRIPLE")  # graph input
boolean = BoolSelector(false)  # graph input
contains = String.Contains(str=getParameterValueByName_2, searchFor=string_3, ignoreCase=boolean)
filterByBoolMask = List.FilterByBoolMask(list=groupByKey.groups, mask=contains)
watch_2 = Watch(filterByBoolMask.in)
sort = List.Sort(list=watch_2)
string_4 = StringInput("Room")  # graph input
filterByString = Custom[List.FilterByString](list=sort, String=string_4)  # Filter a list by a string match
watch_3 = Watch(filterByString.Match)
transpose = List.Transpose(lists=watch_3)
watch_4 = Watch(transpose)
uniqueId = Element.UniqueId(element=watch_4)
geometry = Element.Geometry()  # unwired: element
integer_slider = IntegerSlider(255, range=0..255 step 1)  # graph input
integer_slider_2 = IntegerSlider(255, range=0..255 step 1)  # graph input
integer_slider_3 = IntegerSlider(113, range=0..255 step 1)  # graph input
byARGB = Color.ByARGB(r=integer_slider, g=integer_slider_2, b=integer_slider_3)
byGeometryColor = Modifiers.GeometryColor.ByGeometryColor(geometry=geometry, color=byARGB)
flatten = List.Flatten(list=geometry)
string_5 = StringInput("Solid")  # graph input
filterByString_2 = Custom[List.FilterByString](list=flatten, String=string_5)
watch_5 = Watch(filterByString_2.Match)
volume = Solid.Volume(solid=watch_5)
watch_6 = Watch(volume)
sum = Math.Sum(values=watch_6)
VOLUME = Watch(sum)
flatten_2 = List.Flatten(list=filterByString_2.Match)
byUnion = Solid.ByUnion(solids=flatten_2)
exportToSAT = ExportWithUnits(geometry=byUnion, SelectedExportedUnitsSource=[0, 1, 2, 3, 5, 4], SelectedExportedUnit=0)
watch_7 = Watch(exportToSAT)
directory_path = Directory("P:\868 UW Phase 4B\2.0 Design\2.15 Workflow Development\170120_Cost Tracking BIM Integration\Solids Exports")  # graph input
string_6 = StringInput("\test3")  # graph input
code_block = CodeBlock(dir=directory_path, filename=string_6) { dir + filename; }
area = Room.Area(room=watch_3)
watch_8 = Watch(area)
sum_2 = Math.Sum(values=watch_8)
NSF = Watch(sum_2)
