# Dynamo graph panels.dyn (Dynamo 2.1.0.6544)

# group: LISTS & DATA
# note: ________________________________________________________
# note: USES: LISTS, LIST MGMT, DATA

# group: LOGIC - AUXILLARY
# note: ________________________________________________________
# note: USES: SECONDARY LOGIC

# group: DOC - WIP
# note: ________________________________________________________
# note: USES: IN PROGRESS, FROZEN, BROKEN

# group: DOC - ANNOTATION
# note: ________________________________________________________
# note: USES: ANNOTATIONS, EXPLANATION

# group: DOC - WATCH
# note: ________________________________________________________
# note: USES: HIGHLIGHT, WATCH

# group: WRITE DATA - STEP
# note: ________________________________________________________
# note: USES: TEMPORARY/SECONDARY MODEL GEOM.

# group: WRITE DATA - FINAL
# note: ________________________________________________________
# note: USES: OUTPUTS, MODEL CHANGES

# group: LOGIC - SECONDARY
# note: ________________________________________________________
# note: USES: LOGIC, DECISION-MAKING, COMPUTATION

# group: LOGIC - PRIMARY
# note: ________________________________________________________
# note: USES: LOGIC, DECISION-MAKING, COMPUTATION

# group: INPUT - PARSE/MOD
# note: ________________________________________________________
# note: USES: TRANSLATING INPUTS FOR DYNAMO

# group: INPUT - FIXED
# note: ________________________________________________________
# note: USES: FIXED INPUTS, STATIC INPUTS

# group: INPUT - CONTROL
# note: ________________________________________________________
# note: USES: INPUT, UI INPUT, DATA IN

# group: DOC - TAXONOMY
# note: ________________________________________________________
# note: USES: HIERARCHY, TAXONOMY

# group: INPUTS
refresh_element_selection = BoolSelector(false)  # graph input
of_closest_panels_to_consider = DoubleSlider(4, range=1..20 step 0.1)  # graph input
parse_details_on_sheets = BoolSelector(true)  # graph input
detail_name_match = DoubleSlider(50, range=0..100 step 1)  # graph input

# group: FILTER CURTAIN PANELS
categories = Categories(index=142)  # graph input
string_from_object = FromObject(obj=categories)
select_elements_of_category = Python(IN[0]=refresh_element_selection, IN[1]=string_from_object)
# ---------- select_elements_of_category.python (44 lines) ----------
#Sometimes a pick selection is better
#Based on a node from Dimitar Venkov
#adapted by john pierson for rhythm
import clr

clr.AddReference("RevitAPIUI")
from  Autodesk.Revit.UI import *

clr.AddReference("RevitServices")
import RevitServices
from RevitServices.Persistence import DocumentManager
doc = DocumentManager.Instance.CurrentDBDocument
uidoc=DocumentManager.Instance.CurrentUIApplication.ActiveUIDocument

clr.AddReference("RevitNodes")
import Revit
clr.ImportExtensions(Revit.Elements)
TaskDialog.Show('Isolated Selection','Pick elements of category, ' + (IN[1].lower()) + '. Press finish to complete.')

sel1 = uidoc.Selection
obt1 = Selection.ObjectType.Element
class CustomISelectionFilter(Selection.ISelectionFilter):
	def __init__(self, nom_categorie):
		self.nom_categorie = nom_categorie
	def AllowElement(self, e):
		if e.Category.Name == self.nom_categorie:
			return True
		else:
			return False
	def AllowReference(self, ref, point):
		return true
		
el_ref = sel1.PickObjects(obt1, CustomISelectionFilter(IN[1]), 'Pick elements of category, ' + (IN[1].lower()) + ' Press finish to complete.')
typelist = list()
idlist = list()
for i in el_ref:
	
	try:
		typelist.append(doc.GetElement(i.ElementId))
	except:
		typelist.apped(list())
		

OUT = typelist
# ----------------------------------------

# group: PARSE FAMILY NAMES
code_block = CodeBlock(t2=select_elements_of_category)
# ---------- code_block.designscript (9 lines) ----------
polyCurve1 = t2.Boundaries;
t3 = Curves.DeconstructPolyCurve(polyCurve1);
t4 = __TryGetValueFromNestedDictionaries(t3, "Segments");
t5 = __TryGetValueFromNestedDictionaries(t3, "Points");
t6 = DSCore.List.Flatten(t5, 1);
polygon1 = Polygon.ByPoints(t6);
point1 = polygon1.Center();
vector1 = Autodesk.Vector.ByTwoPoints(point1<1>, point1<2>);
t7 = vector1.Length;
# ----------------------------------------
python_script = Python(IN[0]=code_block.t7, IN[1]=of_closest_panels_to_consider)
# ---------- python_script.python (22 lines) ----------
import sys
pyt_path = r'C:\\Program Files (x86)\\IronPython 2.7\\Lib'
sys.path.append(pyt_path)
import clr
clr.AddReference('ProtoGeometry')
from Autodesk.DesignScript.Geometry import *

from heapq import nsmallest

dataEnteringNode = IN

dist_lists = IN[0]
items_consider = IN[1]
min_lists = []


for x in dist_lists:
	min_vals = nsmallest(items_consider, x)
	min_lists.append(min_vals)


OUT = min_lists
# ----------------------------------------
watch = Watch(python_script)
lunchbox_sheet_collector = Custom[LunchBox Sheet Collector](Toggle=parse_details_on_sheets)  # Collects sheets from the current document
code_block_2 = CodeBlock(t7=code_block.t7, t8=watch, t12=select_elements_of_category, t17=lunchbox_sheet_collector.Name, t18=lunchbox_sheet_collector.Element)
# ---------- code_block_2.designscript (16 lines) ----------
t6 = DSCore.List.AllIndicesOf(t7<1L>, t8<1L>);
t9 = Flatten(t6);
x = t8;
t10 = DSCore.List.Count(x[0]);
t11 = DSCore.List.Chop(t9, t10);
t13 = DSCore.List.GetItemAtIndex(t12, t11);
t5 = 1;
t4 = true;
t14 = "VIEWPORT_VIEW_NAME";
t15 = true;
t16 = DSCore.String.Contains(t17, "detail", t15);
t19 = DSCore.List.FilterByBoolMask(t18, t16);
t20 = __TryGetValueFromNestedDictionaries(t19, "in");
t21 = __TryGetValueFromNestedDictionaries(t19, "out");
element1 = Archilab.Sheet.Viewports(t20);
t1 = "";
# ----------------------------------------
firstItem = List.FirstItem()  # unwired: list
map = List.Map(list=code_block_2.t13, f_x=firstItem)
dropItems = List.DropItems(amount=code_block_2.t5)  # unwired: list
map_2 = List.Map(list=code_block_2.t13, f_x=dropItems)
get_built_in_parameter = Custom[Get Built In Parameter](ParameterNames=code_block_2.t14, Elements=code_block_2.element1@L2)  # This node will take an input of a built in parameter name and element to return that parameters value.
code_block_3 = CodeBlock(t2=map, t3=map_2, t9=code_block_2.t4, t17=get_built_in_parameter)
# ---------- code_block_3.designscript (22 lines) ----------
boundingBox1 = t2.BoundingBox;
boundingBox2 = t3.BoundingBox;
t4 = boundingBox1.Intersects(boundingBox2);
t5 = GetKeys(t4);
t6 = DSCore.List.GetItemAtIndex(t2, t5);
familyinstance1 = t6.AsFamilyInstance();
familytype1 = familyinstance1.Type;
t7 = familytype1.Name;
t8 = DSCore.List.AllIndicesOf(t4@-2<1>, t9);
t10 = DSCore.List.GetItemAtIndex(t3@-2<1>, t8@-2<1>);
familyinstance2 = t10.AsFamilyInstance();
familytype2 = familyinstance2.Type;
t11 = familytype2.Name;
a = t7;
b = t11;
t1 = (a + " to ") + b;
t12 = Manage.RemoveNulls(t1);
t13 = __TryGetValueFromNestedDictionaries(t12, "Cleaned");
t14 = __TryGetValueFromNestedDictionaries(t12, "Indices");
t15 = Flatten(t13);
t16 = DSCore.List.UniqueItems(t15);
t18 = Flatten(t17);
# ----------------------------------------
python_script_2 = Python(IN[0]=code_block_3.t16, IN[1]=code_block_3.t18, IN[2]=code_block_2.t1)
# ---------- python_script_2.python (49 lines) ----------
import sys
pyt_path = r'C:\\Program Files (x86)\\IronPython 2.7\\Lib'
sys.path.append(pyt_path)
import clr
clr.AddReference('ProtoGeometry')
from Autodesk.DesignScript.Geometry import *

from difflib import SequenceMatcher

import datetime
datetime.datetime.now()

dataEnteringNode = IN

sorted_list = []
sorted_detail_list = []
sorted_detail_strings = []
sorted_strings = []
exist_list = []
match_list = []
original_list = IN[0]
detail_list = IN[1]

def similar(a, b):
	return SequenceMatcher(None, a, b).ratio()

for i in original_list:
	result = sorted(i)
	if result not in sorted_list:
		sorted_list.append(result)
	else : exist_list.append(i)

for x in detail_list:
	result2 = sorted(x)
	if result2 not in sorted_detail_list:
		sorted_detail_list.append(result2)

sorted_detail_strings = map(IN[2].join, sorted_detail_list)
sorted_strings = map(IN[2].join, sorted_list)

for n in sorted_strings:
	#percent_match = similar(n, sorted_strings)
	#percent_match = map(similar, n, sorted_strings)
	percent_match = [similar(n, x) for x in sorted_detail_strings]
	match_list.append(percent_match)

timer = datetime.datetime.now()

OUT = sorted_list, exist_list, sorted_detail_strings, sorted_strings, match_list, timer
# ----------------------------------------
watch_2 = Watch(python_script_2)
tolerance_for_string_comparison = Watch(detail_name_match)
code_block_4 = CodeBlock(t12=watch_2, t13=tolerance_for_string_comparison, familytype1=code_block_3.familytype1, t19=code_block_3.t16, t24=code_block_3.t7)
# ---------- code_block_4.designscript (28 lines) ----------
x = t12;
x1 = t12;
x2 = t12;
x3 = t12;
X = t13;
t3 = X / 100;
t14 = x3[4] > t3;
t15 = DSCore.List.AllIndicesOf(t14@-2<1>, true);
x4 = t12;
t11 = x4[5];
t16 = DSCore.List.UniqueItems(familytype1);
t17 = DSCore.List.Count(t16);
x5 = t12;
t18 = DSCore.List.AllIndicesOf(t19, x5[1]);
t20 = Flatten(t18);
t21 = DSCore.List.RemoveItemAtIndex(t19, t20);
t22 = DSCore.List.Count(t21);
t23 = Flatten(t24);
t25 = DSCore.List.UniqueItems(t23);
t26 = Math.Average(x3[4]);
X1 = t26;
t4 = (Math.Ceiling(X1 * 100)) + "%";
t27 = DSCore.List.MaximumItem(x3[4]);
X2 = t27;
t1 = (Math.Ceiling(X2 * 100)) + "%";
a = t4;
b = t1;
t2 = (("AVG = " + a) + " | MAX = ") + b;
# ----------------------------------------

# group: README
# note: KieranTimberlake
# Script: Curtain Panel Location
# Author: Petar Mitev
# Dynamo Version: 1.31
# October, 2017
# Script Inputs:
# 1. Curtain wall elements
# 2. Attractor panel
# 3. Closest Panels Tolerance
# Script Function & Output:
# 1. Color gradient will be applied to the curtain wall elements based on their distance from the attractor panel
# 2. A selection will be made of the panels which are within the %threshold specified.
# 3. Within this selection, unique assemblies and joint conditions will be identified as "suggested details".
# Dependencies: None
# Dynamo Player Ready: No
# Dyno Ready: No
date_time = DateTime("2017-10-03T10:40:00Z")

# group: CHECK IF DETAIL ALREADY IN MODEL
anyTrue = Custom[List.AnyTrue](seq=code_block_4.t14)  # Returns true if any item in a list of booleans is true.

# group (continued): PARSE FAMILY NAMES
code_block_5 = CodeBlock(t1=code_block_4.t21, t2=anyTrue)
# ---------- code_block_5.designscript (3 lines) ----------
t3 = DSCore.List.FilterByBoolMask(t1, t2);
t4 = __TryGetValueFromNestedDictionaries(t3, "in");
t5 = __TryGetValueFromNestedDictionaries(t3, "out");
# ----------------------------------------

# group: WATCH
number_of_unique_panel_types = Watch(code_block_4.t17)
neighbor_conditions_within = Watch(code_block_3.t15)  # "Neighbor Conditions within Selection"
number_of_suggested_details = Watch(code_block_4.t22)
suggested_details_within = Watch(code_block_4.t21)  # "Suggested Details within Selection"
unique_panel_names = Watch(code_block_4.t25)
suggested_details_not_already_on = Watch(code_block_5.t5)  # "Suggested Details not already on Sheets"
likelihood_that_detail_exists = Watch(code_block_4.t2)
end_time = Watch(code_block_4.t11)
