# Dynamo graph renum.dyn (Dynamo 2.1.0.6544)

select_model_element = DSModelElementSelection()  # nothing selected; graph input
curve = CurveElement.Curve(curveElement=select_model_element)
integer_slider = IntegerSlider(50, range=0..100 step 1)  # graph input
pointsAtEqualSegmentLength = Curve.PointsAtEqualSegmentLength(curve=curve, divisions=integer_slider)
firstItem = List.FirstItem(list=pointsAtEqualSegmentLength)
levels = Levels()  # nothing selected; graph input
all_elements_at_level = ElementsAtLevel(Level=levels)
categories = Categories(index=425)  # graph input
isOfCategory = Custom[Element.IsOfCategory](element=all_elements_at_level, category=categories)  # Checks whether an element is of a specified category
filterByBoolMask = List.FilterByBoolMask(list=all_elements_at_level, mask=isOfCategory)
watch = Watch(filterByBoolMask.in)
filterByBoolMask_2 = List.FilterByBoolMask(list=watch)  # unwired: mask
watch_2 = Watch(filterByBoolMask_2.in)
boundingBox = Geometry.BoundingBox(geometry=watch)
contains = BoundingBox.Contains(boundingBox=boundingBox)  # unwired: point
map = List.Map(list=pointsAtEqualSegmentLength, f_x=contains)
map_2 = List.Map(list=map, f_x=filterByBoolMask_2.in)
flatten = List.Flatten(list=map_2)
uniqueItems = List.UniqueItems(list=flatten)
watch_to_reorder = Watch(uniqueItems)
string = StringInput("Number")  # graph input
integer_slider_2 = IntegerSlider(800, range=0..10000 step 1)  # graph input
count = List.Count(list=watch_to_reorder)
integer_slider_3 = IntegerSlider(1, range=0..100 step 1)  # graph input
sequence = Sequence(start=integer_slider_2, amount=count, step=integer_slider_3, lacing=Longest)
string_from_object = FromObject(obj=sequence)
setParameterByName = Element.SetParameterByName(element=watch_to_reorder, parameterName=string, value=string_from_object)
select_model_elements = DSModelElementsSelection()  # nothing selected; graph input
