# Dynamo graph roomsbad.dyn (Dynamo 2.1.0.6544)

boolean = BoolSelector(false)  # graph input
room_element_collector = Custom[Room Element Collector](RunMe=boolean)  # THis will collect data regarding rooms in the active model. Similar to Lunchbox node, but this one does not use python.
create = List.Create(item0=room_element_collector.Name, item1=room_element_collector.Number, item2=room_element_collector.Level_Name)  # unwired: item3, item4
watch = Watch(create)
lunchbox_room_element_collector = Custom[LunchBox Room Element Collector](Toggle=boolean)  # Collects rooms from the Revit document
boolean_2 = BoolSelector(true)  # graph input
percentGlazingByOrientation = Custom[Rhythm.PercentGlazingByOrientation](RunMe=boolean_2)  # This node was show at RTCNA2015 to optimize your workflows. It reports the window to wall % by direction the wall faces.
watch_2 = Watch(percentGlazingByOrientation.East)
watch_3 = Watch(percentGlazingByOrientation.North)
watch_4 = Watch(percentGlazingByOrientation.West)
watch_5 = Watch(percentGlazingByOrientation.South)
categories = Categories(index=142)  # graph input
all_elements_of_category = ElementsOfCategory(Category=categories)
watch_6 = Watch(all_elements_of_category)
asFamilyInstance = CurtainPanel.AsFamilyInstance(curtainPanel=all_elements_of_category)
watch_7 = Watch(asFamilyInstance)
transpose = List.Transpose(lists=watch_7)
watch_8 = Watch(transpose)
string = StringInput("Wood Panel")  # graph input
filterByString = Custom[List.FilterByString](list=watch_8, String=string)  # Filter a list by a string match
watch_9 = Watch(filterByString.Match)
uniqueId = Element.UniqueId(element=watch_9)
string_2 = StringInput("Area")  # graph input
getParameterValueByName = Element.GetParameterValueByName(parameterName=string_2)  # unwired: element
watch_10 = Watch(getParameterValueByName)
flatten = List.Flatten(list=watch_10)
sum = Math.Sum(values=flatten)
mass_addition = Custom[Mass Addition](List=sum)  # This node will attempt to sum all elements contained within it.
watch_11 = Watch(mass_addition)
geometry = Element.Geometry()  # unwired: element
flatten_2 = List.Flatten(list=geometry)
string_3 = StringInput("Solid")  # graph input
filterByString_2 = Custom[List.FilterByString](list=flatten_2, String=string_3)
flatten_3 = List.Flatten(list=filterByString_2.Match)
byUnion = Solid.ByUnion(solids=flatten_3)
directory_path = Directory("P:\868 UW Phase 4B\2.0 Design\2.15 Workflow Development\170123_Cost Tracking Bim Integration - Facade")  # graph input
string_4 = StringInput("\Output2")  # graph input
code_block = CodeBlock(dir=directory_path, filename=string_4) { dir + filename; }
exportToSAT = ExportWithUnits(geometry=byUnion, filePath=code_block, SelectedExportedUnitsSource=[0, 1, 2, 3, 5, 4], SelectedExportedUnit=0)
watch_12 = Watch(exportToSAT)
