# Dynamo graph rr.dyn (Dynamo 2.1.0.6544)

# group: DOC - WIP
# note: ________________________________________________________
# note: USES: IN PROGRESS, FROZEN, BROKEN

# group: DOC - ANNOTATION
# note: ________________________________________________________
# note: USES: ANNOTATIONS, EXPLANATION

# group: DOC - WATCH
# note: ________________________________________________________
# note: USES: HIGHLIGHT, WATCH

# group: WRITE DATA - STEP
# note: ________________________________________________________
# note: USES: TEMPORARY/SECONDARY MODEL GEOM.

# group: WRITE DATA - REVIT
# note: ________________________________________________________
# note: USES: OUTPUTS, MODEL CHANGES

# group: LOGIC - AUXILLARY
# note: ________________________________________________________
# note: USES: SECONDARY LOGIC

# group: LOGIC - SECONDARY
# note: ________________________________________________________
# note: USES: LOGIC, DECISION-MAKING, COMPUTATION

# group: LOGIC - PRIMARY
# note: ________________________________________________________
# note: USES: LOGIC, DECISION-MAKING, COMPUTATION

# group: INPUT - PARSE/MOD
# note: ________________________________________________________
# note: USES: TRANSLATING INPUTS FOR DYNAMO

# group: INPUT - FIXED
# note: ________________________________________________________
# note: USES: FIXED INPUTS, STATIC INPUTS

# group: INPUT - CONTROL
# note: ________________________________________________________
# note: USES: INPUT, UI INPUT, DATA IN

# group: LISTS & DATA
# note: ________________________________________________________
# note: USES: LISTS, LIST MGMT, DATA

# group: RHINO FILE
# note: Select your Rhino model location using this node.
file_path = Filename("..\..\..\..\..\Desktop\Temp\test\UCSF - 170801_MonumentalStair_03v3.3dm")  # graph input

# group: README
# note: KieranTimberlake
# Script: Rhino Geometry to Revit
# Author: Petar Mitev
# Dynamo Version: 1.31
# August, 2017
# Script Inputs:
# 1. Filepath of Rhino File.
# Script Function & Output:
# 1. Model is created in Rhino with appropriate layers.
# 2. Revit is opened, and a new family document is started (I used furniture template).
# 3. Dynamo is opened, and the created script is run. It will ask for the location of your Rhino file.
# 4. The Rhino geometry is now imported into your open family document. You can assign materials individually to each piece.
# 5. Family document is saved, closed, and loaded into your project.
# Dependencies: Springs, Rhynamo
# Dynamo Player Ready: No
# Dyno Ready: No
date_time = DateTime("2017-07-11T15:22:00Z")  # graph input

extractSolids = PolySurface.ExtractSolids()  # unwired: polySurface
extractSolids_2 = PolySurface.ExtractSolids()  # unwired: polySurface
extractSolids_3 = PolySurface.ExtractSolids()  # unwired: polySurface
extractSolids_4 = PolySurface.ExtractSolids()  # unwired: polySurface
extractSolids_5 = PolySurface.ExtractSolids()  # unwired: polySurface

# group: COLLECT RHINO OBJECTS PER LAYER
string = StringInput("RUNGS")  # graph input
string_2 = StringInput("1_CONC")  # graph input
string_3 = StringInput("1_MTL")  # graph input
extractSolids_6 = PolySurface.ExtractSolids()  # unwired: polySurface
create = List.Create(item0=extractSolids, item1=extractSolids_6)
flatten = List.Flatten(list=create)
extractSolids_7 = PolySurface.ExtractSolids()  # unwired: polySurface
create_2 = List.Create(item0=extractSolids_2, item1=extractSolids_7)
flatten_2 = List.Flatten(list=create_2)
extractSolids_8 = PolySurface.ExtractSolids()  # unwired: polySurface
create_3 = List.Create(item0=extractSolids_3, item1=extractSolids_8)
flatten_3 = List.Flatten(list=create_3)
extractSolids_9 = PolySurface.ExtractSolids()  # unwired: polySurface
create_4 = List.Create(item0=extractSolids_4, item1=extractSolids_9)
flatten_4 = List.Flatten(list=create_4)
extractSolids_10 = PolySurface.ExtractSolids()  # unwired: polySurface
create_5 = List.Create(item0=extractSolids_5, item1=extractSolids_10)
flatten_5 = List.Flatten(list=create_5)
string_4 = StringInput("GRD FRM & HRL")  # graph input
string_5 = StringInput("S-BEAM")  # graph input

# group: COLLECT SOLIDS
create_6 = List.Create(item0=flatten, item1=flatten_2, item2=flatten_3, item3=flatten_4, item4=flatten_5)
flatten_6 = List.Flatten(list=create_6)

# group: CREATE FORMS IN FAMILY DOC
# note: Connect the Output wire from either Flatten node to the geometry Input of the Springs.Form.ByGeometry Node based on whether or not you want to import all of your Rhino layers.
byGeometry = Custom[Springs.Form.ByGeometry](geometry=flatten_6)  # Convert the input geometry to a Revit Form object. Forms can exist only in the family environment. You can convert complicated solids or surfaces directly into forms. A form can act as a void. Provide either one true boolean value to convert a form into a void. The node's lacing is set to longest by default.

# group: COLLECT ALL RHINO OBJECTS IN FILE
extractSolids_11 = PolySurface.ExtractSolids()  # unwired: polySurface
extractSolids_12 = PolySurface.ExtractSolids()  # unwired: polySurface

# group: COLLECT SOLIDS
create_7 = List.Create(item0=extractSolids_11, item1=extractSolids_12)
flatten_7 = List.Flatten(list=create_7)

# group: MODEL
watch = Watch()  # unwired: arg0

# group: MODEL
watch_2 = Watch()  # frozen; unwired: arg0
